vi "Run (lvsound2).gvi"   [LabVIEW NXG 4.0.0]
# The main audio output loop.
# Priority: Time Critical
# Execution System: Instrument I/O
inputs:
  "Audio Output Queue": Queue<"Audio Output Queue Type.gtype">, required
  "error in (no error)": error
outputs:
  "error out": error
types:
  "Audio Output Queue Type.gtype" = cluster{"Master": waveform<i16>[], "Headphones": waveform<i16>[]}
  "Audio Output Info.gtype" = cluster{"Enable": bool, "Output ID": i32}
  "Audio Output Config.gtype" = cluster{"Master": "Audio Output Info.gtype", "Headphones": "Audio Output Info.gtype"}
  "Message Cluster.gtype" = cluster{"Event": string, "Source": string, "Target": string, "Data": variant}
  "Sound Data Format.gtype" = cluster{"sample rate (S/s)": f64, "number of channels": i32, "bits per sample": i32}
uses:
  NI::G Core::Sound::Output::Sound Output Stop.gvi
  NI::G Core::Sound::Output::Sound Output Clear.gvi
  NI::G Core::Error::Legacy::Clear Errors.gvi
  NI::G Core::Sound::Output::Sound Output Configure.gvi
  NI::G Core::Sound::Output::Sound Output Start.gvi
  NI::G Core::Sound::Output::Sound Output Write::Sound Output Write (I16).gvi
  Messaging::Update UI.gvi
diagram:
  Obtain Queue(element data type="Message Cluster.gtype" {all zero or empty}, max queue size=50, name="AudioOutput") -> (created new?=w1, queue out=w2)
  s1 = "Init"  # shift register
  s2 = uninitialised  # shift register
  s3 = $"error in (no error)"  # shift register
  s4 = no error  # shift register
  s5 = uninitialised  # shift register
  s6 = "Audio Output Config.gtype" {all zero or empty}  # shift register
  while (after w1) {
    # Smallest buffer would probably be 256 samples, which is 5.8ms.
    Wait(time to wait=5)
    Dequeue Element(queue=w2, timeout in ms=0) -> (element=w3, queue out=w4, timed out?=w5)
    case (w5) {
      frame False, Default {
        Property Node(instance in=w3) -> ("Data"=w8, "Event"=w9)
        Variant To Data(type="Audio Output Config.gtype" {all zero or empty}, variant=w8) -> (data=w7)
        Scan From String(inputString=w9, default="Init") -> (out0=w6)
      }
      frame True {
        w6 = s1
        w7 = s6
      }
    }
    case (w6) {
      frame "Init", Default {
        w10 = s2
        w11 = s3
        w12 = "Configure"
        w13 = default
        w14 = s4
        w15 = s5
        w16 = "Audio Output Config.gtype" {TRUE, 0, FALSE, 0}
      }
      frame "Configure" {
        call "Sound Output Stop.gvi"(task ID in=s2, error in=s3) -> (task ID out=w17, error out=w18)
        call "Sound Output Clear.gvi"(task ID=w17, error in=w18) -> (error out=w19)
        call "Sound Output Stop.gvi"(task ID in=s5) -> (task ID out=w20, error out=w21)
        call "Sound Output Clear.gvi"(task ID=w20, error in=w21) -> (error out=w22)
        Merge Errors(w19, w22) -> (error out=w23)
        call "Clear Errors.gvi"(specific error code to clear=-11, error in=w23) -> (error out=w24)
        Property Node(instance in=w7) -> ("Master"=w25, "Headphones"=w26)
        Property Node(instance in=w25) -> ("Enable"=w27, "Output ID"=w28)
        Tag Read(ref in="Globals::Constants.grsc::Output Buffer Size") -> (Data=w29)
        Tag Read(ref in="Globals::Constants.grsc::Sample Rate") -> (Data=w30)
        Tag Read(ref in="Globals::Constants.grsc::Channels") -> (Data=w31)
        Tag Read(ref in="Globals::Constants.grsc::Depth") -> (Data=w32)
        Property Node(instance in="Sound Data Format.gtype" {all zero or empty}, "sample rate (S/s)"=w30, "number of channels"=w31, "bits per sample"=w32) -> (instance out=w33)
        case (w27) {
          frame False, Default {
            w10 = 0x0
            w34 = no error
          }
          frame True {
            call "Sound Output Configure.gvi"(device ID=w28, sound format=w33, number of samples/ch=w29) -> (task ID=w35, error out=w36)
            call "Sound Output Start.gvi"(task ID in=w35, error in=w36) -> (task ID out=w10, error out=w34)
          }
        }
        Property Node(instance in=w26) -> ("Enable"=w37, "Output ID"=w38)
        case (w37) {
          frame False, Default {
            w15 = 0x0
            w39 = no error
          }
          frame True {
            call "Sound Output Configure.gvi"(device ID=w38, sound format=w33, number of samples/ch=w29) -> (task ID=w40, error out=w41)
            call "Sound Output Start.gvi"(task ID in=w40, error in=w41) -> (task ID out=w15, error out=w39)
          }
        }
        Merge Errors(w34, w39) -> (error out=w11)
        w12 = "Output"
        w13 = default
        w14 = default
        w16 = w7
      }
      frame "Output" {
        Dequeue Element(error in=s3, queue=$"Audio Output Queue", timeout in ms=0) -> (element=w42, error out=w43, timed out?=w44)
        case (w44) {
          frame False, Default {
            Property Node(instance in=w7) -> ("Master:Enable"=w45, "Headphones:Enable"=w46)
            Logical Or(w45, w46) -> w47
            # If both outputs disabled, simulate audio loop timing to keep audio processing loop running at correct speed.
            case (w47) {
              frame False, Default {
                Tag Read(ref in="Globals::Constants.grsc::Output Buffer Size") -> (Data=w48)
                Tag Read(ref in="Globals::Constants.grsc::Sample Rate") -> (Data=w49)
                Divide(x=w48, y=w49) -> w50
                Multiply(w50, 1000) -> w51
                Wait(time to wait=w51)
              }
              frame True { }
            }
            Property Node(instance in=w42) -> ("Master"=w52, "Headphones"=w53)
            case (w45) {
              frame False, Default {
                w10 = s2
                w54 = w43
              }
              frame True {
                call "Sound Output Write (I16).gvi"(task ID in=s2, data=w52, error in=w43) -> (task ID out=w10, error out=w54)
              }
            }
            case (w46) {
              frame False, Default {
                w15 = s5
                w55 = w43
              }
              frame True {
                call "Sound Output Write (I16).gvi"(task ID in=s5, data=w53, error in=w43) -> (task ID out=w15, error out=w55)
              }
            }
            Merge Errors(w54, w55) -> (error out=w11)
            Feedback Node[DelayCount=3](input=w56) -> w57
            call "Update UI.gvi"(ID="Mixer", Target="Channel1.LevelIndicator", Data=w57) -> (error out=w58)
            Array Index(array=w52) -> (out0[_]=w59, out1[_]=w60)
            Property Node(instance in=w59) -> ("Y"=w61)
            Array Max And Min(array=w61) -> (max value=w62)
            Divide(x=w62, y=1638.4) -> w63
            To Unsigned 8 Bit Integer(number=w63) -> w56
            Feedback Node[DelayCount=3](input=w64) -> w65
            call "Update UI.gvi"(ID="Mixer", Target="Channel2.LevelIndicator", Data=w65) -> (error out=w66)
            # This value is 32768 / 20
            # Convert from I16 to DBL, then multiply by 20 for 20 LED output levels
            Property Node(instance in=w60) -> ("Y"=w67)
            Array Max And Min(array=w67) -> (max value=w68)
            Divide(x=w68, y=1638.4) -> w69
            To Unsigned 8 Bit Integer(number=w69) -> w64
            w16 = w7
          }
          frame True {
            w11 = w43
            w10 = s2
            w15 = s5
            w16 = w7
          }
        }
        w12 = "Output"
        w13 = default
        w14 = default
      }
      frame "Error" {
        Property Node(instance in=s3) -> ("code"=w70)
        case (w70) {
          frame Default {
            w14 = s3
          }
          frame 0..1 {
            w14 = no error
          }
        }
        w10 = s2
        w11 = no error
        w12 = "Shutdown"
        w13 = default
        w15 = s5
        w16 = w7
      }
      frame "Shutdown" {
        Release Queue(queue=w4)
        call "Sound Output Stop.gvi"(task ID in=s2, error in=s3) -> (task ID out=w71, error out=w72)
        call "Sound Output Clear.gvi"(task ID=w71, error in=w72) -> (error out=w73)
        call "Sound Output Stop.gvi"(task ID in=s5, error in=s3) -> (task ID out=w74, error out=w75)
        call "Sound Output Clear.gvi"(task ID=w74, error in=w75) -> (error out=w76)
        Merge Errors(w73, w76) -> (error out=w77)
        call "Clear Errors.gvi"(specific error code to clear=-11, error in=w77) -> (error out=w11)
        w10 = 0x0
        w12 = "Shutdown"
        w13 = TRUE
        w14 = s4
        w15 = 0x0
        w16 = w7
      }
    }
    Select(s=w11, t="Error", f=w12) -> w78
    next s1 = w78
    next s2 = w10
    next s3 = w11
    next s4 = w14
    next s5 = w15
    next s6 = w16
    stop if w13
  }
  $"error out" <- s4
