vi "Get File Extension (Reentrant).gvi"   [LabVIEW Conversion 4.0.0]
# Returns the file extension, without the period (.), of a file you specify.
inputs:
  "file": path, required  # file specifies the path to the file whose extension you want LabVIEW to return.
  "error in (no error)": error
outputs:
  "unmodified file extension": string  # unmodified file extension returns the extension of the file you specify in file, without the period (.). Unlike lowercase file extension, unmodified file extension matches the case of the original file extension.
  "dup file": path  # dup file returns file unchanged.
  "lowercase file extension": string  # lowercase file extension returns the extension of the file, without the period (.). LabVIEW always returns a lowercase file extension, even if file contains uppercase letters.
  "filename without extension": string  # filename without extension returns the name of the file you specify in file without the directory path, period (.), or file extension. Unlike lowercase file extension, filename without extension matches the case of the original filename.
  "error out": error
diagram:
  $"dup file" <- $file
  # Get all characters after the last period in the filename
  case ($"error in (no error)") {
    frame No Error {
      Strip Path(path=$file) -> (name=w4)
      Match Pattern(regular expression="\\.[~\\.]*$", string=w4) -> (before substring=w2, match substring=w5)
      String Subset(offset (0)=1, string=w5) -> w3
      To Lower Case(string=w3) -> w1
    }
    frame Error {
      w1 = default
      w2 = default
      w3 = default
    }
  }
  $"filename without extension" <- w2
  $"lowercase file extension" <- w1
  $"unmodified file extension" <- w3
  $"error out" <- $"error in (no error)"
