vi "Load Async.gvi"   [LabVIEW NXG 4.0.0]
# This VI loads an audio track, placing the audio data into the specified DVR.
# Priority: Background
# Execution System: Other 1
inputs:
  "Audio Data Reference": DataValueReference<i16[][]>, required
  "Path": path, required
  "Message Queue": Queue<"Message Cluster.gtype">, required
  "error in (no error)": error
  "Deck ID": string, required
outputs:
  "error out": error
types:
  "Message Cluster.gtype" = cluster{"Event": string, "Source": string, "Target": string, "Data": variant}
  "Audio File Info.gtype" = cluster{"Length (Samples)": i32, "Channels": i32, "Sample Rate (Hz)": i32, "Path": path, "BPM": f64, "Cue Points (Samples)": i32[]}
uses:
  Audio File Input::Get File Extension (Reentrant).gvi
  Audio File Input::Load WAV.gvi
  Audio File Input::Load MP3.gvi
  NI::Analysis::Resampling::Resample N Waveforms (single shot).gvi
  Audio Processing::I16 To DBL.gvi
  NI::Analysis::Statistics::RMS (DBL).gvi
  Messaging::Send.gvi
diagram:
  case ($"error in (no error)") {
    frame No Error {
      call "Get File Extension (Reentrant).gvi"(file=$Path, error in (no error)=$"error in (no error)") -> (dup file=w2, lowercase file extension=w3, error out=w4)
      # #TODO
      # Up mix/down mix non-stereo audio files to two channels
      case (w3) {
        frame "wav", Default {
          call "Load WAV.gvi"(Path=w2, error in (no error)=w4) -> (Channels=w7, Sample Rate (Hz)=w8, data=w6, error out=w5)
        }
        frame "mp3" {
          call "Load MP3.gvi"(Path=w2, error in (no error)=w4) -> (Channels=w7, Sample Rate (Hz)=w8, data=w6, error out=w5)
        }
      }
      Tag Read(ref in="Globals::Constants.grsc::Sample Rate") -> (Data=w9)
      Is Equal(x=w8, y=w9) -> w10
      Is Equal To 0(x=w9) -> w11
      Logical Or(w10, w11) -> w12
      # #NOTE
      # This VI runs at the lowest execution priority, so as not to interrupt playback.
      # #BUG
      # Single shot resample of longer 48kHz tracks throws out of memory error.
      case (w12) {
        frame False, Default {
          Reciprocal(x=w9) -> w15
          # Resample to the output sample rate.
          call "Resample N Waveforms (single shot).gvi"(signal=w6, resampled dt=w15, interpolation mode="spline"(2), error in=w5) -> (resampled signal=w16, error out=w14)
          Waveform To Signed 16 Bit Integer(number=w16) -> (16bit integer=w13)
        }
        frame True {
          w13 = w6
          w14 = w5
        }
      }
      for {
        w17 = each element of w13
        Property Node(instance in=w17) -> ("Y"=w19)
        append w19 to w18
      }
      in-place {
        Read Poser(ro0=$"Audio Data Reference")
        Write Poser(wi0=w18) -> (wo1=w20)
      }
      # Determine Length here after resampling
      Matrix Size(matrix=w18) -> (number of columns=w21)
      Multiply(2, 1024) -> w22
      Initialize Array(element=0, size=w22) -> w23
      s1 = w23  # shift register
      s2 = w23  # shift register
      for (iteration -> i1) {
        w24 = each element of w18
        Divide(x=w21, y=1024) -> w25
        for (N = 1024) (iteration -> i2) {
          Multiply(w25, i2) -> w28
          Array Subset(array=w24, index0=w28, length0=w25) -> w29
          call "I16 To DBL.gvi"(Audio Data (1D I16)=w29) -> (Audio Data (1D DBL)=w30)
          Array Max And Min(array=w30) -> (max value=w31, min value=w32)
          Build Array(w31, w32) -> w33
          call "RMS (DBL).gvi"(x=w30) -> (rms value=w34)
          Negate(x=w34) -> w35
          Build Array(w34, w35) -> w36
          concatenate w33 onto w26
          concatenate w36 onto w27
        }
        Add(s1, w27) -> w37
        Add(s2, w26) -> w38
        next s1 = w37
        next s2 = w38
      }
      Increment(x=i1) -> w39
      Build Array(s2, s1) -> w40
      Divide(x=w40, y=w39) -> w41
      Concatenate Strings($"Deck ID", ".Waveform") -> w42
      Property Node(instance in="Message Cluster.gtype" {all zero or empty}, "Event"="Value Change", "Target"=w42, "Data"=w41) -> (instance out=w43)
      call "Send.gvi"(Queue Name="UI", Message=w43) -> (error out=w44)
      Merge Errors(w20, w14, w44) -> (error out=w45)
      Property Node(instance in="Audio File Info.gtype" {all zero or empty}, "Length (Samples)"=w21, "Channels"=w7, "Sample Rate (Hz)"=w8, "Path"=$Path, "Cue Points (Samples)"=[-1, -1, -1]) -> (instance out=w46)
      case (w45) {
        frame No Error {
          w47 = "Track Loaded"
        }
        frame Error {
          w47 = "File Error"
        }
      }
      Property Node(instance in="Message Cluster.gtype" {all zero or empty}, "Event"=w47, "Data"=w46) -> (instance out=w48)
      Enqueue Element(element=w48, queue=$"Message Queue", timeout in ms=0) -> (error out=w49)
      Merge Errors(w45, w49) -> (error out=w1)
    }
    frame Error {
      w1 = $"error in (no error)"
    }
  }
  $"error out" <- w1
