vi "Load MP3.gvi"   [LabVIEW NXG 4.0.0]
# Loads an MP3 file from disk.
# Priority: Background priority (lowest)
inputs:
  "Path": path, required
  "error in (no error)": error
outputs:
  "Channels": i32
  "Sample Rate (Hz)": i32
  "data": waveform<i16>[]
  "error out": error
  "Length (Samples)": i32
uses:
  My Computer::labview_audio_codecs_x64.sli::load_mp3_w
  My Computer::LabVIEW.sli::MoveBlock
  My Computer::labview_audio_codecs_x64.sli::free_mp3
diagram:
  w1 = u16[] []  # U16 Array
  Path To String(path=$Path) -> (string=w2)
  String To Byte Array(encoding="UTF-16", string=w2) -> (unsigned byte array=w3)
  Type Cast(type=w1, x=w3) -> w4
  Swap Bytes(data=w4) -> (byte swapped=w5)
  Build Array(w5, 0) -> w6
  # #TODO
  # Use path to DLL
  # Append null character
  call "load_mp3_w"(file_name in=w6, num_samples in=0, channels in=0, frequency in=0, error in=$"error in (no error)") -> (return type=w7, num_samples out=w8, channels out=w9, frequency out=w10, error out=w11)
  # num_samples is buffer size. Divide by number of samples to get samples/ch
  Quotient And Remainder(x=w8, y=w9) -> (floor(x/y)=w12)
  $"Length (Samples)" <- w12
  $Channels <- w9
  $"Sample Rate (Hz)" <- w10
  Initialize Array(element=0, size=w8) -> w13
  # Load the mp3 into memory
  # int16_t -> 2 bytes
  # Copy the audio data from the dll into LabVIEW.
  Multiply(w8, 2) -> w14
  call "MoveBlock"(Address (Pointer) in=w7, Destination in=w13, Size in=w14, error in=w11) -> (Address (Pointer) out=w15, Destination out=w16, error out=w17)
  # Free the memory allocated in the dll
  case (w9) {
    frame 1, Default {
      Build Waveform Node(Y=w16) -> (output waveform=w19)
      Build Array(w19) -> w18
    }
    frame 2 {
      Decimate Array(array=w16) -> (out0=w20, out1=w21)
      Build Waveform Node(Y=w20) -> (output waveform=w22)
      # Multi-channel audio data is interleaved in one large array. Decimate based on number of channels to get individual channel data.
      Build Waveform Node(Y=w21) -> (output waveform=w23)
      Build Array(w22, w23) -> w18
    }
  }
  $data <- w18
  call "free_mp3"(Address (Pointer) in=w15, error in=w17) -> (error out=w24)
  $"error out" <- w24
