vi "Load WAV.gvi"   [LabVIEW NXG 4.0.0]
# Loads a WAV file from disk.
# Priority: Background priority (lowest)
inputs:
  "Path": path, required
  "error in (no error)": error
outputs:
  "Channels": i32
  "Sample Rate (Hz)": i32
  "data": waveform<i16>[]
  "error out": error
  "Length (Samples)": i32
uses:
  My Computer::labview_audio_codecs_x64.sli::load_wav_w
  My Computer::LabVIEW.sli::MoveBlock
  My Computer::labview_audio_codecs_x64.sli::free_wav
  NI::G Core::Sound::Files::Sound File Open::Sound File Read Open.gvi
  NI::G Core::Sound::Files::Sound File Info::Sound File Info (refnum).gvi
  NI::G Core::Sound::Files::Sound File Read::Sound File Read (I16).gvi
  NI::G Core::Sound::Files::Sound File Close.gvi
diagram:
  disable {
    frame Enabled {
      Path To String(path=$Path) -> (string=w6)
      String To Byte Array(encoding="UTF-16", string=w6) -> (unsigned byte array=w7)
      Decimate Array(array=w7) -> (out0=w8, out1=w9)
      Join Numbers(high(x)=w9, low(x)=w8) -> w10
      Build Array(w10, 0) -> w11
      # Load the wav into memory
      call "load_wav_w"(file_name in=w11, num_samples in=0, channels in=0, sample_rate in=0, error in=$"error in (no error)") -> (return type=w12, num_samples out=w5, channels out=w4, sample_rate out=w3, error out=w13)
      Multiply(w5, w4) -> w14
      # Copy the audio data from the dll into LabVIEW.
      # num_samples is per channel. Multiply by num_channels to get full buffer size.
      Initialize Array(element=0, size=w14) -> w15
      # int16_t -> 2 bytes
      Multiply(w14, 2) -> w16
      call "MoveBlock"(Address (Pointer) in=w12, Destination in=w15, Size in=w16, error in=w13) -> (Address (Pointer) out=w17, Destination out=w18, error out=w19)
      call "free_wav"(Address (Pointer) in=w17, error in=w19) -> (error out=w2)
      Reciprocal(x=w3) -> w20
      # Free the memory allocated in the dll
      case (w4) {
        frame 1, Default {
          Build Waveform Node(Y=w18, dt=w20) -> (output waveform=w21)
          Build Array(w21) -> w1
        }
        frame 2 {
          Decimate Array(array=w18) -> (out0=w22, out1=w23)
          Build Waveform Node(Y=w22, dt=w20) -> (output waveform=w24)
          # Multi-channel audio data is interleaved in one large array. Decimate based on number of channels to get individual channel data.
          Build Waveform Node(Y=w23, dt=w20) -> (output waveform=w25)
          Build Array(w24, w25) -> w1
        }
      }
    }
    frame Disabled {
      # This VI is reentrant, but none of these VIs are. Not a big deal, as its unlikely lots of WAV files will be getting loaded simultaneously.
      call "Sound File Read Open.gvi"(sound file=$Path, error in=$"error in (no error)") -> (reference=w26, error out=w27)
      call "Sound File Info (refnum).gvi"(reference in=w26, error in=w27) -> (reference out=w28, total number of samples/ch=w29, sound format=w30, error out=w31)
      To Signed 32 Bit Integer(number=w29) -> w5
      Property Node(instance in=w30) -> ("number of channels"=w4, "sample rate (S/s)"=w32)
      To Signed 32 Bit Integer(number=w32) -> w3
      call "Sound File Read (I16).gvi"(reference in=w28, error in=w31) -> (reference out=w33, data=w1, error out=w34)
      call "Sound File Close.gvi"(reference=w33, error in=w34) -> (error out=w2)
    }
  }
  $"Length (Samples)" <- w5
  $Channels <- w4
  $"Sample Rate (Hz)" <- w3
  $data <- w1
  $"error out" <- w2
