vi "Load.gvi"   [LabVIEW NXG 4.0.0]
# Sets up an asynchronous call to load the audio file given in Path.
inputs:
  "Audio Data Reference": DataValueReference<i16[][]>, required
  "Path": path, required
  "Message Queue": Queue<"Message Cluster.gtype">, required
  "error in (no error)": error
  "Deck ID": string, required
outputs:
  "error out": error
types:
  "Message Cluster.gtype" = cluster{"Event": string, "Source": string, "Target": string, "Data": variant}
uses:
  Audio File Input::Load Async.gvi
diagram:
  call "Load Async.gvi"() -> (VIReference=w1)
  # 0x40 - Reentrant call
  # 0x80 - Call and forget
  Logical Or(0x40, 0x80) -> w2
  sequence (after w2) {
    frame 0 {
      Open VI Reference[CallOptions=AsynchronousCallWithoutWait, EnableSimultaneousCalls=True](error in=$"error in (no error)", type specifier VI reference=w1, vi name="Audio File Input::Load Async.gvi") -> (error out=w3, vi reference=w4)
    }
  }
  Call By Reference[CallByReferenceLoadType=0, CallByReferenceStyle=1](L0=$"Audio Data Reference", L1=$Path, L2=$"Message Queue", T0=$"Deck ID", error in=w3, #ri=w4) -> (error out=w5, #ro=w6)
  # #BUG
  # When the async VI completes, it will interrupt the UI. For example dragging a slider as the async VI returns will cause the slider to stop being dragged.
  #
  # Possible workarounds:
  # - Use call and collect - NO. The issue is still present when the VI ref is closed.
  # - Don't close the reference at all (or until after VI returns?) Obvious memory leak
  # - Use the Run VI invoke method (hits VI server and UI thread, which want to avoid)
  # - Get fancy and return the VI ref to the UI, and have it closed there when no other UI action is progress?
  # - Reuse VI ref and never close it. No memory leak, and ref will be destoryed on application exit.
  #
  # It seems this bug is only present in development. The built applcation doesn't exhibit this behaviour.
  Close Reference(error in=w5, reference=w6) -> (error out=w7)
  $"error out" <- w7
