vi "Adjust Sample Size.gvi"   [LabVIEW Conversion 4.0.0]
# Ensures the Sample Size is never in the range -1 to 1. Attempting to interpolate an array of 0 or 1 samples generates an audio buffer filled with NaN values.
inputs:
  "Sample Size In": i32, required
outputs:
  "Sample Size Out": i32
diagram:
  Absolute Value(x=$"Sample Size In") -> w1
  Is Less(x=w1, y=2) -> w2
  case (w2) {
    frame False, Default {
      w3 = $"Sample Size In"
    }
    frame True {
      # Retain the sign
      Sign(number=$"Sample Size In") -> (-1, 0, 1=w4)
      Multiply(w4, 2) -> w3
    }
  }
  $"Sample Size Out" <- w3
