vi "Calculate Playback Speed.gvi"   [LabVIEW Conversion 4.0.0]
# Convert pitch (-30 to 30) into speed multiplier (0.7 to 1.3), with adjustments made for pitch bending.
inputs:
  "Pitch": f64, required
  "Pitch Bend Down (F)": bool
  "Pitch Bend Up (F)": bool
outputs:
  "Speed Multiplier": f64
diagram:
  # Pitch value is in range -30 to 30, where 0 is no pitch change (ie. 100% speed). Convert value to speed multiplier.
  case ($"Pitch Bend Down (F)") {
    frame False, Default {
      w1 = $Pitch
    }
    frame True {
      Subtract(x=$Pitch, y=8) -> w1
    }
  }
  # Pitch bend is +/- 8%
  case ($"Pitch Bend Up (F)") {
    frame False, Default {
      w2 = w1
    }
    frame True {
      Add(w1, 8) -> w2
    }
  }
  Divide(x=w2, y=100) -> w3
  Increment(x=w3) -> w4
  $"Speed Multiplier" <- w4
