vi "Calculate Sample Buffer Size.gvi"   [LabVIEW Conversion 4.0.0]
# Calculate the size of the audio buffer based on the playback speed.
inputs:
  "Speed Multiplier": f64, required
  "Reverse (F)": bool
outputs:
  "Sample Size": i32
uses:
  Audio Processing::Adjust Sample Size.gvi
diagram:
  Tag Read(ref in="Globals::Constants.grsc::Buffer Size") -> (Data=w1)
  Multiply($"Speed Multiplier", w1) -> w2
  To Signed 32 Bit Integer(number=w2) -> w3
  case ($"Reverse (F)") {
    frame False, Default {
      w4 = w3
    }
    frame True {
      Negate(x=w3) -> w4
    }
  }
  call "Adjust Sample Size.gvi"(Sample Size In=w4) -> (Sample Size Out=w5)
  $"Sample Size" <- w5
