vi "Change Audio Speed.gvi"   [LabVIEW Conversion 4.0.0]
# Stretches or squashes the input audio block (via interpolation) to the fixed audio processing block size. This in effect changes the speed of the audio.
inputs:
  "Audio Block": f64[][], required
outputs:
  "Interpolated Audio": f64[][]
uses:
  NI::Analysis::Interpolation::Nearest Interpolation 1D.gvi
  NI::Analysis::Interpolation::Linear Interpolation 1D.gvi
  NI::Analysis::Interpolation::Spline Interpolation 1D.gvi
  NI::Analysis::Interpolation::Hermite Interpolation 1D.gvi
  NI::Analysis::Interpolation::Polynomial Interpolation 1D.gvi
diagram:
  Tag Read(ref in="Globals::Constants.grsc::Buffer Size") -> (Data=w1)
  Matrix Size(matrix=$"Audio Block") -> (number of columns=w2)
  Divide(x=w2, y=w1) -> w3
  for (N = w1) (iteration -> i1) {
    Multiply(w3, i1) -> w5
    append w5 to w4
  }
  for {
    w6 = each element of $"Audio Block"
    case ("spline"(2)) {
      frame 0, Default {
        call "Nearest Interpolation 1D.gvi"(x is monotonic?=TRUE, y=w10, x=f64[] [], xi=w11, ntimes=1) -> (yi=w12, xi used=w13, error out=w9)
        w6 = w10
        w8 = w11
      }
      frame 1 {
        call "Linear Interpolation 1D.gvi"(x is monotonic?=TRUE, y=w14, x=f64[] [], xi=w15, ntimes=1) -> (yi=w16, xi used=w17, error out=w9)
        w6 = w14
        w8 = w15
      }
      frame 2 {
        call "Spline Interpolation 1D.gvi"(y=w18, x=f64[] [], xi=w19, ntimes=1) -> (error out=w9, yi=w20, xi used=w21)
        w6 = w18
        w8 = w19
      }
      frame 3 {
        call "Hermite Interpolation 1D.gvi"(y=w22, x=f64[] [], xi=w23, ntimes=1) -> (error out=w9, xi used=w24, yi=w25)
        w6 = w22
        w8 = w23
      }
      frame 4 {
        call "Polynomial Interpolation 1D.gvi"(x is monotonic?=TRUE, y=w26, x=f64[] [], xi=w27, ntimes=1) -> (yi=w28, xi used=w29, error out=w9)
        w6 = w26
        w8 = w27
      }
    }
    Property Node(instance in=w9)
    append w30 to w7
  }
  $"Interpolated Audio" <- w7
