vi "DBL To I16.gvi"   [LabVIEW Conversion 4.0.0]
# Converts audio in DBL format (range 0-1) to I16 (range -32768 to 32767).
# Wire 1D array for single channel audio, or 2D array for multi-channel audio.
inputs:
  "Audio Data (2D DBL)": f64[][]
  "Audio Data (1D DBL)": f64[]
outputs:
  "Audio Data (2D I16)": i16[][]
  "Audio Data (1D I16)": i16[]
diagram:
  Multiply($"Audio Data (2D DBL)", 32768) -> w1
  To Signed 16 Bit Integer(number=w1) -> w2
  $"Audio Data (2D I16)" <- w2
  Multiply($"Audio Data (1D DBL)", 32768) -> w3
  To Signed 16 Bit Integer(number=w3) -> w4
  $"Audio Data (1D I16)" <- w4
