vi "I16 To DBL.gvi"   [LabVIEW Conversion 4.0.0]
# Converts audio in I16 format (range -32768 to 32767) to DBL (range 0-1).
# Wire 1D array for single channel audio, or 2D array for multi-channel audio.
inputs:
  "Audio Data (2D I16)": i16[][]
  "Audio Data (1D I16)": i16[]
outputs:
  "Audio Data (2D DBL)": f64[][]
  "Audio Data (1D DBL)": f64[]
diagram:
  Divide(x=$"Audio Data (2D I16)", y=32768) -> w1
  $"Audio Data (2D DBL)" <- w1
  Divide(x=$"Audio Data (1D I16)", y=32768) -> w2
  $"Audio Data (1D DBL)" <- w2
