vi "Run.gvi"   [LabVIEW Conversion 4.0.0]
# The main audio processing loop.
# Priority: Above Normal
# Execution System: Data Acquisition
inputs:
  "Audio Output Queue": Queue<"Audio Output Queue Type.gtype">, required
  "error in (no error)": error
outputs:
  "error out": error
types:
  "Audio Output Queue Type.gtype" = cluster{"Master": waveform<i16>[], "Headphones": waveform<i16>[]}
uses:
  Merged::Deck.gtype::Init.gvi
  MergedDependencies::Mixer.gtype::Init.gvi
  Merged::Deck.gtype::Update.gvi
  MergedDependencies::Mixer.gtype::Update.gvi
  Audio Processing::DBL To I16.gvi
  Merged::Deck.gtype::Cleanup.gvi
  MergedDependencies::Mixer.gtype::Cleanup.gvi
diagram:
  call "Init.gvi"(ID="Deck1") -> (Deck out=w1)
  call "Init.gvi"(ID="Deck2") -> (Deck out=w2)
  call "Init.gvi"(ID="Mixer") -> (Mixer out=w3)
  # Convert the audio data to an appropriate data format for the sound card.
  #
  # LabVIEW's sound write supports dbl and integers, but WaveIO only supports integers.
  s1 = w1  # shift register
  s2 = w2  # shift register
  s3 = w3  # shift register
  while {
    call "Update.gvi"(Deck in=s1) -> (Deck out=w4, Audio Block=w5)
    call "Update.gvi"(Deck in=s2) -> (Deck out=w6, Audio Block=w7)
    call "Update.gvi"(Mixer in=s3, Audio Block 1=w5, Audio Block 2=w7) -> (Mixer out=w8, Master Audio Block Out=w9, Headphones Audio Block Out=w10)
    call "DBL To I16.gvi"(Audio Data (2D DBL)=w9) -> (Audio Data (2D I16)=w11)
    call "DBL To I16.gvi"(Audio Data (2D DBL)=w10) -> (Audio Data (2D I16)=w12)
    for {
      w13 = each element of w11
      w14 = each element of w12
      Build Waveform Node(Y=w13) -> (output waveform=w17)
      Build Waveform Node(Y=w14) -> (output waveform=w18)
      append w17 to w15
      append w18 to w16
    }
    Property Node(instance in="Audio Output Queue Type.gtype" {all zero or empty}, "Master"=w15, "Headphones"=w16) -> (instance out=w19)
    Enqueue Element(element=w19, queue=$"Audio Output Queue") -> (error out=w20)
    next s1 = w4
    next s2 = w6
    next s3 = w8
    stop if w20
  }
  call "Cleanup.gvi"(Deck in=s1)
  call "Cleanup.gvi"(Deck in=s2)
  # Notice this loop has no explicit timing.
  #
  # Instead timing is provided by the enqueue function. This timing is dictated by the dequeue rate in the audio output loop, which in turn is set by the write sound VI.
  #
  # The write sound VI will block when the audio output buffer is full. This output buffer is emptied at the configured output rate (1024 / 44100 = 23ms -> 43Hz). When the write sound VI blocks, the dequeue VI isn't executing. As soon as one element is placed in this queue, the upstream enqueue function also blocks.
  call "Cleanup.gvi"(Mixer in=s3)
  $"error out" <- $"error in (no error)"
