vi "Cleanup.gvi"   [LabVIEW Conversion 4.0.0]
inputs:
  "Deck in": "Deck.gtype", required
  "error in (no error)": error
outputs:
  "Deck out": "Deck.gtype"
  "error out": error
diagram:
  case ($"error in (no error)") {
    frame No Error {
      Property Node(instance in=$"Deck in") -> ("Message Queue"=w3, "Audio Data Reference"=w4)
      Release Queue(error in=$"error in (no error)", force destroy=TRUE, queue=w3) -> (error out=w5)
      Delete Data Value Reference(data value reference=w4, error in (no error)=w5) -> (error out=w1)
      w2 = $"Deck in"
    }
    frame Error {
      w1 = $"error in (no error)"
      w2 = $"Deck in"
    }
  }
  $"Deck out" <- w2
  $"error out" <- w1
