vi "Copy Audio Sample.gvi"   [LabVIEW Conversion 4.0.0]
# Copy a sample block of audio from the DVR based on Offset and Length. If Offset + Length exceeds the size of audio in the DVR, the sample buffer is zero padded.
# Length can be negative or positive. If length is negative, the sample data returned is reversed.
inputs:
  "Deck in": "Deck.gtype", required
  "Offset": i32, required
  "Length": i32, required
  "error in (no error)": error
outputs:
  "Deck out": "Deck.gtype"
  "Audio Block": f64[][]
  "error out": error
uses:
  Audio Processing::I16 To DBL.gvi
diagram:
  # if offset < 0 OR offset + length > max_size
  #     zero pad buffer
  case ($"error in (no error)") {
    frame No Error {
      Property Node(instance in=$"Deck in") -> ("Audio Data Reference"=w4)
      Is Less Than 0(x=$Length) -> w5
      case (w5) {
        frame False, Default {
          w6 = $Offset
          w7 = $Length
          w8 = w5
          w9 = $Length
        }
        frame True {
          Add($Offset, $Length) -> w10
          Absolute Value(x=$Length) -> w9
          Is Less Than 0(x=w10) -> w11
          case (w11) {
            frame False, Default {
              w6 = w10
              w7 = w9
            }
            frame True {
              w6 = 0
              w7 = $Offset
            }
          }
          w8 = w5
        }
      }
      in-place {
        Read Poser(ro0=w4) -> (ri0=w12)
        Write Poser(wi0=w12) -> (wo0=w13)
        Matrix Size(matrix=w12) -> (number of rows=w14)
        Array Subset(array=w12, index1=w6, length1=w7) -> w15
      }
      Property Node(instance in=$"Deck in", "Audio Data Reference"=w13) -> (instance out=w2)
      Matrix Size(matrix=w15) -> (number of columns=w16)
      Is Not Equal(x=w16, y=w9) -> w17
      case (w17) {
        frame False, Default {
          w18 = w15
        }
        frame True {
          # Zero pad buffer
          Transpose 2D Array(2D array=w15) -> (transposed array=w19)
          Reshape Array(inArray=w19, size=w9, size=w14) -> w20
          Transpose 2D Array(2D array=w20) -> (transposed array=w18)
        }
      }
      case (w8) {
        frame False, Default {
          w21 = w18
        }
        frame True {
          for {
            w22 = each element of w18
            Reverse 1D Array(array=w22) -> (reversed array=w23)
            append w23 to w21
          }
        }
      }
      call "I16 To DBL.gvi"(Audio Data (2D I16)=w21) -> (Audio Data (2D DBL)=w3)
      w1 = $"error in (no error)"
    }
    frame Error {
      w1 = $"error in (no error)"
      w2 = $"Deck in"
      w3 = f64[][] []
    }
  }
  $"Deck out" <- w2
  $"Audio Block" <- w3
  $"error out" <- w1
