vi "Init.gvi"   [LabVIEW Conversion 4.0.0]
inputs:
  "Deck in": "Deck.gtype"
  "ID": string, required
  "error in (no error)": error
outputs:
  "Deck out": "Deck.gtype"
  "error out": error
types:
  "Audio File Info.gtype" = cluster{"Length (Samples)": i32, "Channels": i32, "Sample Rate (Hz)": i32, "Path": path, "BPM": f64, "Cue Points (Samples)": i32[]}
  "Value Properties.gtype" = cluster{"Lower": f64, "Upper": f64}
  "Value Cluster.gtype" = cluster{"Value": f64, "Limits": "Value Properties.gtype"}
uses:
  Messaging::Create Message Queue.gvi
diagram:
  # The Empty Audio Block is used to send data to the soundcard when no track is loaded or is playing.
  case ($"error in (no error)") {
    frame No Error {
      w3 = "Audio File Info.gtype" {"Cue Points (Samples)"=[-1, -1, -1]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}
      Tag Read(ref in="Globals::Constants.grsc::Buffer Size") -> (Data=w4)
      Initialize Array(element=0, size=2, size=w4) -> w5
      call "Create Message Queue.gvi"(Queue Name=$ID) -> (queue out=w6)
      Property Node(instance in=$"Deck in") -> ("Audio Data Reference"=w7)
      Is Not A Number Or Path Or Refnum(number=w7) -> w8
      case (w8) {
        frame False, Default {
          w9 = w7
        }
        frame True {
          New Data Value Reference(data value=i16[][] []) -> (data value reference=w9)
        }
      }
      Initialize Array(element=cluster{"Positions": i32[]} {all zero or empty}, size=2) -> w10
      Property Node(instance in=$"Deck in", "ID"=$ID, "Message Queue"=w6, "State"="No Track", "PlaybackPosition"=0, "PositionHistory"=w10, "ScratchPositions"=i32[] [], "Pitch"="Value Cluster.gtype" {0, -30, 30}, "BrakeSpeed"=1, "BackspinSpeed"=10, "Playing"=FALSE, "Reverse"=FALSE, "PitchBendDown"=FALSE, "PitchBendUp"=FALSE, "Empty Audio Block"=w5, "Audio Data Reference"=w9, "Track Info"=w3) -> (instance out=w2)
      w1 = $"error in (no error)"
    }
    frame Error {
      w1 = $"error in (no error)"
      w2 = $"Deck in"
    }
  }
  $"Deck out" <- w2
  $"error out" <- w1
