vi "Process Messages.gvi"   [LabVIEW NXG 4.0.0]
inputs:
  "Deck in": "Deck.gtype", required
  "error in (no error)": error
outputs:
  "Deck out": "Deck.gtype"
  "error out": error
types:
  "Message Cluster.gtype" = cluster{"Event": string, "Source": string, "Target": string, "Data": variant}
  "Audio File Info.gtype" = cluster{"Length (Samples)": i32, "Channels": i32, "Sample Rate (Hz)": i32, "Path": path, "BPM": f64, "Cue Points (Samples)": i32[]}
uses:
  Messaging::Update UI.gvi
  Audio File Input::Load.gvi
  Messaging::Send.gvi
  User Interface::Format Sample To Time.gvi
diagram:
  case ($"error in (no error)") {
    frame No Error {
      Property Node(instance in=$"Deck in") -> ("Message Queue"=w3, "ID"=w4)
      Flush Queue(queue=w3) -> (remaining elements=w5)
      # Wire the error cluster across even in the "No Error"
      # case so that warnings get propagated.
      s1 = $"Deck in"  # shift register
      for {
        w6 = each element of w5
        # Events:
        #
        # Load Track
        # Track Loaded
        # Value Change
        # Increment
        # Toggle
        # Mouse Up
        Property Node(instance in=w6) -> ("Event"=w7, "Data"=w8, "Target"=w9, "Source"=w10)
        case (w9) {
          frame Default {
            case (w7) {
              frame Default {
                w11 = s1
              }
              frame "Reset" {
                Property Node(instance in=s1, "PlaybackPosition"=0, "ScratchPositions"=i32[] [], "Playing"=FALSE, "Reverse"=FALSE, "BrakeSpeed"=1, "BackspinSpeed"=10, "PitchBendDown"=FALSE, "PitchBendUp"=FALSE) -> (instance out=w11)
                # #TODO
                # Send updates to UI matching Reset state
                #
                # Add private class VI to reset state (also add to Init), then unbundle reset values and update UI here.
                #
                # Actually each class should do this, and also add all UI knob/slider ranges. Have two levels of reset - one to init entire VI (ranges included), and one to simply reset values.
                call "Update UI.gvi"(ID=w4, Target="PlaybackPosition", Data=0)
                call "Update UI.gvi"(ID=w4, Target="Waveform", Data=f64[][] [])
                # Reset the deck to its default playback settings and appearance
                call "Update UI.gvi"(ID=w4, Target="Time", Data="")
              }
              frame "Load Track" {
                # Update UI
                # Clear waveform
                # Show "Loading..." in title field
                # Reset Playback Position
                # Reset Time
                #
                # (Should async loading VI handle this?)
                Property Node(instance in=s1, "State"="Loading") -> (instance out=w11)
                Property Node(instance in=s1) -> ("ID"=w12, "Audio Data Reference"=w13, "Message Queue"=w14)
                Variant To Data(type=path path "", variant=w8) -> (data=w15)
                call "Load.gvi"(Audio Data Reference=w13, Path=w15, Message Queue=w14, Deck ID=w12)
                call "Update UI.gvi"(ID=w4, Target="Title", Data="Loading...")
                Property Node(instance in="Message Cluster.gtype" {all zero or empty}, "Event"="Reset", "Source"=w4) -> (instance out=w16)
                call "Send.gvi"(Queue Name=w4, Message=w16)
              }
              frame "Track Loaded" {
                Variant To Data(type="Audio File Info.gtype" {all zero or empty}, variant=w8) -> (data=w17)
                Property Node(instance in=s1, "State"="Active", "PlaybackPosition"=0, "Track Info"=w17) -> (instance out=w11)
                # Update UI
                # Update title field
                #
                # (Should async loading VI handle this?)
                Property Node(instance in=w17) -> ("Path"=w18, "Length (Samples)"=w19)
                Strip Path(path=w18) -> (name=w20)
                call "Update UI.gvi"(ID=w4, Target="Title", Data=w20)
                call "Update UI.gvi"(ID=w4, Target="PlaybackPosition", Data=w19, Message (Value Change)="Slide.Scale.Maximum")
                call "Format Sample To Time.gvi"(Samples=w19) -> (Formatted Time=w21)
                call "Update UI.gvi"(ID=w4, Target="Time", Data=w21)
              }
              frame "File Error" {
                # Update UI
                # Update title field
                #
                # (Should async loading VI handle this?)
                Variant To Data(type="Audio File Info.gtype" {all zero or empty}, variant=w8) -> (data=w22)
                Property Node(instance in=s1, "State"="No Track", "PlaybackPosition"=0, "Track Info"=w22) -> (instance out=w11)
                call "Update UI.gvi"(ID=w4, Target="Title", Data="File Error")
                call "Update UI.gvi"(ID=w4, Target="Time", Data="")
              }
              frame "Mouse Up" {
                Property Node(instance in=s1) -> ("State"=w23)
                case (w23) {
                  frame Default {
                    w24 = w23
                  }
                  frame "Scratching" {
                    w24 = "Active"
                  }
                }
                Property Node(instance in=s1, "State"=w24) -> (instance out=w11)
              }
            }
          }
          frame "PlaybackPosition" {
            case (w7) {
              frame Default {
                w11 = s1
              }
              frame "Value Change" {
                Property Node(instance in=s1) -> ("PlaybackPosition"=w25)
                Variant To Data(type=w25, variant=w8) -> (data=w26)
                Property Node(instance in=s1, "PlaybackPosition"=w26) -> (instance out=w11)
              }
              frame "Increment" {
                Property Node(instance in=s1) -> ("PlaybackPosition"=w27)
                Variant To Data(type=w27, variant=w8) -> (data=w28)
                Add(w27, w28) -> w29
                Property Node(instance in=s1, "PlaybackPosition"=w29) -> (instance out=w11)
              }
            }
          }
          frame "Pitch" {
            case (w7) {
              frame Default {
                w11 = s1
              }
              frame "Value Change" {
                Property Node(instance in=s1) -> ("Pitch"=w30)
                Property Node(instance in=w30) -> ("Value"=w31, instance out=w32)
                Variant To Data(type=w31, variant=w8) -> (data=w33)
                Property Node(instance in=w32, "Value"=w33) -> (instance out=w34)
                Property Node(instance in=s1, "Pitch"=w34) -> (instance out=w11)
                case (w10) {
                  frame "UI" { }
                  frame Default {
                    call "Update UI.gvi"(ID=w4, Target=w9, Data=w33)
                  }
                }
              }
              frame "Increment" {
                Property Node(instance in=s1) -> ("Pitch"=w35)
                Property Node(instance in=w35) -> ("Value"=w36, "Limits:Upper"=w37, "Limits:Lower"=w38, instance out=w39)
                Variant To Data(type=w36, variant=w8) -> (data=w40)
                Add(w36, w40) -> w41
                In Range And Coerce[IncludeHighLimit=True](lower limit=w38, upper limit=w37, x=w41) -> (coerced(x)=w42)
                Property Node(instance in=w39, "Value"=w42) -> (instance out=w43)
                Property Node(instance in=s1, "Pitch"=w43) -> (instance out=w11)
                case (w10) {
                  frame "UI" { }
                  frame Default {
                    call "Update UI.gvi"(ID=w4, Target=w9, Data=w42)
                  }
                }
              }
            }
          }
          frame "PitchBendDown" {
            case (w7) {
              frame Default {
                w11 = s1
              }
              frame "Value Change" {
                Property Node(instance in=s1) -> ("PitchBendDown"=w44)
                Variant To Data(type=w44, variant=w8) -> (data=w45)
                Property Node(instance in=s1, "PitchBendDown"=w45) -> (instance out=w11)
              }
              frame "Toggle" {
                Property Node(instance in=s1) -> ("PitchBendDown"=w46)
                Not(x=w46) -> w47
                Property Node(instance in=s1, "PitchBendDown"=w47) -> (instance out=w11)
              }
            }
          }
          frame "PitchBendUp" {
            case (w7) {
              frame Default {
                w11 = s1
              }
              frame "Value Change" {
                Property Node(instance in=s1) -> ("PitchBendUp"=w48)
                Variant To Data(type=w48, variant=w8) -> (data=w49)
                Property Node(instance in=s1, "PitchBendUp"=w49) -> (instance out=w11)
              }
              frame "Toggle" {
                Property Node(instance in=s1) -> ("PitchBendUp"=w50)
                Not(x=w50) -> w51
                Property Node(instance in=s1, "PitchBendUp"=w51) -> (instance out=w11)
              }
            }
          }
          frame "Jogwheel" {
            case (w7) {
              frame Default {
                w11 = s1
              }
              frame "Value Change" {
                Property Node(instance in=s1) -> ("State"=w52, "ScratchPositions"=w53, "PlaybackPosition"=w54)
                case (w52) {
                  frame Default {
                    w55 = w52
                  }
                  frame "Active" {
                    w55 = "Scratching"
                  }
                }
                Variant To Data(type=w54, variant=w8) -> (data=w56)
                Subtract(x=w53, y=w54) -> w57
                Add Array Elements(numeric array=w57) -> (sum=w58)
                Add(w58, w54, w56) -> w59
                Build Array(w59) -> w60
                Property Node(instance in=s1, "State"=w55, "ScratchPositions"=w60) -> (instance out=w11)
              }
            }
          }
          frame "Cue1" {
            case (w7) {
              frame Default {
                w11 = s1
              }
              frame "Value Change" {
                Property Node(instance in=s1) -> ("Track Info"=w61)
                Property Node(instance in=w61) -> ("Cue Points (Samples)"=w62, "Length (Samples)"=w63)
                Array Index(array=w62) -> (out0[0]=w64)
                Is Greater Or Equal To 0(x=w64) -> w65
                case (w65) {
                  frame False, Default {
                    w11 = s1
                  }
                  frame True {
                    Property Node(instance in=s1, "PlaybackPosition"=w64) -> (instance out=w11)
                    call "Update UI.gvi"(ID=w4, Target="PlaybackPosition", Data=w64)
                    call "Update UI.gvi"(ID=w4, Target="Jogwheel", Data=w64)
                    Subtract(x=w63, y=w64) -> w66
                    call "Format Sample To Time.gvi"(Samples=w66) -> (Formatted Time=w67)
                    call "Update UI.gvi"(ID=w4, Target="Time", Data=w67)
                  }
                }
              }
            }
          }
          frame "Cue2" {
            case (w7) {
              frame Default {
                w11 = s1
              }
              frame "Value Change" {
                Property Node(instance in=s1) -> ("Track Info"=w68)
                Property Node(instance in=w68) -> ("Cue Points (Samples)"=w69, "Length (Samples)"=w70)
                Array Index(array=w69) -> (out0[1]=w71)
                Is Greater Or Equal To 0(x=w71) -> w72
                case (w72) {
                  frame False, Default {
                    w11 = s1
                  }
                  frame True {
                    Property Node(instance in=s1, "PlaybackPosition"=w71) -> (instance out=w11)
                    call "Update UI.gvi"(ID=w4, Target="PlaybackPosition", Data=w71)
                    call "Update UI.gvi"(ID=w4, Target="Jogwheel", Data=w71)
                    Subtract(x=w70, y=w71) -> w73
                    call "Format Sample To Time.gvi"(Samples=w73) -> (Formatted Time=w74)
                    call "Update UI.gvi"(ID=w4, Target="Time", Data=w74)
                  }
                }
              }
            }
          }
          frame "Cue3" {
            case (w7) {
              frame Default {
                w11 = s1
              }
              frame "Value Change" {
                Property Node(instance in=s1) -> ("Track Info"=w75)
                Property Node(instance in=w75) -> ("Cue Points (Samples)"=w76, "Length (Samples)"=w77)
                Array Index(array=w76) -> (out0[2]=w78)
                Is Greater Or Equal To 0(x=w78) -> w79
                case (w79) {
                  frame False, Default {
                    w11 = s1
                  }
                  frame True {
                    Property Node(instance in=s1, "PlaybackPosition"=w78) -> (instance out=w11)
                    call "Update UI.gvi"(ID=w4, Target="PlaybackPosition", Data=w78)
                    call "Update UI.gvi"(ID=w4, Target="Jogwheel", Data=w78)
                    Subtract(x=w77, y=w78) -> w80
                    call "Format Sample To Time.gvi"(Samples=w80) -> (Formatted Time=w81)
                    call "Update UI.gvi"(ID=w4, Target="Time", Data=w81)
                  }
                }
              }
            }
          }
          frame "SetCue1" {
            case (w7) {
              frame Default {
                w11 = s1
              }
              frame "Value Change" {
                Property Node(instance in=s1) -> ("PlaybackPosition"=w82, "Track Info"=w83)
                Property Node(instance in=w83) -> ("Cue Points (Samples)"=w84, instance out=w85)
                Replace Array Subset(inArray=w84, index=0, new=w82) -> w86
                Property Node(instance in=w85, "Cue Points (Samples)"=w86) -> (instance out=w87)
                Property Node(instance in=s1, "Track Info"=w87) -> (instance out=w11)
              }
            }
          }
          frame "SetCue2" {
            case (w7) {
              frame Default {
                w11 = s1
              }
              frame "Value Change" {
                Property Node(instance in=s1) -> ("PlaybackPosition"=w88, "Track Info"=w89)
                Property Node(instance in=w89) -> ("Cue Points (Samples)"=w90, instance out=w91)
                Replace Array Subset(inArray=w90, index=1, new=w88) -> w92
                Property Node(instance in=w91, "Cue Points (Samples)"=w92) -> (instance out=w93)
                Property Node(instance in=s1, "Track Info"=w93) -> (instance out=w11)
              }
            }
          }
          frame "SetCue3" {
            case (w7) {
              frame Default {
                w11 = s1
              }
              frame "Value Change" {
                Property Node(instance in=s1) -> ("PlaybackPosition"=w94, "Track Info"=w95)
                Property Node(instance in=w95) -> ("Cue Points (Samples)"=w96, instance out=w97)
                Replace Array Subset(inArray=w96, index=2, new=w94) -> w98
                Property Node(instance in=w97, "Cue Points (Samples)"=w98) -> (instance out=w99)
                Property Node(instance in=s1, "Track Info"=w99) -> (instance out=w11)
              }
            }
          }
          frame "ClearCue1" {
            case (w7) {
              frame Default {
                w11 = s1
              }
              frame "Value Change" {
                Property Node(instance in=s1) -> ("Track Info"=w100)
                Property Node(instance in=w100) -> ("Cue Points (Samples)"=w101, instance out=w102)
                Replace Array Subset(inArray=w101, index=0, new=-1) -> w103
                Property Node(instance in=w102, "Cue Points (Samples)"=w103) -> (instance out=w104)
                Property Node(instance in=s1, "Track Info"=w104) -> (instance out=w11)
              }
            }
          }
          frame "ClearCue2" {
            case (w7) {
              frame Default {
                w11 = s1
              }
              frame "Value Change" {
                Property Node(instance in=s1) -> ("Track Info"=w105)
                Property Node(instance in=w105) -> ("Cue Points (Samples)"=w106, instance out=w107)
                Replace Array Subset(inArray=w106, index=1, new=-1) -> w108
                Property Node(instance in=w107, "Cue Points (Samples)"=w108) -> (instance out=w109)
                Property Node(instance in=s1, "Track Info"=w109) -> (instance out=w11)
              }
            }
          }
          frame "ClearCue3" {
            case (w7) {
              frame Default {
                w11 = s1
              }
              frame "Value Change" {
                Property Node(instance in=s1) -> ("Track Info"=w110)
                Property Node(instance in=w110) -> ("Cue Points (Samples)"=w111, instance out=w112)
                Replace Array Subset(inArray=w111, index=2, new=-1) -> w113
                Property Node(instance in=w112, "Cue Points (Samples)"=w113) -> (instance out=w114)
                Property Node(instance in=s1, "Track Info"=w114) -> (instance out=w11)
              }
            }
          }
          frame "Play" {
            case (w7) {
              frame Default {
                w11 = s1
              }
              frame "Value Change" {
                Property Node(instance in=s1) -> ("State"=w115, "Playing"=w116)
                case (w115) {
                  frame Default {
                    w117 = w116
                  }
                  frame "Active".."Backspin" {
                    Variant To Data(type=w116, variant=w8) -> (data=w117)
                  }
                }
                Property Node(instance in=s1, "Playing"=w117) -> (instance out=w11)
                case (w10) {
                  frame "UI" { }
                  frame Default {
                    call "Update UI.gvi"(ID=w4, Target=w9, Data=w117)
                  }
                }
              }
              frame "Toggle" {
                Property Node(instance in=s1) -> ("State"=w118, "Playing"=w119)
                case (w118) {
                  frame Default {
                    w120 = w119
                  }
                  frame "Active".."Backspin" {
                    Not(x=w119) -> w120
                  }
                }
                Property Node(instance in=s1, "Playing"=w120) -> (instance out=w11)
                case (w10) {
                  frame "UI" { }
                  frame Default {
                    call "Update UI.gvi"(ID=w4, Target=w9, Data=w120)
                  }
                }
              }
            }
          }
          frame "Reverse" {
            case (w7) {
              frame Default {
                w11 = s1
              }
              frame "Value Change" {
                Property Node(instance in=s1) -> ("Reverse"=w121)
                Variant To Data(type=w121, variant=w8) -> (data=w122)
                Property Node(instance in=s1, "Reverse"=w122) -> (instance out=w11)
                case (w10) {
                  frame "UI" { }
                  frame Default {
                    call "Update UI.gvi"(ID=w4, Target=w9, Data=w122)
                  }
                }
              }
              frame "Toggle" {
                Property Node(instance in=s1) -> ("Reverse"=w123)
                Not(x=w123) -> w124
                Property Node(instance in=s1, "Reverse"=w124) -> (instance out=w11)
                case (w10) {
                  frame "UI" { }
                  frame Default {
                    call "Update UI.gvi"(ID=w4, Target=w9, Data=w124)
                  }
                }
              }
            }
          }
          frame "Brake" {
            case (w7) {
              frame Default {
                w11 = s1
              }
              frame "Value Change" {
                Property Node(instance in=s1) -> ("Playing"=w125, "State"=w126, "BrakeSpeed"=w127)
                Variant To Data(type=bool FALSE, variant=w8) -> (data=w128)
                case (w126) {
                  frame Default {
                    w129 = w127
                    w130 = w126
                  }
                  frame "Active" {
                    case (w125) {
                      frame False {
                        w130 = w126
                        w129 = w127
                      }
                      frame True {
                        case (w128) {
                          frame False, Default {
                            w130 = w126
                            w129 = w127
                          }
                          frame True {
                            w130 = "Brake"
                            w129 = 1
                          }
                        }
                      }
                    }
                  }
                  frame "Brake" {
                    case (w125) {
                      frame False {
                        w130 = w126
                        w129 = w127
                      }
                      frame True {
                        case (w128) {
                          frame False, Default {
                            w130 = "Active"
                            w129 = 1
                          }
                          frame True {
                            w130 = w126
                            w129 = w127
                          }
                        }
                      }
                    }
                  }
                }
                Property Node(instance in=s1, "State"=w130, "BrakeSpeed"=w129) -> (instance out=w11)
                Is Equal(x=w130, y="Brake") -> w131
                call "Update UI.gvi"(ID=w4, Target=w9, Data=w131)
              }
              frame "Toggle" {
                Property Node(instance in=s1) -> ("Playing"=w132, "State"=w133, "BrakeSpeed"=w134)
                case (w133) {
                  frame Default {
                    w135 = w134
                    w136 = w133
                  }
                  frame "Active" {
                    case (w132) {
                      frame False {
                        w136 = w133
                        w135 = w134
                      }
                      frame True {
                        w136 = "Brake"
                        w135 = 1
                      }
                    }
                  }
                  frame "Brake" {
                    case (w132) {
                      frame False {
                        w136 = w133
                        w135 = w134
                      }
                      frame True {
                        w136 = "Active"
                        w135 = 1
                      }
                    }
                  }
                }
                Property Node(instance in=s1, "State"=w136, "BrakeSpeed"=w135) -> (instance out=w11)
                Is Equal(x=w136, y="Brake") -> w137
                call "Update UI.gvi"(ID=w4, Target=w9, Data=w137)
              }
            }
          }
          frame "Backspin" {
            case (w7) {
              frame Default {
                w11 = s1
              }
              frame "Value Change" {
                Property Node(instance in=s1) -> ("Playing"=w138, "State"=w139, "BackspinSpeed"=w140)
                Variant To Data(type=bool FALSE, variant=w8) -> (data=w141)
                case (w139) {
                  frame Default {
                    w142 = w140
                    w143 = w139
                  }
                  frame "Active" {
                    case (w138) {
                      frame False {
                        w143 = w139
                        w142 = w140
                      }
                      frame True {
                        case (w141) {
                          frame False, Default {
                            w143 = w139
                            w142 = w140
                          }
                          frame True {
                            w143 = "Backspin"
                            w142 = 5
                          }
                        }
                      }
                    }
                  }
                  frame "Backspin" {
                    case (w138) {
                      frame False {
                        w143 = w139
                        w142 = w140
                      }
                      frame True {
                        case (w141) {
                          frame False, Default {
                            w143 = "Active"
                            w142 = 5
                          }
                          frame True {
                            w143 = w139
                            w142 = w140
                          }
                        }
                      }
                    }
                  }
                }
                Property Node(instance in=s1, "State"=w143, "BackspinSpeed"=w142) -> (instance out=w11)
                Is Equal(x=w143, y="Backspin") -> w144
                call "Update UI.gvi"(ID=w4, Target=w9, Data=w144)
              }
              frame "Toggle" {
                Property Node(instance in=s1) -> ("Playing"=w145, "State"=w146, "BackspinSpeed"=w147)
                case (w146) {
                  frame Default {
                    w148 = w147
                    w149 = w146
                  }
                  frame "Active" {
                    case (w145) {
                      frame False {
                        w149 = w146
                        w148 = w147
                      }
                      frame True {
                        w149 = "Backspin"
                        w148 = 5
                      }
                    }
                  }
                  frame "Backspin" {
                    case (w145) {
                      frame False {
                        w149 = w146
                        w148 = w147
                      }
                      frame True {
                        w149 = "Active"
                        w148 = 5
                      }
                    }
                  }
                }
                Property Node(instance in=s1, "State"=w149, "BackspinSpeed"=w148) -> (instance out=w11)
                Is Equal(x=w149, y="Backspin") -> w150
                call "Update UI.gvi"(ID=w4, Target=w9, Data=w150)
              }
            }
          }
        }
        next s1 = w11
      }
      w1 = $"error in (no error)"
      w2 = s1
    }
    frame Error {
      w1 = $"error in (no error)"
      w2 = $"Deck in"
    }
  }
  $"Deck out" <- w2
  $"error out" <- w1
