vi "Update.gvi"   [LabVIEW NXG 4.0.0]
inputs:
  "Deck in": "Deck.gtype", required
  "error in (no error)": error
outputs:
  "Deck out": "Deck.gtype"
  "Audio Block": f64[][]
  "error out": error
uses:
  Merged::Deck.gtype::Process Messages.gvi
  Audio Processing::Calculate Playback Speed.gvi
  Audio Processing::Calculate Sample Buffer Size.gvi
  Messaging::Update UI.gvi
  User Interface::Format Sample To Time.gvi
  Merged::Deck.gtype::Copy Audio Sample.gvi
  Audio Processing::Change Audio Speed.gvi
  NI::Analysis::Interpolation::Nearest Interpolation 1D.gvi
  NI::Analysis::Interpolation::Linear Interpolation 1D.gvi
  NI::Analysis::Interpolation::Spline Interpolation 1D.gvi
  NI::Analysis::Interpolation::Hermite Interpolation 1D.gvi
  NI::Analysis::Interpolation::Polynomial Interpolation 1D.gvi
diagram:
  # Ideas for better scratch
  #
  # Upsample signal from 44100Hz then interpolate?
  # - Probably little benefit to straight interpolation
  #
  # Investiagte Resample (C-V) VI.
  # - Could attach timestamp to each message received, then perform series of smaller interpolations based on those times
  #
  # Capture inputs as non-linear series of data points
  # Resample to constant, higher resolution
  # - Resample times + inputs
  #
  # Keep PlaybackPosition history? Or scratch position history (last point before new buffer update).
  # - Perform interpolation based on
  #     - PrevScratchPos, PlaybackPosition, NewScratchPos[]
  # Perform interpolation, then only use values between previous and new playback position
  # #BUG
  # The playback position slider sends a value change event when the user clicks it.
  # If we then write back to this slider the new position, and the user is still holding the mouse down, a new value change event will be triggered, even if the user hasn't moved the mouse.
  #
  # Not necessarily a LabVIEW bug, as there has been a value change.
  #
  # Might need to use mouse down and mouse move events to detect value change instead.
  case ($"error in (no error)") {
    frame No Error {
      call "Process Messages.gvi"(Deck in=$"Deck in") -> (Deck out=w4)
      Property Node(instance in=w4) -> ("State"=w5)
      case (w5) {
        frame Default {
          Tag Read(ref in="Globals::Constants.grsc::Zero Buffer") -> (Data=w3)
          w2 = w4
        }
        frame "Active" {
          Property Node(instance in=w4) -> ("ID"=w6, "Reverse"=w7, "PlaybackPosition"=w8, "Pitch"=w9, "PitchBendDown"=w10, "PitchBendUp"=w11, "Track Info"=w12, "PositionHistory"=w13, "Playing"=w14)
          Property Node(instance in=w12) -> ("Length (Samples)"=w15)
          Property Node(instance in=w9) -> ("Value"=w16)
          case (w14) {
            frame False, Default {
              Build Array(w8) -> w17
              Property Node(instance in=cluster{"Element 1": i32[]} {all zero or empty}, "Element 1"=w17) -> (instance out=w18)
              Build Array(w13, w18) -> w19
              Coerce To Type(type=cluster{"Positions": i32[]}[] [], x=w19) -> w20
              Array Subset(array=w20, index0=1) -> w21
              Property Node(instance in=w4, "PlaybackPosition"=w8, "PositionHistory"=w21, "ScratchPositions"=i32[] []) -> (instance out=w2)
              Tag Read(ref in="Globals::Constants.grsc::Zero Buffer") -> (Data=w3)
            }
            frame True {
              call "Calculate Playback Speed.gvi"(Pitch=w16, Pitch Bend Down (F)=w10, Pitch Bend Up (F)=w11) -> (Speed Multiplier=w22)
              call "Calculate Sample Buffer Size.gvi"(Speed Multiplier=w22, Reverse (F)=w7) -> (Sample Size=w23)
              # Playback position will build up error here (up to 1ms per second). Is this noticable?
              Add(w8, w23) -> w24
              Is Less(x=w24, y=w15) -> w25
              Select(s=w25, t=w24, f=w15) -> w26
              call "Update UI.gvi"(ID=w6, Target="PlaybackPosition", Data=w26)
              call "Update UI.gvi"(ID=w6, Target="Jogwheel", Data=w26)
              Subtract(x=w15, y=w26) -> w27
              call "Format Sample To Time.gvi"(Samples=w27) -> (Formatted Time=w28)
              call "Update UI.gvi"(ID=w6, Target="Time", Data=w28)
              case (w25) {
                frame True { }
                frame False {
                  call "Update UI.gvi"(ID=w6, Target="Play", Data=FALSE)
                }
              }
              call "Copy Audio Sample.gvi"(Deck in=w4, Offset=w8, Length=w23) -> (Deck out=w29, Audio Block=w30)
              call "Change Audio Speed.gvi"(Audio Block=w30) -> (Interpolated Audio=w3)
              Build Array(w26) -> w31
              Property Node(instance in=cluster{"Element 1": i32[]} {all zero or empty}, "Element 1"=w31) -> (instance out=w32)
              Build Array(w13, w32) -> w33
              Coerce To Type(type=cluster{"Positions": i32[]}[] [], x=w33) -> w34
              Array Subset(array=w34, index0=1) -> w35
              Property Node(instance in=w29, "PlaybackPosition"=w26, "Playing"=w25, "PositionHistory"=w35, "ScratchPositions"=i32[] []) -> (instance out=w2)
            }
          }
        }
        frame "Brake" {
          Property Node(instance in=w4) -> ("ID"=w36, "Reverse"=w37, "PlaybackPosition"=w38, "Pitch"=w39, "BrakeSpeed"=w40, "Track Info"=w41, "Playing"=w42)
          Property Node(instance in=w41) -> ("Length (Samples)"=w43)
          Is Equal(x=w40, y=1) -> w44
          Property Node(instance in=w39) -> ("Value"=w45)
          call "Calculate Playback Speed.gvi"(Pitch=w45) -> (Speed Multiplier=w46)
          Select(s=w44, t=w46, f=w40) -> w47
          call "Calculate Sample Buffer Size.gvi"(Speed Multiplier=w47, Reverse (F)=w37) -> (Sample Size=w48)
          Add(w38, w48) -> w49
          Is Less(x=w49, y=w43) -> w50
          Select(s=w50, t=w49, f=w43) -> w51
          call "Update UI.gvi"(ID=w36, Target="PlaybackPosition", Data=w51)
          call "Update UI.gvi"(ID=w36, Target="Jogwheel", Data=w51)
          Subtract(x=w43, y=w51) -> w52
          call "Format Sample To Time.gvi"(Samples=w52) -> (Formatted Time=w53)
          call "Update UI.gvi"(ID=w36, Target="Time", Data=w53)
          Subtract(x=w47, y=0.01) -> w54
          Is Greater(x=w54, y=0) -> w55
          Logical And(w55, w50) -> w56
          Logical And(w56, w42) -> w57
          case (w57) {
            frame True { }
            frame False {
              call "Update UI.gvi"(ID=w36, Target="Play", Data=FALSE)
              call "Update UI.gvi"(ID=w36, Target="Brake", Data=FALSE)
            }
          }
          call "Copy Audio Sample.gvi"(Deck in=w4, Offset=w38, Length=w48) -> (Deck out=w58, Audio Block=w59)
          Select(s=w55, t=w54, f=1) -> w60
          Select(s=w56, t=w5, f="Active") -> w61
          Property Node(instance in=w58, "PlaybackPosition"=w51, "State"=w61, "BrakeSpeed"=w60, "Playing"=w57) -> (instance out=w2)
          call "Change Audio Speed.gvi"(Audio Block=w59) -> (Interpolated Audio=w3)
        }
        frame "Backspin" {
          Property Node(instance in=w4) -> ("ID"=w62, "PlaybackPosition"=w63, "BackspinSpeed"=w64, "Track Info"=w65, "Playing"=w66)
          Property Node(instance in=w65) -> ("Length (Samples)"=w67)
          call "Calculate Sample Buffer Size.gvi"(Speed Multiplier=w64, Reverse (F)=TRUE) -> (Sample Size=w68)
          Add(w63, w68) -> w69
          Is Less(x=w69, y=w67) -> w70
          Select(s=w70, t=w69, f=w67) -> w71
          call "Update UI.gvi"(ID=w62, Target="PlaybackPosition", Data=w71)
          call "Update UI.gvi"(ID=w62, Target="Jogwheel", Data=w71)
          Subtract(x=w67, y=w71) -> w72
          call "Format Sample To Time.gvi"(Samples=w72) -> (Formatted Time=w73)
          call "Update UI.gvi"(ID=w62, Target="Time", Data=w73)
          Subtract(x=w64, y=0.2) -> w74
          Is Greater(x=w74, y=0) -> w75
          Logical And(w75, w70) -> w76
          Logical And(w76, w66) -> w77
          case (w77) {
            frame True { }
            frame False {
              call "Update UI.gvi"(ID=w62, Target="Play", Data=FALSE)
              call "Update UI.gvi"(ID=w62, Target="Backspin", Data=FALSE)
            }
          }
          call "Copy Audio Sample.gvi"(Deck in=w4, Offset=w63, Length=w68) -> (Deck out=w78, Audio Block=w79)
          Select(s=w75, t=w74, f=5) -> w80
          Select(s=w76, t=w5, f="Active") -> w81
          Property Node(instance in=w78, "PlaybackPosition"=w71, "State"=w81, "BackspinSpeed"=w80, "Playing"=w77) -> (instance out=w2)
          call "Change Audio Speed.gvi"(Audio Block=w79) -> (Interpolated Audio=w3)
        }
        frame "Scratching" {
          Property Node(instance in=w4) -> ("ID"=w82, "PlaybackPosition"=w83, "PositionHistory"=w84, "ScratchPositions"=w85, "Track Info"=w86)
          Property Node(instance in=w86) -> ("Length (Samples)"=w87)
          Array Size(array=w85) -> (size(s)=w88)
          # #TODO
          # The scratching implementation here is servicable at best. It uses the last two scratch positions plus the current one to constuct a smooth curve comprising all of the intermediate sample positions for the scratch. Those samples positions are then used when interpolating the audio.
          #
          # A better scratch might include timestamps of user events (rather than being quantized to the nearest sample block). The historical curve fitting probably still has merit, but needs a rethink and cleanup. The need to reset the scratch history in so many other places is also bad. At least have a class method to do it.
          case (w88) {
            frame 0 {
              Build Array(w83) -> w92
              Property Node(instance in=cluster{"Element 1": i32[]} {all zero or empty}, "Element 1"=w92) -> (instance out=w93)
              Build Array(w84, w93) -> w94
              Coerce To Type(type=cluster{"Positions": i32[]}[] [], x=w94) -> w91
              Tag Read(ref in="Globals::Constants.grsc::Zero Buffer") -> (Data=w3)
              w89 = w83
              w90 = w4
            }
            frame Default {
              Array Size(array=w85) -> (size(s)=w95)
              Decrement(x=w95) -> w96
              Array Index(array=w85) -> (out0[w96]=w97)
              In Range And Coerce[IncludeHighLimit=True](lower limit=0, upper limit=w87, x=w97) -> (coerced(x)=w89)
              Subtract(x=w97, y=w83) -> w98
              call "Copy Audio Sample.gvi"(Deck in=w4, Offset=w83, Length=w98) -> (Deck out=w90, Audio Block=w99)
              Array Size(array=w84) -> (size(s)=w100)
              Negate(x=w100) -> w101
              Property Node(instance in=cluster{"ScratchPositions": i32[]} {all zero or empty}, "ScratchPositions"=w85) -> (instance out=w102)
              Build Array(w84, w102) -> w103
              Coerce To Type(type=cluster{"ScratchPositions": i32[]}[] [], x=w103) -> w91
              for (iteration -> i1) {
                w104 = each element of w91
                Add(w101, i1) -> w107
                Property Node(instance in=w104) -> ("ScratchPositions"=w108)
                Array Size(array=w108) -> (size(s)=w109)
                Reciprocal(x=w109) -> w110
                for (N = w109) (iteration -> i2) {
                  Increment(x=i2) -> w112
                  Multiply(w110, w112) -> w113
                  Add(w107, w113) -> w114
                  append w114 to w111
                }
                concatenate w111 onto w105
                concatenate w108 onto w106
              }
              Subtract(x=w106, y=w83) -> w115
              Tag Read(ref in="Globals::Constants.grsc::Buffer Size") -> (Data=w116)
              Reciprocal(x=w116) -> w117
              for (N = w116) (iteration -> i3) {
                Multiply(w117, i3) -> w119
                append w119 to w118
              }
              case ("cubic Hermite"(3)) {
                frame 0, Default {
                  call "Nearest Interpolation 1D.gvi"(x is monotonic?=FALSE, y=w115, x=w105, xi=w118, ntimes=1) -> (yi=w120, xi used=w122, error out=w121)
                }
                frame 1 {
                  call "Linear Interpolation 1D.gvi"(x is monotonic?=FALSE, y=w115, x=w105, xi=w118, ntimes=1) -> (yi=w120, xi used=w123, error out=w121)
                }
                frame 2 {
                  call "Spline Interpolation 1D.gvi"(y=w115, x=w105, xi=w118, ntimes=1) -> (error out=w121, yi=w120, xi used=w124)
                }
                frame 3 {
                  call "Hermite Interpolation 1D.gvi"(y=w115, x=w105, xi=w118, ntimes=1) -> (error out=w121, xi used=w125, yi=w120)
                }
                frame 4 {
                  call "Polynomial Interpolation 1D.gvi"(x is monotonic?=FALSE, y=w115, x=w105, xi=w118, ntimes=1) -> (yi=w120, xi used=w126, error out=w121)
                }
              }
              Absolute Value(x=w120) -> w127
              for {
                w128 = each element of w99
                case ("spline"(2)) {
                  frame 0, Default {
                    call "Nearest Interpolation 1D.gvi"(x is monotonic?=TRUE, y=w128, x=f64[] [], xi=w127, ntimes=1) -> (yi=w130, xi used=w132, error out=w131)
                  }
                  frame 1 {
                    call "Linear Interpolation 1D.gvi"(x is monotonic?=TRUE, y=w128, x=f64[] [], xi=w127, ntimes=1) -> (yi=w130, xi used=w133, error out=w131)
                  }
                  frame 2 {
                    call "Spline Interpolation 1D.gvi"(y=w128, x=f64[] [], xi=w127, ntimes=1) -> (error out=w131, yi=w130, xi used=w134)
                  }
                  frame 3 {
                    call "Hermite Interpolation 1D.gvi"(y=w128, x=f64[] [], xi=w127, ntimes=1) -> (error out=w131, xi used=w135, yi=w130)
                  }
                  frame 4 {
                    call "Polynomial Interpolation 1D.gvi"(x is monotonic?=TRUE, y=w128, x=f64[] [], xi=w127, ntimes=1) -> (yi=w130, xi used=w136, error out=w131)
                  }
                }
                Property Node(instance in=w131)
                append w130 to w129
              }
              Tag Read(ref in="Globals::Constants.grsc::Zero Buffer") -> (Data=w137)
              Is Not A Number Or Path Or Refnum(number=w129) -> w138
              Or Array Elements(Boolean array=w138) -> (logical OR=w139)
              Select(s=w139, t=w137, f=w129) -> w3
              Property Node(instance in=w121)
            }
          }
          call "Update UI.gvi"(ID=w82, Target="PlaybackPosition", Data=w89)
          Subtract(x=w87, y=w89) -> w140
          call "Format Sample To Time.gvi"(Samples=w140) -> (Formatted Time=w141)
          call "Update UI.gvi"(ID=w82, Target="Time", Data=w141)
          Coerce To Type(type=cluster{"ScratchPositions": i32[]}[] [], x=w91) -> w142
          Array Subset(array=w142, index0=1) -> w143
          Property Node(instance in=w90, "PositionHistory"=w143, "PlaybackPosition"=w89, "ScratchPositions"=i32[] []) -> (instance out=w2)
        }
      }
      w1 = $"error in (no error)"
    }
    frame Error {
      Tag Read(ref in="Globals::Constants.grsc::Zero Buffer") -> (Data=w3)
      w1 = $"error in (no error)"
      w2 = $"Deck in"
    }
  }
  $"Deck out" <- w2
  $"Audio Block" <- w3
  $"error out" <- w1
