vi "Cleanup.gvi"   [LabVIEW Conversion 4.0.0]
inputs:
  "Channel in": "Channel.gtype", required
  "error in (no error)": error
outputs:
  "error out": error
uses:
  MergedDependencies::Effect.gtype::Cleanup.gvi
diagram:
  Property Node(instance in=$"Channel in") -> ("Message Queue"=w1, "Effects"=w2)
  Release Queue(error in=$"error in (no error)", force destroy=TRUE, queue=w1) -> (error out=w3)
  for {
    w4 = each element of w2
    call "Cleanup.gvi"(Effect in=w4) -> (error out=w6)
    append w6 to w5
  }
  Merge Errors(w5, w3) -> (error out=w7)
  $"error out" <- w7
