vi "EQ.gvi"   [LabVIEW NXG 4.0.0]
# Perform 3-band (low, mid, high) equalization of the audio data using Butterworth filters.
inputs:
  "Channel in": "Channel.gtype", required
  "Audio Block In": f64[][], required
  "error in (no error)": error
outputs:
  "Audio Block Out": f64[][]
  "error out": error
uses:
  NI::Analysis::Filtering::Butterworth Highpass Filter (DBL).gvi
  NI::Analysis::Filtering::Butterworth Bandpass Filter (DBL).gvi
  NI::Analysis::Filtering::Butterworth Lowpass Filter (DBL).gvi
diagram:
  Property Node(instance in=$"Channel in") -> ("EQ High"=w1, "EQ Mid"=w2, "EQ Low"=w3)
  Property Node(instance in=w1) -> ("Level"=w4, "Kill"=w5)
  Select(s=w5, t=0, f=w4) -> w6
  Property Node(instance in=w2) -> ("Level"=w7, "Kill"=w8)
  Select(s=w8, t=0, f=w7) -> w9
  Property Node(instance in=w3) -> ("Level"=w10, "Kill"=w11)
  Select(s=w11, t=0, f=w10) -> w12
  Tag Read(ref in="Globals::Constants.grsc::Sample Rate") -> (Data=w13)
  To Double Precision Float(number=w13) -> w14
  Is First Call() -> w15
  Not(x=w15) -> w16
  # #BUG
  # If a NaN makes its way into the audio block, the filters will forever output NaNs, regardless of input.
  #
  # Reinit the filters if this happens?
  # Wire the error cluster across even in the "No Error"
  # case so that warnings get propagated.
  for (iteration -> i1) {
    w17 = each element of $"Audio Block In"
    case (i1) {
      frame Default {
        # Not expecting more than two channels, so pass them through unfiltered
        w19 = w17
      }
      frame 0 {
        Not(x=w16) -> w20
        call "Butterworth Highpass Filter (DBL).gvi"(signal=w17, sampling frequency=w14, cutoff frequency=3000, reset=w20, order=3) -> (filtered signal=w21, error out=w22)
        Property Node(instance in=w22)
        Multiply(w21, w6) -> w23
        Not(x=w16) -> w24
        # Left channel
        call "Butterworth Bandpass Filter (DBL).gvi"(signal=w17, sampling frequency=w14, high cutoff frequency=2500, low cutoff frequency=450, reset=w24, order=3) -> (filtered signal=w25, error out=w26)
        Multiply(w25, w9) -> w27
        Not(x=w16) -> w28
        call "Butterworth Lowpass Filter (DBL).gvi"(signal=w17, sampling frequency=w14, cutoff frequency=400, reset=w28, order=3) -> (filtered signal=w29, error out=w30)
        Multiply(w29, w12) -> w31
        Add(w23, w27, w31) -> w19
        Property Node(instance in=w30)
        Property Node(instance in=w26)
      }
      frame 1 {
        Not(x=w16) -> w32
        call "Butterworth Highpass Filter (DBL).gvi"(signal=w17, sampling frequency=w14, cutoff frequency=3000, reset=w32, order=3) -> (filtered signal=w33, error out=w34)
        Property Node(instance in=w34)
        Multiply(w33, w6) -> w35
        Not(x=w16) -> w36
        # Right channel
        call "Butterworth Bandpass Filter (DBL).gvi"(signal=w17, sampling frequency=w14, high cutoff frequency=2500, low cutoff frequency=450, reset=w36, order=3) -> (filtered signal=w37, error out=w38)
        Multiply(w37, w9) -> w39
        Not(x=w16) -> w40
        call "Butterworth Lowpass Filter (DBL).gvi"(signal=w17, sampling frequency=w14, cutoff frequency=400, reset=w40, order=3) -> (filtered signal=w41, error out=w42)
        Multiply(w41, w12) -> w43
        Add(w35, w39, w43) -> w19
        Property Node(instance in=w42)
        Property Node(instance in=w38)
      }
    }
    append w19 to w18
  }
  # The cases in this case stucture are identical (except the default).
  #
  # Each case exists to hold the reentrant filter VI states between calls to this VI. It would be nice if the for loop parallelism option handled and maintained each reentrant VI state, but alas that's not how it works.
  #
  # Another solution would be to create a pool of filter VI references which have are called based on channel number and filter level.
  $"Audio Block Out" <- w18
  $"error out" <- $"error in (no error)"
