vi "Init.gvi"   [LabVIEW Conversion 4.0.0]
inputs:
  "Channel in": "Channel.gtype"
  "ID": string, required
  "error in (no error)": error
outputs:
  "Channel out": "Channel.gtype"
  "error out": error
types:
  "EQ.gtype" = cluster{"Level": f64, "Kill": bool}
uses:
  MergedDependencies::Effect.gtype::Init.gvi
  Messaging::Create Message Queue.gvi
diagram:
  case ($"error in (no error)") {
    frame No Error {
      # Wire the error cluster across even in the "No Error"
      # case so that warnings get propagated.
      for (N = 3) (iteration -> i1) {
        Increment(x=i1) -> w4
        Format Into String(formatString="%s.%s%d", $ID, "Effect", w4) -> w5
        call "Init.gvi"(ID=w5, Type=w4) -> (Effect out=w6)
        append w6 to w3
      }
      call "Create Message Queue.gvi"(Queue Name=$ID) -> (queue out=w7)
      Property Node(instance in=$"Channel in", "ID"=$ID, "Message Queue"=w7, "Gain"=1, "Level"=1, "EQ High"="EQ.gtype" {"Level"=1, "Kill"=FALSE}, "EQ Mid"="EQ.gtype" {"Level"=1, "Kill"=FALSE}, "EQ Low"="EQ.gtype" {"Level"=1, "Kill"=FALSE}, "Effects"=w3) -> (instance out=w2)
      w1 = $"error in (no error)"
    }
    frame Error {
      w1 = $"error in (no error)"
      w2 = $"Channel in"
    }
  }
  $"Channel out" <- w2
  $"error out" <- w1
