vi "Process Messages.gvi"   [LabVIEW NXG 4.0.0]
inputs:
  "Channel in": "Channel.gtype", required
  "error in (no error)": error
outputs:
  "Channel out": "Channel.gtype"
  "error out": error
uses:
  Messaging::Update UI.gvi
  MergedDependencies::Effect.gtype::Process Messages.gvi
diagram:
  case ($"error in (no error)") {
    frame No Error {
      Property Node(instance in=$"Channel in") -> ("Message Queue"=w3, "ID"=w4)
      Flush Queue(queue=w3) -> (remaining elements=w5)
      # Wire the error cluster across even in the "No Error"
      # case so that warnings get propagated.
      s1 = $"Channel in"  # shift register
      for {
        w6 = each element of w5
        Property Node(instance in=w6) -> ("Event"=w7, "Data"=w8, "Target"=w9, "Source"=w10)
        case (w9) {
          frame Default {
            w11 = s1
          }
          frame "Gain" {
            case (w7) {
              frame Default {
                w11 = s1
              }
              frame "Value Change" {
                Property Node(instance in=s1) -> ("Gain"=w12)
                Variant To Data(type=w12, variant=w8) -> (data=w13)
                Property Node(instance in=s1, "Gain"=w13) -> (instance out=w11)
                case (w10) {
                  frame "UI" { }
                  frame Default {
                    call "Update UI.gvi"(ID=w4, Target=w9, Data=w13)
                  }
                }
              }
              frame "Increment" {
                Property Node(instance in=s1) -> ("Gain"=w14)
                Variant To Data(type=w14, variant=w8) -> (data=w15)
                Add(w14, w15) -> w16
                Property Node(instance in=s1, "Gain"=w16) -> (instance out=w11)
                case (w10) {
                  frame "UI" { }
                  frame Default {
                    call "Update UI.gvi"(ID=w4, Target=w9, Data=w16)
                  }
                }
              }
            }
          }
          frame "Level" {
            case (w7) {
              frame Default {
                w11 = s1
              }
              frame "Value Change" {
                Property Node(instance in=s1) -> ("Level"=w17)
                Variant To Data(type=w17, variant=w8) -> (data=w18)
                Property Node(instance in=s1, "Level"=w18) -> (instance out=w11)
                case (w10) {
                  frame "UI" { }
                  frame Default {
                    call "Update UI.gvi"(ID=w4, Target=w9, Data=w18)
                  }
                }
              }
              frame "Increment" {
                Property Node(instance in=s1) -> ("Level"=w19)
                Variant To Data(type=w19, variant=w8) -> (data=w20)
                Add(w19, w20) -> w21
                Property Node(instance in=s1, "Level"=w21) -> (instance out=w11)
                case (w10) {
                  frame "UI" { }
                  frame Default {
                    call "Update UI.gvi"(ID=w4, Target=w9, Data=w21)
                  }
                }
              }
            }
          }
          frame "EQHigh" {
            case (w7) {
              frame Default {
                w11 = s1
              }
              frame "Value Change" {
                Property Node(instance in=s1) -> ("EQ High"=w22)
                Property Node(instance in=w22) -> ("Level"=w23, instance out=w24)
                Variant To Data(type=w23, variant=w8) -> (data=w25)
                Property Node(instance in=w24, "Level"=w25) -> (instance out=w26)
                Property Node(instance in=s1, "EQ High"=w26) -> (instance out=w11)
                case (w10) {
                  frame "UI" { }
                  frame Default {
                    call "Update UI.gvi"(ID=w4, Target=w9, Data=w25)
                  }
                }
              }
              frame "Increment" {
                Property Node(instance in=s1) -> ("EQ High"=w27)
                Property Node(instance in=w27) -> ("Level"=w28, instance out=w29)
                Variant To Data(type=w28, variant=w8) -> (data=w30)
                Add(w28, w30) -> w31
                Property Node(instance in=w29, "Level"=w31) -> (instance out=w32)
                Property Node(instance in=s1, "EQ High"=w32) -> (instance out=w11)
                case (w10) {
                  frame "UI" { }
                  frame Default {
                    call "Update UI.gvi"(ID=w4, Target=w9, Data=w31)
                  }
                }
              }
            }
          }
          frame "EQMid" {
            case (w7) {
              frame Default {
                w11 = s1
              }
              frame "Value Change" {
                Property Node(instance in=s1) -> ("EQ Mid"=w33)
                Property Node(instance in=w33) -> ("Level"=w34, instance out=w35)
                Variant To Data(type=w34, variant=w8) -> (data=w36)
                Property Node(instance in=w35, "Level"=w36) -> (instance out=w37)
                Property Node(instance in=s1, "EQ Mid"=w37) -> (instance out=w11)
                case (w10) {
                  frame "UI" { }
                  frame Default {
                    call "Update UI.gvi"(ID=w4, Target=w9, Data=w36)
                  }
                }
              }
              frame "Increment" {
                Property Node(instance in=s1) -> ("EQ Mid"=w38)
                Property Node(instance in=w38) -> ("Level"=w39, instance out=w40)
                Variant To Data(type=w39, variant=w8) -> (data=w41)
                Add(w39, w41) -> w42
                Property Node(instance in=w40, "Level"=w42) -> (instance out=w43)
                Property Node(instance in=s1, "EQ Mid"=w43) -> (instance out=w11)
                case (w10) {
                  frame "UI" { }
                  frame Default {
                    call "Update UI.gvi"(ID=w4, Target=w9, Data=w42)
                  }
                }
              }
            }
          }
          frame "EQLow" {
            case (w7) {
              frame Default {
                w11 = s1
              }
              frame "Value Change" {
                Property Node(instance in=s1) -> ("EQ Low"=w44)
                Property Node(instance in=w44) -> ("Level"=w45, instance out=w46)
                Variant To Data(type=w45, variant=w8) -> (data=w47)
                Property Node(instance in=w46, "Level"=w47) -> (instance out=w48)
                Property Node(instance in=s1, "EQ Low"=w48) -> (instance out=w11)
                case (w10) {
                  frame "UI" { }
                  frame Default {
                    call "Update UI.gvi"(ID=w4, Target=w9, Data=w47)
                  }
                }
              }
              frame "Increment" {
                Property Node(instance in=s1) -> ("EQ Low"=w49)
                Property Node(instance in=w49) -> ("Level"=w50, instance out=w51)
                Variant To Data(type=w50, variant=w8) -> (data=w52)
                Add(w50, w52) -> w53
                Property Node(instance in=w51, "Level"=w53) -> (instance out=w54)
                Property Node(instance in=s1, "EQ Low"=w54) -> (instance out=w11)
                case (w10) {
                  frame "UI" { }
                  frame Default {
                    call "Update UI.gvi"(ID=w4, Target=w9, Data=w53)
                  }
                }
              }
            }
          }
          frame "EQHighKill" {
            case (w7) {
              frame Default {
                w11 = s1
              }
              frame "Value Change" {
                Property Node(instance in=s1) -> ("EQ High"=w55)
                Property Node(instance in=w55) -> ("Kill"=w56, instance out=w57)
                Variant To Data(type=w56, variant=w8) -> (data=w58)
                Property Node(instance in=w57, "Kill"=w58) -> (instance out=w59)
                Property Node(instance in=s1, "EQ High"=w59) -> (instance out=w11)
                case (w10) {
                  frame "UI" { }
                  frame Default {
                    call "Update UI.gvi"(ID=w4, Target=w9, Data=w58)
                  }
                }
              }
              frame "Toggle" {
                Property Node(instance in=s1) -> ("EQ High"=w60)
                Property Node(instance in=w60) -> ("Kill"=w61, instance out=w62)
                Not(x=w61) -> w63
                Property Node(instance in=w62, "Kill"=w63) -> (instance out=w64)
                Property Node(instance in=s1, "EQ High"=w64) -> (instance out=w11)
                case (w10) {
                  frame "UI" { }
                  frame Default {
                    call "Update UI.gvi"(ID=w4, Target=w9, Data=w63)
                  }
                }
              }
            }
          }
          frame "EQMidKill" {
            case (w7) {
              frame Default {
                w11 = s1
              }
              frame "Value Change" {
                Property Node(instance in=s1) -> ("EQ Mid"=w65)
                Property Node(instance in=w65) -> ("Kill"=w66, instance out=w67)
                Variant To Data(type=w66, variant=w8) -> (data=w68)
                Property Node(instance in=w67, "Kill"=w68) -> (instance out=w69)
                Property Node(instance in=s1, "EQ Mid"=w69) -> (instance out=w11)
                case (w10) {
                  frame "UI" { }
                  frame Default {
                    call "Update UI.gvi"(ID=w4, Target=w9, Data=w68)
                  }
                }
              }
              frame "Toggle" {
                Property Node(instance in=s1) -> ("EQ Mid"=w70)
                Property Node(instance in=w70) -> ("Kill"=w71, instance out=w72)
                Not(x=w71) -> w73
                Property Node(instance in=w72, "Kill"=w73) -> (instance out=w74)
                Property Node(instance in=s1, "EQ Mid"=w74) -> (instance out=w11)
                case (w10) {
                  frame "UI" { }
                  frame Default {
                    call "Update UI.gvi"(ID=w4, Target=w9, Data=w73)
                  }
                }
              }
            }
          }
          frame "EQLowKill" {
            case (w7) {
              frame Default {
                w11 = s1
              }
              frame "Value Change" {
                Property Node(instance in=s1) -> ("EQ Low"=w75)
                Property Node(instance in=w75) -> ("Kill"=w76, instance out=w77)
                Variant To Data(type=w76, variant=w8) -> (data=w78)
                Property Node(instance in=w77, "Kill"=w78) -> (instance out=w79)
                Property Node(instance in=s1, "EQ Low"=w79) -> (instance out=w11)
                case (w10) {
                  frame "UI" { }
                  frame Default {
                    call "Update UI.gvi"(ID=w4, Target=w9, Data=w78)
                  }
                }
              }
              frame "Toggle" {
                Property Node(instance in=s1) -> ("EQ Low"=w80)
                Property Node(instance in=w80) -> ("Kill"=w81, instance out=w82)
                Not(x=w81) -> w83
                Property Node(instance in=w82, "Kill"=w83) -> (instance out=w84)
                Property Node(instance in=s1, "EQ Low"=w84) -> (instance out=w11)
                case (w10) {
                  frame "UI" { }
                  frame Default {
                    call "Update UI.gvi"(ID=w4, Target=w9, Data=w83)
                  }
                }
              }
            }
          }
          frame "HeadphoneOutput" {
            case (w7) {
              frame Default {
                w11 = s1
              }
              frame "Value Change" {
                Property Node(instance in=s1) -> ("HeadphoneOutput"=w85)
                Variant To Data(type=w85, variant=w8) -> (data=w86)
                Property Node(instance in=s1, "HeadphoneOutput"=w86) -> (instance out=w11)
                case (w10) {
                  frame "UI" { }
                  frame Default {
                    call "Update UI.gvi"(ID=w4, Target=w9, Data=w86)
                  }
                }
              }
              frame "Toggle" {
                Property Node(instance in=s1) -> ("HeadphoneOutput"=w87)
                Not(x=w87) -> w88
                Property Node(instance in=s1, "HeadphoneOutput"=w88) -> (instance out=w11)
                case (w10) {
                  frame "UI" { }
                  frame Default {
                    call "Update UI.gvi"(ID=w4, Target=w9, Data=w88)
                  }
                }
              }
            }
          }
        }
        next s1 = w11
      }
      Property Node(instance in=s1) -> ("Effects"=w89)
      for {
        w90 = each element of w89
        call "Process Messages.gvi"(Effect in=w90) -> (Effect out=w92)
        append w92 to w91
      }
      Property Node(instance in=s1, "Effects"=w91) -> (instance out=w2)
      w1 = $"error in (no error)"
    }
    frame Error {
      w1 = $"error in (no error)"
      w2 = $"Channel in"
    }
  }
  $"Channel out" <- w2
  $"error out" <- w1
