vi "Update.gvi"   [LabVIEW Conversion 4.0.0]
inputs:
  "Channel in": "Channel.gtype", required
  "Audio Block In": f64[][], required
  "error in (no error)": error
outputs:
  "Channel out": "Channel.gtype"
  "Master Audio Block Out": f64[][]
  "Headphones Audio Block Out": f64[][]
  "error out": error
uses:
  MergedDependencies::Effect.gtype::Update.gvi
  MergedDependencies::Channel.gtype::EQ.gvi
diagram:
  case ($"error in (no error)") {
    frame No Error {
      Property Node(instance in=$"Channel in") -> ("Effects"=w5, "Gain"=w6, "Level"=w7, "HeadphoneOutput"=w8)
      s1 = $"Audio Block In"  # shift register
      for {
        w9 = each element of w5
        call "Update.gvi"(Effect in=w9, Audio Data In=s1) -> (Effect out=w11, Audio Data Out=w12)
        append w11 to w10
        next s1 = w12
      }
      Property Node(instance in=$"Channel in", "Effects"=w10) -> (instance out=w2)
      call "EQ.gvi"(Channel in=w2, Audio Block In=s1) -> (Audio Block Out=w13)
      Multiply(w13, w6) -> w14
      Multiply(w14, w7) -> w3
      case (w8) {
        frame False, Default {
          Tag Read(ref in="Globals::Constants.grsc::Zero Buffer") -> (Data=w4)
        }
        frame True {
          w4 = w14
        }
      }
      w1 = $"error in (no error)"
    }
    frame Error {
      w1 = $"error in (no error)"
      w2 = $"Channel in"
      w3 = $"Audio Block In"
      w4 = $"Audio Block In"
    }
  }
  $"Channel out" <- w2
  $"Master Audio Block Out" <- w3
  $"Headphones Audio Block Out" <- w4
  $"error out" <- w1
