vi "Cleanup.gvi"   [LabVIEW Conversion 4.0.0]
inputs:
  "Effect in": "Effect.gtype", required
  "error in (no error)": error
outputs:
  "error out": error
diagram:
  Property Node(instance in=$"Effect in") -> ("Message Queue"=w1)
  Release Queue(error in=$"error in (no error)", force destroy=TRUE, queue=w1) -> (error out=w2)
  $"error out" <- w2
