vi "Crusher.gvi"   [LabVIEW Conversion 4.0.0]
inputs:
  "Effect in": "Effect.gtype", required
  "Audio Data In": f64[][], required
  "error in (no error)": error
outputs:
  "Effect out": "Effect.gtype"
  "Audio Data Out": f64[][]
  "error out": error
uses:
  NI::Analysis::Resampling::Decimate (single shot, DBL).gvi
  NI::Analysis::Interpolation::Nearest Interpolation 1D.gvi
  NI::Analysis::Interpolation::Linear Interpolation 1D.gvi
  NI::Analysis::Interpolation::Spline Interpolation 1D.gvi
  NI::Analysis::Interpolation::Hermite Interpolation 1D.gvi
  NI::Analysis::Interpolation::Polynomial Interpolation 1D.gvi
diagram:
  $"Effect out" <- $"Effect in"
  Property Node(instance in=$"Effect in") -> ("Value1"=w1, "Value2"=w2)
  Power Of 2(x=w2) -> w3
  Matrix Size(matrix=$"Audio Data In") -> (number of columns=w4)
  for {
    w5 = each element of $"Audio Data In"
    call "Decimate (single shot, DBL).gvi"(signal=w5, decimating factor=w1) -> (decimated signal=w7)
    case ("nearest"(0)) {
      frame 0, Default {
        call "Nearest Interpolation 1D.gvi"(x is monotonic?=TRUE, y=w7, x=f64[] [], xi=w10, ntimes=1) -> (yi=w11, xi used=w12, error out=w9)
        w8 = w10
      }
      frame 1 {
        call "Linear Interpolation 1D.gvi"(x is monotonic?=TRUE, y=w7, x=f64[] [], xi=w13, ntimes=1) -> (yi=w14, xi used=w15, error out=w9)
        w8 = w13
      }
      frame 2 {
        call "Spline Interpolation 1D.gvi"(y=w7, x=f64[] [], xi=w16, ntimes=1) -> (error out=w9, yi=w17, xi used=w18)
        w8 = w16
      }
      frame 3 {
        call "Hermite Interpolation 1D.gvi"(y=w7, x=f64[] [], xi=w19, ntimes=1) -> (error out=w9, xi used=w20, yi=w21)
        w8 = w19
      }
      frame 4 {
        call "Polynomial Interpolation 1D.gvi"(x is monotonic?=TRUE, y=w7, x=f64[] [], xi=w22, ntimes=1) -> (yi=w23, xi used=w24, error out=w9)
        w8 = w22
      }
    }
    Property Node(instance in=w9)
    Array Size(array=w7) -> (size(s)=w25)
    Divide(x=w25, y=w4) -> w26
    for (N = w4) (iteration -> i1) {
      w27 = each element of w8
      Multiply(w26, i1) -> w27
    }
    append w28 to w6
  }
  Scale By Power Of 2(n=w2, x=w6) -> w29
  Round To Nearest(number=w29) -> w30
  Divide(x=w30, y=w3) -> w31
  $"Audio Data Out" <- w31
  $"error out" <- $"error in (no error)"
