vi "Echo.gvi"   [LabVIEW Conversion 4.0.0]
inputs:
  "Effect in": "Effect.gtype", required
  "Audio Data In": f64[][], required
  "error in (no error)": error
outputs:
  "Effect out": "Effect.gtype"
  "Audio Data Out": f64[][]
  "error out": error
diagram:
  Property Node(instance in=$"Effect in") -> ("Value1"=w1, "Value2"=w2, "Audio History Buffer"=w3)
  # Convert to samples
  # Have an audio history buffer (1 second)
  # Index into buffer at some delay amount (say 0.5s)
  # Grab necessary buffer size (0.5s + 1024 samples)
  # Multiply by amount
  # Add to audio buffer
  # Replace last block in audio buffer with mixed buffer for feedback
  Matrix Size(matrix=$"Audio Data In") -> (number of columns=w4)
  Tag Read(ref in="Globals::Constants.grsc::Sample Rate") -> (Data=w5)
  Subtract(x=w5, y=w4) -> w6
  Multiply(w2, w5) -> w7
  Subtract(x=w5, y=w7) -> w8
  In Range And Coerce[IncludeHighLimit=True](lower limit=0, upper limit=w6, x=w8) -> (coerced(x)=w9)
  Array Subset(array=w3, index1=w9, length1=w4) -> w10
  Multiply(w1, w10) -> w11
  Add($"Audio Data In", w11) -> w12
  Matrix Size(matrix=w3) -> (number of columns=w13)
  Subtract(x=w13, y=w4) -> w14
  Decrement(x=w14) -> w15
  for {
    w16 = each element of w3
    w17 = each element of w12
    Replace Array Subset(inArray=w16, index=w15, new=w17) -> w19
    append w19 to w18
  }
  Property Node(instance in=$"Effect in", "Audio History Buffer"=w18) -> (instance out=w20)
  $"Effect out" <- w20
  $"Audio Data Out" <- w12
  $"error out" <- $"error in (no error)"
