vi "Flanger.gvi"   [LabVIEW Conversion 4.0.0]
inputs:
  "Effect in": "Effect.gtype", required
  "Audio Data In": f64[][], required
  "error in (no error)": error
outputs:
  "Effect out": "Effect.gtype"
  "Audio Data Out": f64[][]
  "error out": error
uses:
  NI::Analysis::Generation::Sine Wave (Scalar DBL).gvi
diagram:
  $"Effect out" <- $"Effect in"
  Property Node(instance in=$"Effect in") -> ("Value1"=w1, "Value2"=w2, "Audio History Buffer"=w3)
  Matrix Size(matrix=$"Audio Data In") -> (number of columns=w4)
  Feedback Node(initial value=0, input=w5) -> w6
  Add(w6, 0.125) -> w5
  Multiply(w2, w5) -> w7
  Multiply(w7, 360) -> w8
  Add(w8, 0) -> w9
  call "Sine Wave (Scalar DBL).gvi"(reset phase=TRUE, amplitude=80, frequency=w2, phase in=w9, sample rate=1) -> (sine wave=w10)
  Matrix Size(matrix=w3) -> (number of columns=w11)
  Subtract(x=w11, y=80) -> w12
  Subtract(x=w12, y=w4) -> w13
  Subtract(x=w13, y=w10) -> w14
  To Signed 32 Bit Integer(number=w14) -> w15
  Array Subset(array=w3, index1=w15, length1=w4) -> w16
  Add($"Audio Data In", w16) -> w17
  Multiply(w1, w17) -> w18
  Subtract(x=1, y=w1) -> w19
  Multiply($"Audio Data In", w19) -> w20
  Add(w20, w18) -> w21
  $"Audio Data Out" <- w21
  $"error out" <- $"error in (no error)"
