vi "Init.gvi"   [LabVIEW Conversion 4.0.0]
inputs:
  "Effect in": "Effect.gtype"
  "ID": string, required
  "Type": i32, required
  "error in (no error)": error
outputs:
  "Effect out": "Effect.gtype"
  "error out": error
uses:
  Messaging::Create Message Queue.gvi
diagram:
  case ($"error in (no error)") {
    frame No Error {
      call "Create Message Queue.gvi"(Queue Name=$ID) -> (queue out=w3)
      # Wire the error cluster across even in the "No Error"
      # case so that warnings get propagated.
      Property Node(instance in=$"Effect in", "ID"=$ID, "Message Queue"=w3, "Enable"=FALSE, "Value1"=0, "Value2"=1, "Effect Type"=$Type) -> (instance out=w2)
      w1 = $"error in (no error)"
    }
    frame Error {
      w1 = $"error in (no error)"
      w2 = $"Effect in"
    }
  }
  $"Effect out" <- w2
  $"error out" <- w1
