vi "Process Messages.gvi"   [LabVIEW Conversion 4.0.0]
inputs:
  "Effect in": "Effect.gtype", required
  "error in (no error)": error
outputs:
  "Effect out": "Effect.gtype"
  "error out": error
uses:
  Messaging::Update UI.gvi
diagram:
  case ($"error in (no error)") {
    frame No Error {
      Property Node(instance in=$"Effect in") -> ("Message Queue"=w3, "ID"=w4)
      Flush Queue(queue=w3) -> (remaining elements=w5)
      # Wire the error cluster across even in the "No Error"
      # case so that warnings get propagated.
      s1 = $"Effect in"  # shift register
      for {
        w6 = each element of w5
        Property Node(instance in=w6) -> ("Event"=w7, "Data"=w8, "Target"=w9, "Source"=w10)
        case (w9) {
          frame Default {
            w11 = s1
          }
          frame "Enable" {
            case (w7) {
              frame Default {
                w11 = s1
              }
              frame "Value Change" {
                Property Node(instance in=s1) -> ("Enable"=w12)
                Variant To Data(type=w12, variant=w8) -> (data=w13)
                Property Node(instance in=s1, "Enable"=w13) -> (instance out=w11)
                case (w10) {
                  frame "UI" { }
                  frame Default {
                    call "Update UI.gvi"(ID=w4, Target=w9, Data=w13)
                  }
                }
              }
              frame "Toggle" {
                Property Node(instance in=s1) -> ("Enable"=w14)
                Not(x=w14) -> w15
                Property Node(instance in=s1, "Enable"=w15) -> (instance out=w11)
                case (w10) {
                  frame "UI" { }
                  frame Default {
                    call "Update UI.gvi"(ID=w4, Target=w9, Data=w15)
                  }
                }
              }
            }
          }
          frame "Value1" {
            case (w7) {
              frame Default {
                w11 = s1
              }
              frame "Value Change" {
                Property Node(instance in=s1) -> ("Value1"=w16)
                Variant To Data(type=w16, variant=w8) -> (data=w17)
                Property Node(instance in=s1, "Value1"=w17) -> (instance out=w11)
                case (w10) {
                  frame "UI" { }
                  frame Default {
                    call "Update UI.gvi"(ID=w4, Target=w9, Data=w17)
                  }
                }
              }
              frame "Increment" {
                Property Node(instance in=s1) -> ("Value1"=w18)
                Variant To Data(type=w18, variant=w8) -> (data=w19)
                Add(w18, w19) -> w20
                Property Node(instance in=s1, "Value1"=w20) -> (instance out=w11)
                case (w10) {
                  frame "UI" { }
                  frame Default {
                    call "Update UI.gvi"(ID=w4, Target=w9, Data=w20)
                  }
                }
              }
            }
          }
          frame "Value2" {
            case (w7) {
              frame Default {
                w11 = s1
              }
              frame "Value Change" {
                Property Node(instance in=s1) -> ("Value2"=w21)
                Variant To Data(type=w21, variant=w8) -> (data=w22)
                Property Node(instance in=s1, "Value2"=w22) -> (instance out=w11)
                case (w10) {
                  frame "UI" { }
                  frame Default {
                    call "Update UI.gvi"(ID=w4, Target=w9, Data=w22)
                  }
                }
              }
              frame "Increment" {
                Property Node(instance in=s1) -> ("Value2"=w23)
                Variant To Data(type=w23, variant=w8) -> (data=w24)
                Add(w23, w24) -> w25
                Property Node(instance in=s1, "Value2"=w25) -> (instance out=w11)
                case (w10) {
                  frame "UI" { }
                  frame Default {
                    call "Update UI.gvi"(ID=w4, Target=w9, Data=w25)
                  }
                }
              }
            }
          }
        }
        next s1 = w11
      }
      w1 = $"error in (no error)"
      w2 = s1
    }
    frame Error {
      w1 = $"error in (no error)"
      w2 = $"Effect in"
    }
  }
  $"Effect out" <- w2
  $"error out" <- w1
