vi "Update Audio History.gvi"   [LabVIEW Conversion 4.0.0]
# Updates the audio history buffer with new samples. If the history buffer doesn't exist, it is automatically created according to the sample size input.
# The audio history buffer always has the oldest sample at index 0, and the latest sample at index (size - 1). As new samples are inserted into the history buffer, the buffer is rotated to maintain the oldest sample at index 0.
inputs:
  "Effect in": "Effect.gtype", required
  "Audio Data In": f64[][], required
  "History Buffer Size (Samples) (44100)": i32 = 44100
  "error in (no error)": error
outputs:
  "Effect out": "Effect.gtype"
  "error out": error
diagram:
  case ($"error in (no error)") {
    frame No Error {
      Property Node(instance in=$"Effect in") -> ("Audio History Buffer"=w3)
      Is Empty Array(array=w3) -> w4
      Matrix Size(matrix=$"Audio Data In") -> (number of rows=w5)
      case (w4) {
        frame False, Default {
          w6 = w3
        }
        frame True {
          Initialize Array(element=0, size=w5, size=$"History Buffer Size (Samples) (44100)") -> w6
        }
      }
      # Wire the error cluster across even in the "No Error"
      # case so that warnings get propagated.
      for {
        w7 = each element of $"Audio Data In"
        w8 = each element of w6
        Array Size(array=w7) -> (size(s)=w10)
        Negate(x=w10) -> w11
        Replace Array Subset(inArray=w8, index=_, new=w7) -> w12
        Rotate 1D Array(array=w12, n=w11) -> (array (last n elements first)=w13)
        append w13 to w9
      }
      Property Node(instance in=$"Effect in", "Audio History Buffer"=w9) -> (instance out=w2)
      w1 = $"error in (no error)"
    }
    frame Error {
      w1 = $"error in (no error)"
      w2 = $"Effect in"
    }
  }
  $"Effect out" <- w2
  $"error out" <- w1
