vi "Update.gvi"   [LabVIEW Conversion 4.0.0]
inputs:
  "Effect in": "Effect.gtype", required
  "Audio Data In": f64[][], required
  "error in (no error)": error
outputs:
  "Effect out": "Effect.gtype"
  "Audio Data Out": f64[][]
  "error out": error
uses:
  MergedDependencies::Effect.gtype::Update Audio History.gvi
  MergedDependencies::Effect.gtype::Flanger.gvi
  MergedDependencies::Effect.gtype::Crusher.gvi
  MergedDependencies::Effect.gtype::Echo.gvi
diagram:
  case ($"error in (no error)") {
    frame No Error {
      call "Update Audio History.gvi"(Effect in=$"Effect in", Audio Data In=$"Audio Data In") -> (Effect out=w4)
      Property Node(instance in=w4) -> ("Enable"=w5, "Effect Type"=w6)
      case (w5) {
        frame False, Default {
          w3 = $"Audio Data In"
          w2 = w4
        }
        frame True {
          case (w6) {
            frame Default {
              w3 = $"Audio Data In"
              w2 = w4
            }
            frame 1 {
              call "Flanger.gvi"(Effect in=w4, Audio Data In=$"Audio Data In") -> (Effect out=w2, Audio Data Out=w3)
            }
            frame 2 {
              call "Crusher.gvi"(Effect in=w4, Audio Data In=$"Audio Data In") -> (Effect out=w2, Audio Data Out=w3)
            }
            frame 3 {
              call "Echo.gvi"(Effect in=w4, Audio Data In=$"Audio Data In") -> (Effect out=w2, Audio Data Out=w3)
            }
          }
        }
      }
      w1 = $"error in (no error)"
    }
    frame Error {
      w1 = $"error in (no error)"
      w2 = $"Effect in"
      w3 = $"Audio Data In"
    }
  }
  $"Effect out" <- w2
  $"Audio Data Out" <- w3
  $"error out" <- w1
