vi "Cleanup.gvi"   [LabVIEW Conversion 4.0.0]
inputs:
  "Mixer in": "Mixer.gtype", required
  "error in (no error)": error
outputs:
  "Mixer out": "Mixer.gtype"
  "error out": error
uses:
  MergedDependencies::Channel.gtype::Cleanup.gvi
diagram:
  case ($"error in (no error)") {
    frame No Error {
      Property Node(instance in=$"Mixer in") -> ("Message Queue"=w3, "Channels"=w4)
      Release Queue(error in=$"error in (no error)", force destroy=TRUE, queue=w3) -> (error out=w5)
      for {
        w6 = each element of w4
        call "Cleanup.gvi"(Channel in=w6) -> (error out=w8)
        append w8 to w7
      }
      Merge Errors(w7, w5) -> (error out=w1)
      w2 = $"Mixer in"
    }
    frame Error {
      w1 = $"error in (no error)"
      w2 = $"Mixer in"
    }
  }
  $"Mixer out" <- w2
  $"error out" <- w1
