vi "Init.gvi"   [LabVIEW Conversion 4.0.0]
inputs:
  "Mixer in": "Mixer.gtype"
  "ID": string, required
  "error in (no error)": error
outputs:
  "Mixer out": "Mixer.gtype"
  "error out": error
uses:
  MergedDependencies::Channel.gtype::Init.gvi
  Messaging::Create Message Queue.gvi
diagram:
  case ($"error in (no error)") {
    frame No Error {
      for (N = 2) (iteration -> i1) {
        Increment(x=i1) -> w4
        Format Into String(formatString="%s.%s%d", $ID, "Channel", w4) -> w5
        call "Init.gvi"(ID=w5) -> (Channel out=w6)
        append w6 to w3
      }
      call "Create Message Queue.gvi"(Queue Name=$ID) -> (queue out=w7)
      Property Node(instance in=$"Mixer in", "ID"=$ID, "Message Queue"=w7, "Crossfader"=0, "Master"=1, "Headphones"=1, "Channels"=w3) -> (instance out=w2)
      w1 = $"error in (no error)"
    }
    frame Error {
      w1 = $"error in (no error)"
      w2 = $"Mixer in"
    }
  }
  $"Mixer out" <- w2
  $"error out" <- w1
