vi "Process Messages.gvi"   [LabVIEW Conversion 4.0.0]
inputs:
  "Mixer in": "Mixer.gtype", required
  "error in (no error)": error
outputs:
  "Mixer out": "Mixer.gtype"
  "error out": error
uses:
  Messaging::Update UI.gvi
  MergedDependencies::Channel.gtype::Process Messages.gvi
diagram:
  case ($"error in (no error)") {
    frame No Error {
      Property Node(instance in=$"Mixer in") -> ("Message Queue"=w3, "ID"=w4)
      Flush Queue(queue=w3) -> (remaining elements=w5)
      # Events:
      #
      # Load Track
      # Track Loaded
      # Value Change
      # Increment
      # Toggle
      # Mouse Up
      # Wire the error cluster across even in the "No Error"
      # case so that warnings get propagated.
      s1 = $"Mixer in"  # shift register
      for {
        w6 = each element of w5
        Property Node(instance in=w6) -> ("Event"=w7, "Data"=w8, "Target"=w9, "Source"=w10)
        case (w9) {
          frame Default {
            w11 = s1
          }
          frame "Crossfader" {
            case (w7) {
              frame Default {
                w11 = s1
              }
              frame "Value Change" {
                Property Node(instance in=s1) -> ("Crossfader"=w12)
                Variant To Data(type=w12, variant=w8) -> (data=w13)
                Property Node(instance in=s1, "Crossfader"=w13) -> (instance out=w11)
                case (w10) {
                  frame "UI" { }
                  frame Default {
                    call "Update UI.gvi"(ID=w4, Target=w9, Data=w13)
                  }
                }
              }
              frame "Increment" {
                Property Node(instance in=s1) -> ("Crossfader"=w14)
                Variant To Data(type=w14, variant=w8) -> (data=w15)
                Add(w14, w15) -> w16
                Property Node(instance in=s1, "Crossfader"=w16) -> (instance out=w11)
                case (w10) {
                  frame "UI" { }
                  frame Default {
                    call "Update UI.gvi"(ID=w4, Target=w9, Data=w16)
                  }
                }
              }
            }
          }
          frame "Master" {
            case (w7) {
              frame Default {
                w11 = s1
              }
              frame "Value Change" {
                Property Node(instance in=s1) -> ("Master"=w17)
                Variant To Data(type=w17, variant=w8) -> (data=w18)
                Property Node(instance in=s1, "Master"=w18) -> (instance out=w11)
                case (w10) {
                  frame "UI" { }
                  frame Default {
                    call "Update UI.gvi"(ID=w4, Target=w9, Data=w18)
                  }
                }
              }
              frame "Increment" {
                Property Node(instance in=s1) -> ("Master"=w19)
                Variant To Data(type=w19, variant=w8) -> (data=w20)
                Add(w19, w20) -> w21
                Property Node(instance in=s1, "Master"=w21) -> (instance out=w11)
                case (w10) {
                  frame "UI" { }
                  frame Default {
                    call "Update UI.gvi"(ID=w4, Target=w9, Data=w21)
                  }
                }
              }
            }
          }
          frame "Headphones" {
            case (w7) {
              frame Default {
                w11 = s1
              }
              frame "Value Change" {
                Property Node(instance in=s1) -> ("Headphones"=w22)
                Variant To Data(type=w22, variant=w8) -> (data=w23)
                Property Node(instance in=s1, "Headphones"=w23) -> (instance out=w11)
                case (w10) {
                  frame "UI" { }
                  frame Default {
                    call "Update UI.gvi"(ID=w4, Target=w9, Data=w23)
                  }
                }
              }
              frame "Increment" {
                Property Node(instance in=s1) -> ("Headphones"=w24)
                Variant To Data(type=w24, variant=w8) -> (data=w25)
                Add(w24, w25) -> w26
                Property Node(instance in=s1, "Headphones"=w26) -> (instance out=w11)
                case (w10) {
                  frame "UI" { }
                  frame Default {
                    call "Update UI.gvi"(ID=w4, Target=w9, Data=w26)
                  }
                }
              }
            }
          }
        }
        next s1 = w11
      }
      Property Node(instance in=s1) -> ("Channels"=w27)
      for {
        w28 = each element of w27
        call "Process Messages.gvi"(Channel in=w28) -> (Channel out=w30)
        append w30 to w29
      }
      Property Node(instance in=s1, "Channels"=w29) -> (instance out=w2)
      w1 = $"error in (no error)"
    }
    frame Error {
      w1 = $"error in (no error)"
      w2 = $"Mixer in"
    }
  }
  $"Mixer out" <- w2
  $"error out" <- w1
