vi "Update.gvi"   [LabVIEW Conversion 4.0.0]
inputs:
  "Mixer in": "Mixer.gtype", required
  "Audio Block 1": f64[][]
  "Audio Block 2": f64[][]
  "error in (no error)": error
outputs:
  "Mixer out": "Mixer.gtype"
  "Master Audio Block Out": f64[][]
  "Headphones Audio Block Out": f64[][]
  "error out": error
uses:
  MergedDependencies::Mixer.gtype::Process Messages.gvi
  MergedDependencies::Channel.gtype::Update.gvi
diagram:
  case ($"error in (no error)") {
    frame No Error {
      call "Process Messages.gvi"(Mixer in=$"Mixer in") -> (Mixer out=w5)
      Property Node(instance in=w5) -> ("Master"=w6, "Crossfader"=w7, "Channels"=w8, "Headphones"=w9)
      Array Index(array=w8) -> (out0[_]=w10, out1[_]=w11)
      call "Update.gvi"(Channel in=w10, Audio Block In=$"Audio Block 1") -> (Channel out=w12, Master Audio Block Out=w13, Headphones Audio Block Out=w14)
      # Need to have separate subVI instances on block diagram for each channel so internal channel filter state is maintained between calls.
      # Wire the error cluster across even in the "No Error"
      # case so that warnings get propagated.
      call "Update.gvi"(Channel in=w11, Audio Block In=$"Audio Block 2") -> (Channel out=w15, Master Audio Block Out=w16, Headphones Audio Block Out=w17)
      Is Greater Than 0(x=w7) -> w18
      Absolute Value(x=w7) -> w19
      Subtract(x=1, y=w19) -> w20
      case (w18) {
        frame False, Default {
          Multiply(w20, w16) -> w21
          w22 = w13
        }
        frame True {
          Multiply(w20, w13) -> w22
          w21 = w16
        }
      }
      Add(w22, w21) -> w23
      Multiply(w6, w23) -> w3
      Build Array(w12, w15) -> w24
      Property Node(instance in=w5, "Channels"=w24) -> (instance out=w2)
      Add(w14, w17) -> w25
      # The crossfader values expected are between -1 (left) and 1 (right), where 0 is center. Anything between -1 and 0 is full volume on channel 1 and a linear scale on channel 2. Anything between 0 and 1 is full volume on channel 2, and a linear scale on channel 1.
      Multiply(w25, w9) -> w4
      w1 = $"error in (no error)"
    }
    frame Error {
      w1 = $"error in (no error)"
      w2 = $"Mixer in"
      w3 = $"Audio Block 1"
      w4 = $"Audio Block 1"
    }
  }
  $"Mixer out" <- w2
  $"Master Audio Block Out" <- w3
  $"Headphones Audio Block Out" <- w4
  $"error out" <- w1
