vi "Create Message Queue.gvi"   [LabVIEW Conversion 4.0.0]
inputs:
  "Queue Name": string, required
  "Max Size (100)": i32 = 100
  "error in (no error)": error
outputs:
  "queue out": Queue<"Message Cluster.gtype">
  "error out": error
types:
  "Message Cluster.gtype" = cluster{"Event": string, "Source": string, "Target": string, "Data": variant}
diagram:
  # Create the named queue, then preallocate it with the maximum number of queue elements. This is more an RT trick, but should help reduce jitter.
  Obtain Queue(element data type="Message Cluster.gtype" {all zero or empty}, error in=$"error in (no error)", max queue size=$"Max Size (100)", name=$"Queue Name") -> (error out=w1, queue out=w2)
  s1 = w2  # shift register
  s2 = w1  # shift register
  for (N = $"Max Size (100)") {
    Lossy Enqueue Element(element="Message Cluster.gtype" {all zero or empty}, error in=s2, queue=s1) -> (error out=w3, queue out=w4)
    next s1 = w4
    next s2 = w3
  }
  Flush Queue(error in=s2, queue=s1) -> (error out=w5, queue out=w6)
  $"queue out" <- w6
  $"error out" <- w5
