vi "Parse Control Label.gvi"   [LabVIEW NXG 4.0.0]
inputs:
  "CtlRef": "Control reference", required
outputs:
  "Queue Name": string
  "Value Name": string
diagram:
  Property Node(instance in=$CtlRef) -> ("Label"=w1)
  Property Node(instance in=w1) -> ("Text"=w2)
  # Split Label on LAST period character.
  Match Regular Expression(inputString=w2, regExpression="(.*)\\.(.*)") -> (out0=w3, out1=w4)
  $"Queue Name" <- w3
  $"Value Name" <- w4
