vi "Send UI Value Change.gvi"   [LabVIEW Conversion 4.0.0]
# Convenience wrapper for sending value change events from the UI to the audio processing loop.
inputs:
  "CtlRef": "Control reference", required
  "Data": variant, required
types:
  "Message Cluster.gtype" = cluster{"Event": string, "Source": string, "Target": string, "Data": variant}
uses:
  Messaging::Parse Control Label.gvi
  Messaging::Send.gvi
diagram:
  call "Parse Control Label.gvi"(CtlRef=$CtlRef) -> (Queue Name=w1, Value Name=w2)
  Property Node(instance in="Message Cluster.gtype" {all zero or empty}, "Event"="Value Change", "Source"="UI", "Target"=w2, "Data"=$Data) -> (instance out=w3)
  call "Send.gvi"(Queue Name=w1, Message=w3)
