vi "Send.gvi"   [LabVIEW Conversion 4.0.0]
# Sends the Message to the queue specified by Queue Name. If the named queue does not exist, the message is not sent.
# If the named queue does exist, the queue reference is stored in this VI and reused.
inputs:
  "Queue Name": string, required
  "Message": "Message Cluster.gtype", required
  "error in (no error)": error
outputs:
  "error out": error
types:
  "Message Cluster.gtype" = cluster{"Event": string, "Source": string, "Target": string, "Data": variant}
diagram:
  # Variant feedback node stores all named queue refs which have been opened
  Feedback Node(initial value=variant(), input=w1) -> w2
  Get Variant Attribute(default value=Queue<"Message Cluster.gtype"> constant, error in=$"error in (no error)", name=$"Queue Name", variant=w2) -> (error out=w3, found?=w4, value=w5, variant out=w6)
  # #TODO
  # Reopen named queue ref if it goes bad?
  case (w4) {
    frame False, Default {
      Obtain Queue(create if not found=FALSE, element data type=$Message, error in=w3, name=$"Queue Name") -> (error out=w10, queue out=w7)
      Set Variant Attribute(error in=w10, name=$"Queue Name", value=w7, variant=w6) -> (error out=w9, variant out=w1)
      w8 = $Message
    }
    frame True {
      w7 = w5
      w8 = $Message
      w1 = w6
      w9 = w3
    }
  }
  Enqueue Element(element=w8, error in=w9, queue=w7, timeout in ms=0) -> (error out=w11)
  $"error out" <- w11
