vi "Update UI.gvi"   [LabVIEW Conversion 4.0.0]
# Simple wrapper for sending messages to the UI. If Message is not specified, the default message is a Value Change.
inputs:
  "ID": string, required
  "Target": string, required
  "Data": variant, required
  "error in (no error)": error
  "Message (Value Change)": string = "Value Change"
outputs:
  "error out": error
types:
  "Message Cluster.gtype" = cluster{"Event": string, "Source": string, "Target": string, "Data": variant}
uses:
  Messaging::Send.gvi
diagram:
  Format Into String(formatString="%s.%s", errIn=$"error in (no error)", $ID, $Target) -> (outString=w1, errOut=w2)
  Property Node(instance in="Message Cluster.gtype" {all zero or empty}, "Event"=$"Message (Value Change)", "Source"="Feedback", "Target"=w1, "Data"=$Data) -> (instance out=w3)
  call "Send.gvi"(Queue Name="UI", Message=w3, error in (no error)=w2) -> (error out=w4)
  $"error out" <- w4
