vi "Main.gvi"   [LabVIEW NXG 4.0.0]
types:
  "Sub Panels Cluster.gtype" = cluster{"DJ Interface": "SubPanel reference", "File Browser": "SubPanel reference", "Audio Config": "SubPanel reference"}
  "Audio Output Queue Type.gtype" = cluster{"Master": waveform<i16>[], "Headphones": waveform<i16>[]}
  "Keyboard Shortcut.gtype" = cluster{"Keystroke": string, "Message Queue": string, "Event": string, "Target": string, "Data": variant}
  "Message Cluster.gtype" = cluster{"Event": string, "Source": string, "Target": string, "Data": variant}
uses:
  User Interface::Insert Sub Panels.gvi
  Shared::Shortcuts.gvi
  User Interface::Parse Key Press.gvi
  Messaging::Send.gvi
  Audio Processing::Run.gvi
  Audio Output::Run (lvsound2).gvi
  NI::G Core::Error::Display Error.gvi
diagram:
  This VI Reference() -> (reference out=w1)
  Property Node(instance in=w1) -> ("Panel"=w2, instance out=w3)
  Property Node(instance in="Sub Panels Cluster.gtype" {all zero or empty}, "DJ Interface"=reference to "DJ Interface", "File Browser"=reference to "File Browser", "Audio Config"=reference to "Audio Config") -> (instance out=w4)
  Property Node(instance in=w2) -> ("Window"=w5)
  # Quick hack to center on a 1920x1080 screen
  Property Node(instance in=w5, "Position"=cluster{"Left": f32, "Top": f32} {"Left"=76, "Top"=56}) -> (error out=w6)
  w7 = bool FALSE  # Shutdown
  Create User Event[EventName=Shutdown](error in=w6, user event data type=w7) -> (error out=w8, user event out=w9)
  call "Insert Sub Panels.gvi"(Owning VI=w3, Sub Panels=w4, Shutdown Event=w9, error in (no error)=w8)
  # This is the main audio queue between the audio processing loop and audio output loop. It's a single element queue (SEQ) which contains the next block of audio data to be sent to both the master and headphone outputs. The block size is always Buffer Size (see global constant). Using a SEQ means the audio processing loop timing can be slaved to the audio output loop timing.
  # Initialise Zero Buffer. This is sent to the soundcard when a track isn't loaded, is paused, or the headphone cue is disabled.
  sequence {
    frame 0 {
      Tag Read(ref in="Globals::Constants.grsc::Channels") -> (Data=w10)
      Tag Read(ref in="Globals::Constants.grsc::Buffer Size") -> (Data=w11)
      Initialize Array(element=0, size=w10, size=w11) -> w12
      Tag Write(Data=w12, ref in="Globals::Constants.grsc::Zero Buffer")
    }
    frame 1 {
      Obtain Queue(element data type="Audio Output Queue Type.gtype" {all zero or empty}, max queue size=1, name="Audio") -> (queue out=w13)
    }
  }
  w14 = variant()  # Keyboard Shortcut Map
  call "Shortcuts.gvi"() -> (Keyboard Shortcuts=w15)
  # Dataflow DJ - A live DJ mixing application written entirely in LabVIEW.
  #     Copyright (C) 2019  Dataflow G
  #
  #     This program is free software: you can redistribute it and/or modify
  #     it under the terms of the GNU General Public License as published by
  #     the Free Software Foundation, either version 3 of the License, or
  #     (at your option) any later version.
  #
  #     This program is distributed in the hope that it will be useful,
  #     but WITHOUT ANY WARRANTY; without even the implied warranty of
  #     MERCHANTABILITY or FITNESS FOR A PARTICULAR PURPOSE.  See the
  #     GNU General Public License for more details.
  #
  #     You should have received a copy of the GNU General Public License
  #     along with this program.  If not, see <https://www.gnu.org/licenses/>.
  #
  # Contact:
  #     GitHub - https://github.com/dataflowg
  #     Twitter - @Dataflow_G
  s1 = w14  # shift register
  for {
    w16 = each element of w15
    Property Node(instance in=w16) -> ("Keystroke"=w17)
    Set Variant Attribute(name=w17, value=w16, variant=s1) -> (variant out=w18)
    next s1 = w18
  }
  while {
    event {
      on "Timeout" {
        w19 = default
        w20 = default
      }
      on "Panel" Key down? {
        Event Data() -> ("Virtual Key"=w21, "Scan Code"=w22, "Modifiers"=w23, "Platform Modifiers"=w24)
        call "Parse Key Press.gvi"(VKey=w21, ScanCode=w22, Mods=w23, PlatMods=w24) -> (Key Pressed=w25)
        Get Variant Attribute(default value="Keyboard Shortcut.gtype" {all zero or empty}, name=w25, variant=s1) -> (found?=w26, value=w27)
        case (w26) {
          frame False, Default { }
          frame True {
            Property Node(instance in=w27) -> ("Message Queue"=w28, "Event"=w29, "Target"=w30, "Data"=w31)
            Property Node(instance in="Message Cluster.gtype" {all zero or empty}, "Event"=w29, "Target"=w30, "Data"=w31, "Source"="Shortcut") -> (instance out=w32)
            call "Send.gvi"(Queue Name=w28, Message=w32)
          }
        }
        Event Filter("Discard?"=TRUE)
        w19 = default
        w20 = default
      }
      on "Window" Close? {
        # Only close the panel if running under the run-time engine.
        Event Filter("Discard?"=FALSE)
        Generate User Event(event data=TRUE, user event=w9) -> (error out=w33, user event out=w34)
        Destroy User Event(error in=w33, user event=w34) -> (error out=w20)
        w19 = TRUE
      }
    }
    stop if w19
  }
  Release Queue(error in=w20, force destroy=TRUE, queue=w13)
  call "Run.gvi"(Audio Output Queue=w13)
  call "Run (lvsound2).gvi"(Audio Output Queue=w13) -> (error out=w35)
  call "Display Error.gvi"(error in=w35)
