vi "Application Version.gvi"   [LabVIEW Conversion 4.0.0]
# Get the version information for the built application. Returns "Development" when running from LabVIEW.
outputs:
  "Application Version": string
uses:
  NI::G Core::File IO (General)::File Version Information.gvi
diagram:
  sequence {
    frame 0 {
      Property Node() -> ("App.Kind"=w3, error out=w4, instance out=w5)
      sequence (after w5) {
        frame 0 {
          Get Command Line Arguments(error in=w4) -> (appname=w6, error out=w7)
        }
      }
      w1 = w8
      w2 = w9
    }
  }
  # Return either the application version, "Development" if in the IDE, or "?.?.?.?" on error.
  case (w3) {
    frame Default {
      w10 = "Development"
    }
    frame "Run Time System" {
      Application Directory() -> (Application Directory Output 0=w11)  # Application Directory (Placeholder)
      Build Path(base path=w11, name or relative path=w1) -> (appended path=w12)
      case (w13) {
        frame No Error {
          Format Into String(formatString="v%s", w15) -> w10
          w14 = w15
        }
        frame Error {
          w14 = _
          w10 = "?.?.?.?"
        }
      }
      sequence {
        frame 0 {
          call "File Version Information.gvi"(executable or DLL=w12, error in=w17) -> (details=w18, file version=w19, error out=w13)
          w16 = w17
        }
      }
    }
  }
  $"Application Version" <- w10
