vi "Audio Config.gvi"   [LabVIEW NXG 4.0.0]
# Audio config sub panel. The audio output configuration is set here and updated in the Audio Output loop when Apply is clicked.
# Execution System: User Interface
inputs:
  "Shutdown Event": "event Shutdown", required
panel controls:
  "Master Output": u16 = 65535
  "Headphone Output": u16 = 65535
  "Apply": bool
types:
  "Audio Output Info.gtype" = cluster{"Enable": bool, "Output ID": i32}
  "Audio Output Config.gtype" = cluster{"Master": "Audio Output Info.gtype", "Headphones": "Audio Output Info.gtype"}
  "Message Cluster.gtype" = cluster{"Event": string, "Source": string, "Target": string, "Data": variant}
uses:
  Messaging::Send.gvi
diagram:
  for (N = 1) (iteration -> i1) {
    append "Audio Device" to w1
    append i1 to w2
  }
  for {
    w3 = each element of w1
    w4 = each element of w2
    w6 = cluster{"Device Name": string, "Element 2": i32} {all zero or empty}
    Property Node(instance in=w6, "Device Name"=w3, "Element 2"=w4) -> (instance out=w7)
    append w7 to w5
  }
  w8 = cluster{"Element 1": string, "Element 2": u16} {all zero or empty}
  Property Node(instance in=w8, "Element 1"="(Disabled)", "Element 2"=65535) -> (instance out=w9)
  Build Array(w9, w5) -> w10
  Coerce To Type(type=cluster{"Device Name": string, "Element 2": i32}[] [], x=w10) -> w11
  Array Size(array=w11) -> (size(s)=w12)
  Is Greater(x=w12, y=1) -> w13
  case (w13) {
    frame False, Default {
      w14 = 65535
    }
    frame True {
      Array Index(array=w11) -> (out0[1]=w15)
      Property Node(instance in=w15) -> ("Element 2"=w14)
    }
  }
  Property Node(instance in=reference to "Master Output", "ItemsAndValues"=w11, "Value"=w14) -> (error out=w16)  # Ring properties
  Build Array(1) -> w17
  Property Node(instance in=reference to "Headphone Output", "ItemsAndValues"=w11, "Value"=65535, "DisabledIndexes"=w17, error in=w16)  # Ring properties
  Is Not Equal(x=65535, y=w14) -> w18
  Property Node(instance in="Audio Output Config.gtype" {all zero or empty}, "Master:Enable"=w18, "Master:Output ID"=w14) -> (instance out=w19)
  Register For Events("Shutdown"=$"Shutdown Event") -> (event registration refnum out=w20)
  while (after w19) {
    event (dynamic events = w20) {
      on "Timeout" {
        w21 = default
      }
      on dynamic event 0 {
        w21 = TRUE
      }
      on "Master Output" Value changed {
        w22 = reference to "Headphone Output"  # Static Control Reference (Headphone Output)
        Property Node(instance in=w22) -> ("ItemsAndValues"=w23, instance out=w24)
        Event Data() -> ("New Value"=w25)
        for (iteration -> i2) {
          w26 = each element of w23
          Is Not Equal(x=65535, y=w25) -> w28
          Property Node(instance in=w26) -> ("Value"=w29)
          Is Equal(x=w25, y=w29) -> w30
          Logical And(w28, w30) -> w31
          append i2 to w27 if w31
        }
        Property Node(instance in=w24, "DisabledIndexes"=w27)
        w21 = default
      }
      on "Headphone Output" Value changed {
        w32 = reference to "Master Output"  # Static Control Reference (Master Output)
        Property Node(instance in=w32) -> ("ItemsAndValues"=w33, instance out=w34)
        Event Data() -> ("New Value"=w35)
        for (iteration -> i3) {
          w36 = each element of w33
          Is Not Equal(x=65535, y=w35) -> w38
          Property Node(instance in=w36) -> ("Value"=w39)
          Is Equal(x=w35, y=w39) -> w40
          Logical And(w38, w40) -> w41
          append i3 to w37 if w41
        }
        Property Node(instance in=w34, "DisabledIndexes"=w37)
        w21 = default
      }
      on "Apply" Value changed {
        Is Not Equal(x=65535, y=$"Master Output") -> w42
        Is Not Equal(x=65535, y=$"Headphone Output") -> w43
        Property Node(instance in="Audio Output Config.gtype" {all zero or empty}, "Master:Enable"=w42, "Master:Output ID"=$"Master Output", "Headphones:Enable"=w43, "Headphones:Output ID"=$"Headphone Output") -> (instance out=w44)
        Property Node(instance in="Message Cluster.gtype" {all zero or empty}, "Event"="Configure", "Data"=w44) -> (instance out=w45)
        call "Send.gvi"(Queue Name="AudioOutput", Message=w45)
        w21 = default
      }
    }
    stop if w21
  }
  Unregister For Events(event registration refnum=w20)
