vi "Calculate Jogwheel Delta.gvi"   [LabVIEW Conversion 4.0.0]
# Calculate the delta value from two jogwheel values. Delta value will be shortest distance between old and new values, including sign (clockwise is positive, anti-clockwise is negative).
inputs:
  "Old Value": i32, required
  "New Value": i32, required
outputs:
  "Delta Value": i32
diagram:
  # The jog wheel value range is 0 - 79380, and then wraps back to zero. The jog wheel value maps directly to a sample, which equates to a 33 1/3 RPM platter @44100Hz sample rate.
  Subtract(x=$"New Value", y=$"Old Value") -> w1
  Add(w1, 39690) -> w2
  Quotient And Remainder(x=w2, y=79380) -> (x-y*floor(x/y)=w3)
  Subtract(x=w3, y=39690) -> w4
  $"Delta Value" <- w4
