vi "Calculate Jogwheel Value.gvi"   [LabVIEW Conversion 4.0.0]
# Calculate the jogwheel value and label value based on the current playback position.
inputs:
  "Playback Position": i32, required
outputs:
  "Jogwheel Position": i32
  "Jogwheel Label Image": i32
diagram:
  # The jog wheel value range is 0 - 79380, and then wraps back to zero. The jog wheel value maps directly to a sample, which equates to a 33 1/3 RPM platter @44100Hz sample rate.
  Quotient And Remainder(x=$"Playback Position", y=79380) -> (x-y*floor(x/y)=w1)
  $"Jogwheel Position" <- w1
  # This particular image repeats every 90 degrees, so only need 15 images (60 images / 360 / 90)
  # Hence the mod by 15.
  # Deck label contains images rotated by 6 degrees each
  # 360 / 6 = 60 images
  # 79380 / 60 = 1323 samples / image
  Divide(x=$"Playback Position", y=1323) -> w2
  To Signed 32 Bit Integer(number=w2) -> w3
  Quotient And Remainder(x=w3, y=15) -> (x-y*floor(x/y)=w4)
  $"Jogwheel Label Image" <- w4
