vi "DJ Interface - Original.gvi"   [LabVIEW Conversion 4.0.0]
# Main control interface to Dataflow DJ. Also handles all keyboard shortcuts.
# Execution System: User Interface
inputs:
  "Shutdown Event": "event Shutdown", required
  "Owning VI": VIRefnum, required
panel controls:
  "Deck1.PlaybackPosition": "Slide.PlaybackPosition.gtype"
  "Mixer.Channel1.Gain": f64 = 1
  "Mixer.Channel1.EQLowKill": "LED.Red.16px.gtype"
  "Mixer.Channel1.EQHigh": f64 = 1
  "Mixer.Channel1.EQMid": f64 = 1
  "Mixer.Channel1.EQLow": f64 = 1
  "Mixer.Channel1.EQMidKill": "LED.Red.16px.gtype"
  "Mixer.Channel1.EQHighKill": "LED.Red.16px.gtype"
  "Mixer.Channel1.Level": "Slide.Vert.gtype" = 1
  "Mixer.Crossfader": "Slide.Horiz.gtype"
  "Mixer.Channel2.Gain": f64 = 1
  "Mixer.Channel2.EQLowKill": "LED.Red.16px.gtype"
  "Mixer.Channel2.EQHigh": f64 = 1
  "Mixer.Channel2.EQMid": f64 = 1
  "Mixer.Channel2.EQLow": f64 = 1
  "Mixer.Channel2.EQMidKill": "LED.Red.16px.gtype"
  "Mixer.Channel2.EQHighKill": "LED.Red.16px.gtype"
  "Mixer.Channel2.Level": "Slide.Vert.gtype" = 1
  "Deck2.Jogwheel": "Knob.276px_Hole.gtype"
  "Deck2.Pitch": "Slide.Vert.gtype"
  "Mixer.Channel1.Effect1.Value2": f64
  "Mixer.Channel1.Effect1.Value1": f64
  "Deck1.Jogwheel": "Knob.276px_Hole.gtype"
  "Mixer.Master": f64 = 1
  "Deck1.Play": "Button.Large.gtype"
  "Mixer.Channel1.Effect1.Enable": "LED.Red.16px.gtype"
  "Mixer.Channel1.Effect2.Value2": i32 = 16
  "Mixer.Channel1.Effect2.Value1": i32 = 1
  "Mixer.Channel1.Effect2.Enable": "LED.Red.16px.gtype"
  "Mixer.Channel1.Effect3.Value1": f64
  "Mixer.Channel1.Effect3.Enable": "LED.Red.16px.gtype"
  "Mixer.Channel1.Effect3.Value2": f64
  "Mixer.Channel2.Effect1.Value2": f64
  "Mixer.Channel2.Effect1.Value1": f64
  "Mixer.Channel2.Effect1.Enable": "LED.Red.16px.gtype"
  "Mixer.Channel2.Effect2.Value2": i32 = 16
  "Mixer.Channel2.Effect2.Value1": i32 = 1
  "Mixer.Channel2.Effect2.Enable": "LED.Red.16px.gtype"
  "Mixer.Channel2.Effect3.Value1": f64
  "Mixer.Channel2.Effect3.Enable": "LED.Red.16px.gtype"
  "Mixer.Channel2.Effect3.Value2": f64
  "Deck1.Brake": "Button.Large.gtype"
  "Mixer.Headphones": f64 = 1
  "Deck2.PlaybackPosition": "Slide.PlaybackPosition.gtype"
  "Deck1.Cue1": "Button.Large.gtype"
  "Deck1.Backspin": "Button.Large.gtype"
  "Deck1.Reverse": "Button.Large.gtype"
  "Deck1.Cue2": "Button.Large.gtype"
  "Deck1.Cue3": "Button.Large.gtype"
  "Deck2.Play": "Button.Large.gtype"
  "Deck2.Cue1": "Button.Large.gtype"
  "Deck2.Cue2": "Button.Large.gtype"
  "Deck2.Cue3": "Button.Large.gtype"
  "Deck2.Brake": "Button.Large.gtype"
  "Deck2.Backspin": "Button.Large.gtype"
  "Deck2.Reverse": "Button.Large.gtype"
  "Deck1.PitchBendDown": "Button.Small.gtype"
  "Deck1.PitchBendUp": "Button.Small.gtype"
  "Mixer.Channel1.HeadphoneOutput": "Button.Small.gtype"
  "Mixer.Channel2.HeadphoneOutput": "Button.Small.gtype"
  "Deck2.PitchBendDown": "Button.Small.gtype"
  "Deck2.PitchBendUp": "Button.Small.gtype"
  "Deck1.Pitch": "Slide.Vert.gtype"
panel indicators:
  "Deck2.JogwheelLabel": "PictRing.DeckLabel.gtype"
  "Deck1.JogwheelLabel": "PictRing.DeckLabel.gtype"
  "Deck1.Waveform": "WaveformGraph.WaveformDisplay.gtype"
  "Deck1.Title": string
  "Deck1.Time": string
  "Deck2.Title": string
  "Mixer.Channel1.LevelIndicator": u8
  "Mixer.Channel2.LevelIndicator": u8
  "Deck1.BPM": string
  "Deck2.BPM": string
  "Deck2.Waveform": "WaveformGraph.WaveformDisplay.gtype"
  "Deck2.Time": string
types:
  "PictRing.DeckLabel.gtype" = u16
  "WaveformGraph.WaveformDisplay.gtype" = f64[]
  "Slide.PlaybackPosition.gtype" = i32
  "LED.Red.16px.gtype" = bool
  "Slide.Vert.gtype" = f64
  "Slide.Horiz.gtype" = f64
  "Knob.276px_Hole.gtype" = i32
  "Button.Large.gtype" = bool
  "Button.Small.gtype" = bool
  "Message Cluster.gtype" = cluster{"Event": string, "Source": string, "Target": string, "Data": variant}
  "Keyboard Shortcut.gtype" = cluster{"Keystroke": string, "Message Queue": string, "Event": string, "Target": string, "Data": variant}
uses:
  User Interface::Find Control Refs.gvi
  Messaging::Send UI Value Change.gvi
  Shared::Shortcuts.gvi
  Messaging::Parse Control Label.gvi
  Messaging::Send.gvi
  User Interface::Calculate Jogwheel Delta.gvi
  User Interface::Calculate Jogwheel Value.gvi
  User Interface::Parse Key Press.gvi
  Messaging::Create Message Queue.gvi
diagram:
  Control Reference Constant() -> (Pane Output 0=w1)  # Control Reference Constant (Placeholder)
  call "Find Control Refs.gvi"(Pane Reference In=w1, Control Types=["Knob", "Slide"], Label.Text Filter=["Jogwheel"]) -> (Control Refs=w2)
  # #TODO
  # Make sure this runs after all message queues in the Audio Processing loop have been setup.
  # These type casts do nothing. What's important is the label is being applied to the Event Registration, so the events have a sensible name in the event structure.
  for {
    w3 = each element of w2
    # Init all of the values in the decks, mixer, etc with the default from the controls.
    Property Node(instance in=w3) -> ("Value"=w4, instance out=w5)
    call "Send UI Value Change.gvi"(CtlRef=w5, Data=w4)
  }
  w6 = variant()  # Keyboard Shortcut Map
  call "Shortcuts.gvi"() -> (Keyboard Shortcuts=w7)
  s1 = w6  # shift register
  for {
    w8 = each element of w7
    Property Node(instance in=w8) -> ("Keystroke"=w9)
    Set Variant Attribute(name=w9, value=w8, variant=s1) -> (variant out=w10)
    next s1 = w10
  }
  w11 = "Control reference"[] []  # Numeric Controls
  Type Cast(type=w11, x=w2) -> w12
  call "Find Control Refs.gvi"(Pane Reference In=w1, Control Types=["Boolean"]) -> (Control Refs=w13)
  w14 = "Control reference"[] []  # Boolean Controls
  Type Cast(type=w14, x=w13) -> w15
  Register For Events("Numeric Controls"=w12, "Numeric Controls"=w12, "Boolean Controls"=w15, "Shutdown Event"=$"Shutdown Event", "Owning VI"=$"Owning VI", "Owning VI"=$"Owning VI") -> (event registration refnum out=w16)
  # This loop polls the UI message queue, and updates and controls and indicators with the specified value. All control references are stored as named attributes in a variant.
  while {
    event (dynamic events = w16) {
      on "Timeout" {
        w17 = default
      }
      on "Dynamic" GenericRefnum {
        w17 = TRUE
      }
      frame  {
        Event Data() -> ("Available Data Names"=w18)
        Search 1D Array(1D array=w18, element="path") -> (index of element=w19)
        Is Greater Or Equal To 0(x=w19) -> w20
        Event Filter Node(Accepted? Input 0=w20)  # Event Filter Node (Placeholder)
        w17 = default
      }
      frame  {
        Event Data() -> ("Control Reference"=w21)
        call "Parse Control Label.gvi"(CtlRef=w21) -> (Queue Name=w22)
        GetDragDropData( Input 1=path "", data name Input 2="path") -> ( Output 1=w23)  # GetDragDropData (Placeholder)
        Property Node(instance in="Message Cluster.gtype" {all zero or empty}, "Event"="Load Track", "Data"=w23) -> (instance out=w24)
        call "Send.gvi"(Queue Name=w22, Message=w24)
        Event Filter Node(Accepted? Input 0=TRUE)  # Event Filter Node (Placeholder)
        w17 = default
      }
      frame  {
        Event Data() -> ("Control Reference"=w25, "NewVal"=w26)
        call "Send UI Value Change.gvi"(CtlRef=w25, Data=w26)
        w17 = default
      }
      frame  {
        Event Data() -> ("Control Reference"=w27, "Button"=w28, "Mods"=w29)
        # A double-click on a numeric control (knob/slide) will reset it to its default value (usually 0 or 1). Handy for EQs!
        case (w28) {
          frame Default {
            w30 = FALSE
          }
          frame 1 {
            Property Node(instance in=w29) -> ("Double Click"=w31)
            case (w31) {
              frame False, Default {
                w30 = FALSE
              }
              frame True {
                Property Node(instance in=w27) -> ("DefVal"=w32, instance out=w33)
                Property Node(instance in=w33, "Val(Sgnl)"=w32)
                w30 = TRUE
              }
            }
          }
        }
        Event Filter Node(Discard? Input 0=w30)  # Event Filter Node (Placeholder)
        w17 = default
      }
      on "Deck1.Jogwheel" Mouse down; "Deck2.Jogwheel" Mouse down {
        Event Data() -> ("Time"=w34, "Control Reference"=w35, "Position"=w36, "Button"=w37)
        w38 = cluster{"Horizontal": i32, "Vertical": i32} {all zero or empty}
        Coerce To Type(type=w38, x=w34)
        w39 = cluster{"Horizontal": i32, "Vertical": i32} {all zero or empty}
        Coerce To Type(type=w39, x=w36)
        case (w37) {
          frame Default { }
          frame 1 {
            To Variant(anything=0) -> w40
            # When the jogwheel is clicked, send a zero move to begin scratching on a deck.
            call "Send UI Value Change.gvi"(CtlRef=w35, Data=w40)
          }
        }
        w17 = default
      }
      on "Deck1.Jogwheel" Value changed; "Deck2.Jogwheel" Value changed {
        Event Data() -> ("Control Reference"=w41, "Old Value"=w42, "New Value"=w43)
        call "Calculate Jogwheel Delta.gvi"(Old Value=w42, New Value=w43) -> (Delta Value=w44)
        To Variant(anything=w44) -> w45
        call "Send UI Value Change.gvi"(CtlRef=w41, Data=w45)
        call "Calculate Jogwheel Value.gvi"(Playback Position=w43) -> (Jogwheel Label Image=w46)
        call "Parse Control Label.gvi"(CtlRef=w41) -> (Queue Name=w47)
        case (w47) {
          frame Default { }
          frame "Deck1" {
            $"Deck1.JogwheelLabel" <- w46
          }
          frame "Deck2" {
            $"Deck2.JogwheelLabel" <- w46
          }
        }
        w17 = default
      }
      on "Panel" Key down?; "Panel" Key down? {
        Event Filter("Discard?"=TRUE)
        # #BUG
        # While holding the mouse button down on a control (moving a slider for example), F10 will not register as a key press. All other function keys seem to work.
        #
        # WTF.
        #
        # Help mentions F3 being an issue, but that's always worked. F1 will trigger the LabVIEW help if the key press isn't discarded.
        Event Data() -> ("Virtual Key"=w48, "Scan Code"=w49, "Modifiers"=w50, "Platform Modifiers"=w51)
        call "Parse Key Press.gvi"(VKey=w48, ScanCode=w49, Mods=w50, PlatMods=w51) -> (Key Pressed=w52)
        # Keyboard shortcuts can be setup directly on a control, but LabVIEW only supports function keys and other non-ASCII inputs. In this case we want any key to be a possible shortcut, so all key presses are captured here.
        Get Variant Attribute(default value="Keyboard Shortcut.gtype" {all zero or empty}, name=w52, variant=s1) -> (found?=w53, value=w54)
        # Register Key Down events on both THIS VI (running in a sub panel), and the owning VI. Why both? Why not just the owning VI?
        #
        # Using just the Key Down event from the owning VI works, EXCEPT for when the mouse is being held down at the same time. LabVIEW seems to redirect all input focus to the sub panel VI (this VI) while the mouse button is being held. As such the owning VI can no longer generate Key Down events.
        # Always discard the key press, and don't pass them on to controls or LabVIEW itself.
        # #TODO
        # If file browser controls are in focus, don't execute shortcuts? Or at least allow certain key presses (arrow keys, pgup, pgdwn, home, end, etc)
        case (w53) {
          frame False, Default { }
          frame True {
            Property Node(instance in=w54) -> ("Message Queue"=w55, "Event"=w56, "Target"=w57, "Data"=w58)
            Property Node(instance in="Message Cluster.gtype" {all zero or empty}, "Event"=w56, "Target"=w57, "Data"=w58, "Source"="Shortcut") -> (instance out=w59)
            call "Send.gvi"(Queue Name=w55, Message=w59)
          }
        }
        w17 = default
      }
      on "Panel" Mouse up {
        Event Data() -> ("Position"=w60)
        w61 = cluster{"Horizontal": i32, "Vertical": i32} {all zero or empty}
        Coerce To Type(type=w61, x=w60)
        # #TODO
        # Poll mouse buttons using Input Device Control for mouse up instead?
        Property Node(instance in="Message Cluster.gtype" {all zero or empty}, "Event"="Mouse Up") -> (instance out=w62)
        # The Mouse Up event is sent to each deck to cancel a scratch.
        #
        # Note that the Mouse Up is for the entire pane (not just a jogwheel) as the mouse will more than likely NOT be over the jogwheel. This doesn't help the case where the mouse is released outside the window entirely.
        call "Send.gvi"(Queue Name="Deck1", Message=w62)
        call "Send.gvi"(Queue Name="Deck2", Message=w62)
        w17 = default
      }
    }
    stop if w17
  }
  Unregister For Events(event registration refnum=w16)
  call "Create Message Queue.gvi"(Queue Name="UI") -> (queue out=w63)
  Release Queue(error in=no error, force destroy=TRUE, queue=w63)
  call "Find Control Refs.gvi"(Pane Reference In=w1) -> (Control Refs=w64)
  w65 = variant()  # Control Ref Map
  # What if two controls have same name? Should store them both?
  s2 = w65  # shift register
  for {
    w66 = each element of w64
    Property Node(instance in=w66) -> ("Label.Text"=w67, instance out=w68)
    Set Variant Attribute(name=w67, value=w68, variant=s2) -> (variant out=w69)
    next s2 = w69
  }
  s3 = s2  # shift register
  while {
    Wait Until Next Multiple(multiple to wait=10)
    Flush Queue(queue=w63) -> (error out=w70, remaining elements=w71)
    s4 = s3  # shift register
    for {
      w72 = each element of w71
      Property Node(instance in=w72) -> ("Event"=w73, "Target"=w74, "Data"=w75)
      case (w73) {
        frame Default {
          w76 = s4
        }
        frame "Value Change" {
          case (w74) {
            frame Default {
              Get Variant Attribute(default value="Control reference" constant, name=w74, variant=s4) -> (value=w77, variant out=w76)
              Property Node(instance in=w77, "Value"=w75)
            }
            frame "Deck1.Jogwheel" {
              Variant To Data(type=i32 0, variant=w75) -> (data=w78)
              call "Calculate Jogwheel Value.gvi"(Playback Position=w78) -> (Jogwheel Position=w79, Jogwheel Label Image=w80)
              Get Variant Attribute(default value="Control reference" constant, name=w74, variant=s4) -> (value=w81, variant out=w76)
              Property Node(instance in=w81, "Value"=w79)
              $"Deck1.JogwheelLabel" <- w80
            }
            frame "Deck2.Jogwheel" {
              Variant To Data(type=i32 0, variant=w75) -> (data=w82)
              call "Calculate Jogwheel Value.gvi"(Playback Position=w82) -> (Jogwheel Position=w83, Jogwheel Label Image=w84)
              Get Variant Attribute(default value="Control reference" constant, name=w74, variant=s4) -> (value=w85, variant out=w76)
              Property Node(instance in=w85, "Value"=w83)
              $"Deck2.JogwheelLabel" <- w84
            }
          }
        }
        frame "Slide.Scale.Maximum" {
          Variant To Data(type=f64 0, variant=w75) -> (data=w86)
          Get Variant Attribute(default value="Control reference" constant, name=w74, variant=s4) -> (value=w87, variant out=w76)
          To More Specific Class(reference=w87, target class="SliderControl reference" constant) -> w88
          Property Node(instance in=w88, "Scale.Maximum"=w86)
        }
      }
      next s4 = w76
    }
    next s3 = s4
    stop if w70
  }
  # All of the controls, laid out in roughly their placement on the front panel.
  # Tried using DeferPanelUpdates here, so the UI isn't getting spammed, but it is very jerky, even at 100Hz. Maybe needs to be even multiple of screen refresh? Or is it simply inefficient to disable and enable every 10ms?
