vi "DJ Interface - Working.gvi"   [LabVIEW Conversion 4.0.0]
# Main control interface to Dataflow DJ. Also handles all keyboard shortcuts.
# Execution System: User Interface
inputs:
  "Shutdown Event": "event Shutdown", required
  "Owning VI": VIRefnum, required
panel controls:
  "Deck1.PlaybackPosition": "Slide.PlaybackPosition.gtype"
  "Mixer.Channel1.Gain": f64 = 1
  "Mixer.Channel1.EQLowKill": "LED.Red.16px.gtype"
  "Mixer.Channel1.EQHigh": f64 = 1
  "Mixer.Channel1.EQMid": f64 = 1
  "Mixer.Channel1.EQLow": f64 = 1
  "Mixer.Channel1.EQMidKill": "LED.Red.16px.gtype"
  "Mixer.Channel1.EQHighKill": "LED.Red.16px.gtype"
  "Mixer.Channel1.Level": "Slide.Vert.gtype" = 1
  "Mixer.Crossfader": "Slide.Horiz.gtype"
  "Mixer.Channel2.Gain": f64 = 1
  "Mixer.Channel2.EQLowKill": "LED.Red.16px.gtype"
  "Mixer.Channel2.EQHigh": f64 = 1
  "Mixer.Channel2.EQMid": f64 = 1
  "Mixer.Channel2.EQLow": f64 = 1
  "Mixer.Channel2.EQMidKill": "LED.Red.16px.gtype"
  "Mixer.Channel2.EQHighKill": "LED.Red.16px.gtype"
  "Mixer.Channel2.Level": "Slide.Vert.gtype" = 1
  "Deck2.Jogwheel": "Knob.276px_Hole.gtype"
  "Deck2.Pitch": "Slide.Vert.gtype"
  "Mixer.Channel1.Effect1.Value2": f64
  "Mixer.Channel1.Effect1.Value1": f64
  "Deck1.Jogwheel": "Knob.276px_Hole.gtype"
  "Mixer.Master": f64 = 1
  "Deck1.Play": "Button.Large.gtype"
  "Mixer.Channel1.Effect1.Enable": "LED.Red.16px.gtype"
  "Mixer.Channel1.Effect2.Value2": i32 = 16
  "Mixer.Channel1.Effect2.Value1": i32 = 1
  "Mixer.Channel1.Effect2.Enable": "LED.Red.16px.gtype"
  "Mixer.Channel1.Effect3.Value1": f64
  "Mixer.Channel1.Effect3.Enable": "LED.Red.16px.gtype"
  "Mixer.Channel1.Effect3.Value2": f64
  "Mixer.Channel2.Effect1.Value2": f64
  "Mixer.Channel2.Effect1.Value1": f64
  "Mixer.Channel2.Effect1.Enable": "LED.Red.16px.gtype"
  "Mixer.Channel2.Effect2.Value2": i32 = 16
  "Mixer.Channel2.Effect2.Value1": i32 = 1
  "Mixer.Channel2.Effect2.Enable": "LED.Red.16px.gtype"
  "Mixer.Channel2.Effect3.Value1": f64
  "Mixer.Channel2.Effect3.Enable": "LED.Red.16px.gtype"
  "Mixer.Channel2.Effect3.Value2": f64
  "Deck1.Brake": "Button.Large.gtype"
  "Mixer.Headphones": f64 = 1
  "Deck2.PlaybackPosition": "Slide.PlaybackPosition.gtype"
  "Deck1.Cue1": "Button.Large.gtype"
  "Deck1.Backspin": "Button.Large.gtype"
  "Deck1.Reverse": "Button.Large.gtype"
  "Deck1.Cue2": "Button.Large.gtype"
  "Deck1.Cue3": "Button.Large.gtype"
  "Deck2.Play": "Button.Large.gtype"
  "Deck2.Cue1": "Button.Large.gtype"
  "Deck2.Cue2": "Button.Large.gtype"
  "Deck2.Cue3": "Button.Large.gtype"
  "Deck2.Brake": "Button.Large.gtype"
  "Deck2.Backspin": "Button.Large.gtype"
  "Deck2.Reverse": "Button.Large.gtype"
  "Deck1.PitchBendDown": "Button.Small.gtype"
  "Deck1.PitchBendUp": "Button.Small.gtype"
  "Mixer.Channel1.HeadphoneOutput": "Button.Small.gtype"
  "Mixer.Channel2.HeadphoneOutput": "Button.Small.gtype"
  "Deck2.PitchBendDown": "Button.Small.gtype"
  "Deck2.PitchBendUp": "Button.Small.gtype"
  "Deck1.Pitch": "Slide.Vert.gtype"
panel indicators:
  "Deck2.JogwheelLabel": "PictRing.DeckLabel.gtype"
  "Deck1.JogwheelLabel": "PictRing.DeckLabel.gtype"
  "Deck1.Waveform": "WaveformGraph.WaveformDisplay.gtype"
  "Deck1.Title": string
  "Deck1.Time": string
  "Deck2.Title": string
  "Mixer.Channel1.LevelIndicator": u8
  "Mixer.Channel2.LevelIndicator": u8
  "Deck1.BPM": string
  "Deck2.BPM": string
  "Deck2.Waveform": "WaveformGraph.WaveformDisplay.gtype"
  "Deck2.Time": string
types:
  "PictRing.DeckLabel.gtype" = u16
  "WaveformGraph.WaveformDisplay.gtype" = f64[]
  "Slide.PlaybackPosition.gtype" = i32
  "LED.Red.16px.gtype" = bool
  "Slide.Vert.gtype" = f64
  "Slide.Horiz.gtype" = f64
  "Knob.276px_Hole.gtype" = i32
  "Button.Large.gtype" = bool
  "Button.Small.gtype" = bool
  "Message Cluster.gtype" = cluster{"Event": string, "Source": string, "Target": string, "Data": variant}
  "Keyboard Shortcut.gtype" = cluster{"Keystroke": string, "Message Queue": string, "Event": string, "Target": string, "Data": variant}
uses:
  User Interface::Find Control Refs.gvi
  Messaging::Send UI Value Change.gvi
  Shared::Shortcuts.gvi
  Messaging::Parse Control Label.gvi
  Messaging::Send.gvi
  User Interface::Calculate Jogwheel Delta.gvi
  User Interface::Calculate Jogwheel Value.gvi
  User Interface::Parse Key Press.gvi
  Messaging::Create Message Queue.gvi
diagram:
  Control Reference Constant() -> (Pane Output 0=w1)  # Control Reference Constant (Placeholder)
  call "Find Control Refs.gvi"(Pane Reference In=w1, Control Types=["Knob", "Slide"], Label.Text Filter=["Jogwheel"]) -> (Control Refs=w2)
  # #TODO
  # Make sure this runs after all message queues in the Audio Processing loop have been setup.
  # These type casts do nothing. What's important is the label is being applied to the Event Registration, so the events have a sensible name in the event structure.
  for {
    w3 = each element of w2
    # Init all of the values in the decks, mixer, etc with the default from the controls.
    Property Node(instance in=w3) -> ("Value"=w4, instance out=w5)
    call "Send UI Value Change.gvi"(CtlRef=w5, Data=w4)
  }
  w6 = variant()  # Keyboard Shortcut Map
  call "Shortcuts.gvi"() -> (Keyboard Shortcuts=w7)
  s1 = w6  # shift register
  for {
    w8 = each element of w7
    Property Node(instance in=w8) -> ("Keystroke"=w9)
    Set Variant Attribute(name=w9, value=w8, variant=s1) -> (variant out=w10)
    next s1 = w10
  }
  w11 = "Control reference"[] []  # Numeric Controls
  Type Cast(type=w11, x=w2) -> w12
  call "Find Control Refs.gvi"(Pane Reference In=w1, Control Types=["Boolean"]) -> (Control Refs=w13)
  w14 = "Control reference"[] []  # Boolean Controls
  Type Cast(type=w14, x=w13) -> w15
  Register For Events("Numeric Controls"=w12, "Numeric Controls"=w12, "Boolean Controls"=w15, "Shutdown Event"=$"Shutdown Event", "Owning VI"=$"Owning VI", "Owning VI"=$"Owning VI") -> (event registration refnum out=w16)
  # This loop polls the UI message queue, and updates and controls and indicators with the specified value. All control references are stored as named attributes in a variant.
  while (after w16) {
    event {
      on "Timeout" {
        w18 = default
      }
      frame  {
        w18 = TRUE
      }
      frame  {
        Event Data() -> ("Available Data Names"=w19)
        Search 1D Array(1D array=w19, element="path") -> (index of element=w20)
        Is Greater Or Equal To 0(x=w20) -> w21
        Event Filter Node(Accepted? Input 0=w21)  # Event Filter Node (Placeholder)
        w18 = default
      }
      frame  {
        Event Data() -> ("Control Reference"=w22)
        call "Parse Control Label.gvi"(CtlRef=w22) -> (Queue Name=w23)
        GetDragDropData( Input 1=path "", data name Input 2="path") -> ( Output 1=w24)  # GetDragDropData (Placeholder)
        Property Node(instance in="Message Cluster.gtype" {all zero or empty}, "Event"="Load Track", "Data"=w24) -> (instance out=w25)
        call "Send.gvi"(Queue Name=w23, Message=w25)
        Event Filter Node(Accepted? Input 0=TRUE)  # Event Filter Node (Placeholder)
        w18 = default
      }
      frame  {
        Event Data() -> ("Control Reference"=w26, "NewVal"=w27)
        call "Send UI Value Change.gvi"(CtlRef=w26, Data=w27)
        w18 = default
      }
      frame  {
        Event Data() -> ("Control Reference"=w28, "Button"=w29, "Mods"=w30)
        # A double-click on a numeric control (knob/slide) will reset it to its default value (usually 0 or 1). Handy for EQs!
        case (w29) {
          frame Default {
            w31 = FALSE
          }
          frame 1 {
            Property Node(instance in=w30) -> ("Double Click"=w32)
            case (w32) {
              frame False, Default {
                w31 = FALSE
              }
              frame True {
                Property Node(instance in=w28) -> ("DefVal"=w33, instance out=w34)
                Property Node(instance in=w34, "Val(Sgnl)"=w33)
                w31 = TRUE
              }
            }
          }
        }
        Event Filter Node(Discard? Input 0=w31)  # Event Filter Node (Placeholder)
        w18 = default
      }
      on "Deck1.Jogwheel" Mouse down; "Deck2.Jogwheel" Mouse down {
        Event Data() -> ("Time"=w35, "Control Reference"=w36, "Position"=w37, "Button"=w38)
        w39 = cluster{"Horizontal": i32, "Vertical": i32} {all zero or empty}
        Coerce To Type(type=w39, x=w35)
        w40 = cluster{"Horizontal": i32, "Vertical": i32} {all zero or empty}
        Coerce To Type(type=w40, x=w37)
        case (w38) {
          frame Default { }
          frame 1 {
            To Variant(anything=0) -> w41
            # When the jogwheel is clicked, send a zero move to begin scratching on a deck.
            call "Send UI Value Change.gvi"(CtlRef=w36, Data=w41)
          }
        }
        w18 = default
      }
      on "Deck1.Jogwheel" Value changed; "Deck2.Jogwheel" Value changed {
        Event Data() -> ("Control Reference"=w42, "Old Value"=w43, "New Value"=w44)
        call "Calculate Jogwheel Delta.gvi"(Old Value=w43, New Value=w44) -> (Delta Value=w45)
        To Variant(anything=w45) -> w46
        call "Send UI Value Change.gvi"(CtlRef=w42, Data=w46)
        call "Calculate Jogwheel Value.gvi"(Playback Position=w44) -> (Jogwheel Label Image=w47)
        call "Parse Control Label.gvi"(CtlRef=w42) -> (Queue Name=w48)
        case (w48) {
          frame Default { }
          frame "Deck1" {
            $"Deck1.JogwheelLabel" <- w47
          }
          frame "Deck2" {
            $"Deck2.JogwheelLabel" <- w47
          }
        }
        w18 = default
      }
      on "Panel" Key down?; "Panel" Key down? {
        Event Filter("Discard?"=TRUE)
        # #BUG
        # While holding the mouse button down on a control (moving a slider for example), F10 will not register as a key press. All other function keys seem to work.
        #
        # WTF.
        #
        # Help mentions F3 being an issue, but that's always worked. F1 will trigger the LabVIEW help if the key press isn't discarded.
        Event Data() -> ("Virtual Key"=w49, "Scan Code"=w50, "Modifiers"=w51, "Platform Modifiers"=w52)
        call "Parse Key Press.gvi"(VKey=w49, ScanCode=w50, Mods=w51, PlatMods=w52) -> (Key Pressed=w53)
        # Keyboard shortcuts can be setup directly on a control, but LabVIEW only supports function keys and other non-ASCII inputs. In this case we want any key to be a possible shortcut, so all key presses are captured here.
        Get Variant Attribute(default value="Keyboard Shortcut.gtype" {all zero or empty}, name=w53, variant=s1) -> (found?=w54, value=w55)
        # Register Key Down events on both THIS VI (running in a sub panel), and the owning VI. Why both? Why not just the owning VI?
        #
        # Using just the Key Down event from the owning VI works, EXCEPT for when the mouse is being held down at the same time. LabVIEW seems to redirect all input focus to the sub panel VI (this VI) while the mouse button is being held. As such the owning VI can no longer generate Key Down events.
        # Always discard the key press, and don't pass them on to controls or LabVIEW itself.
        # #TODO
        # If file browser controls are in focus, don't execute shortcuts? Or at least allow certain key presses (arrow keys, pgup, pgdwn, home, end, etc)
        case (w54) {
          frame False, Default { }
          frame True {
            Property Node(instance in=w55) -> ("Message Queue"=w56, "Event"=w57, "Target"=w58, "Data"=w59)
            Property Node(instance in="Message Cluster.gtype" {all zero or empty}, "Event"=w57, "Target"=w58, "Data"=w59, "Source"="Shortcut") -> (instance out=w60)
            call "Send.gvi"(Queue Name=w56, Message=w60)
          }
        }
        w18 = default
      }
      on "Panel" Mouse up {
        Event Data() -> ("Position"=w61)
        w62 = cluster{"Horizontal": i32, "Vertical": i32} {all zero or empty}
        Coerce To Type(type=w62, x=w61)
        # #TODO
        # Poll mouse buttons using Input Device Control for mouse up instead?
        Property Node(instance in="Message Cluster.gtype" {all zero or empty}, "Event"="Mouse Up") -> (instance out=w63)
        # The Mouse Up event is sent to each deck to cancel a scratch.
        #
        # Note that the Mouse Up is for the entire pane (not just a jogwheel) as the mouse will more than likely NOT be over the jogwheel. This doesn't help the case where the mouse is released outside the window entirely.
        call "Send.gvi"(Queue Name="Deck1", Message=w63)
        call "Send.gvi"(Queue Name="Deck2", Message=w63)
        w18 = default
      }
    }
    w17 = _
    stop if w18
  }
  Unregister For Events(event registration refnum=w17)
  call "Create Message Queue.gvi"(Queue Name="UI") -> (queue out=w64)
  Release Queue(error in=no error, force destroy=TRUE, queue=w64)
  call "Find Control Refs.gvi"(Pane Reference In=w1) -> (Control Refs=w65)
  w66 = variant()  # Control Ref Map
  # What if two controls have same name? Should store them both?
  s2 = w66  # shift register
  for {
    w67 = each element of w65
    Property Node(instance in=w67) -> ("Label.Text"=w68, instance out=w69)
    Set Variant Attribute(name=w68, value=w69, variant=s2) -> (variant out=w70)
    next s2 = w70
  }
  s3 = s2  # shift register
  while {
    Wait Until Next Multiple(multiple to wait=10)
    Flush Queue(queue=w64) -> (error out=w71, remaining elements=w72)
    s4 = s3  # shift register
    for {
      w73 = each element of w72
      Property Node(instance in=w73) -> ("Event"=w74, "Target"=w75, "Data"=w76)
      case (w74) {
        frame Default {
          w77 = s4
        }
        frame "Value Change" {
          case (w75) {
            frame Default {
              Get Variant Attribute(default value="Control reference" constant, name=w75, variant=s4) -> (value=w78, variant out=w77)
              Property Node(instance in=w78, "Value"=w76)
            }
            frame "Deck1.Jogwheel" {
              Variant To Data(type=i32 0, variant=w76) -> (data=w79)
              call "Calculate Jogwheel Value.gvi"(Playback Position=w79) -> (Jogwheel Position=w80, Jogwheel Label Image=w81)
              Get Variant Attribute(default value="Control reference" constant, name=w75, variant=s4) -> (value=w82, variant out=w77)
              Property Node(instance in=w82, "Value"=w80)
              $"Deck1.JogwheelLabel" <- w81
            }
            frame "Deck2.Jogwheel" {
              Variant To Data(type=i32 0, variant=w76) -> (data=w83)
              call "Calculate Jogwheel Value.gvi"(Playback Position=w83) -> (Jogwheel Position=w84, Jogwheel Label Image=w85)
              Get Variant Attribute(default value="Control reference" constant, name=w75, variant=s4) -> (value=w86, variant out=w77)
              Property Node(instance in=w86, "Value"=w84)
              $"Deck2.JogwheelLabel" <- w85
            }
          }
        }
        frame "Slide.Scale.Maximum" {
          Variant To Data(type=f64 0, variant=w76) -> (data=w87)
          Get Variant Attribute(default value="Control reference" constant, name=w75, variant=s4) -> (value=w88, variant out=w77)
          To More Specific Class(reference=w88, target class="SliderControl reference" constant) -> w89
          Property Node(instance in=w89, "Scale.Maximum"=w87)
        }
      }
      next s4 = w77
    }
    next s3 = s4
    stop if w71
  }
  # All of the controls, laid out in roughly their placement on the front panel.
  # Tried using DeferPanelUpdates here, so the UI isn't getting spammed, but it is very jerky, even at 100Hz. Maybe needs to be even multiple of screen refresh? Or is it simply inefficient to disable and enable every 10ms?
