vi "DJ Interface.gvi"   [LabVIEW NXG 4.0.0]
# Main control interface to Dataflow DJ. Also handles all keyboard shortcuts.
# Execution System: User Interface
inputs:
  "Shutdown Event": "event Shutdown", required
  "Owning VI": VIRefnum, required
panel controls:
  "Deck1.PlaybackPosition": i32
  "Mixer.Channel1.Gain": f64 = 1
  "Mixer.Channel1.EQLowKill": bool
  "Mixer.Channel1.EQHigh": f64 = 1
  "Mixer.Channel1.EQMid": f64 = 1
  "Mixer.Channel1.EQLow": f64 = 1
  "Mixer.Channel1.EQMidKill": bool
  "Mixer.Channel1.EQHighKill": bool
  "Mixer.Channel1.Level": f64 = 1
  "Mixer.Crossfader": f64
  "Mixer.Channel2.Gain": f64 = 1
  "Mixer.Channel2.EQLowKill": bool
  "Mixer.Channel2.EQHigh": f64 = 1
  "Mixer.Channel2.EQMid": f64 = 1
  "Mixer.Channel2.EQLow": f64 = 1
  "Mixer.Channel2.EQMidKill": bool
  "Mixer.Channel2.EQHighKill": bool
  "Mixer.Channel2.Level": f64 = 1
  "Deck1.Jogwheel": i32
  "Mixer.Master": f64 = 1
  "Deck1.Play": bool
  "Mixer.Channel1.Effect1.Enable": bool
  "Mixer.Channel1.Effect2.Value2": i32 = 16
  "Mixer.Channel1.Effect2.Value1": i32 = 1
  "Mixer.Channel1.Effect2.Enable": bool
  "Mixer.Channel1.Effect3.Value1": f64
  "Mixer.Channel1.Effect3.Enable": bool
  "Mixer.Channel1.Effect3.Value2": f64
  "Deck1.Brake": bool
  "Mixer.Headphones": f64 = 1
  "Deck1.Cue1": bool
  "Deck1.Backspin": bool
  "Deck1.Reverse": bool
  "Deck1.Cue2": bool
  "Deck1.Cue3": bool
  "Deck1.PitchBendDown": bool
  "Deck1.PitchBendUp": bool
  "Mixer.Channel1.HeadphoneOutput": bool
  "Mixer.Channel2.HeadphoneOutput": bool
  "Deck1.Pitch": f64
  "Mixer.Channel1.Effect1.Value1": f64
  "Mixer.Channel1.Effect1.Value2": f64
  "Deck2.Jogwheel": i32
  "Deck2.Play": bool
  "Mixer.Channel2.Effect2.Value2": i32 = 16
  "Mixer.Channel2.Effect2.Value1": i32 = 1
  "Mixer.Channel2.Effect2.Enable": bool
  "Mixer.Channel2.Effect3.Value1": f64
  "Mixer.Channel2.Effect3.Enable": bool
  "Mixer.Channel2.Effect3.Value2": f64
  "Deck2.Brake": bool
  "Deck2.Cue1": bool
  "Deck2.Backspin": bool
  "Deck2.Reverse": bool
  "Deck2.Cue2": bool
  "Deck2.Cue3": bool
  "Deck2.PitchBendDown": bool
  "Deck2.PitchBendUp": bool
  "Deck2.Pitch": f64
  "Deck2.PlaybackPosition": i32
  "Mixer.Channel2.Effect1.Value1": f64
  "Mixer.Channel2.Effect1.Value2": f64
  "Mixer.Channel2.Effect1.Enable": bool
panel indicators:
  "Deck1.Title": string
  "Deck1.Time": string
  "Mixer.Channel1.LevelIndicator": u8
  "Mixer.Channel2.LevelIndicator": u8
  "Deck1.BPM": string
  "Deck1.Waveform": f64[][]
  "Deck2.Time": string
  "Deck2.BPM": string
  "Deck2.Waveform": f64[][]
  "Deck2.Title": string
types:
  "Keyboard Shortcut.gtype" = cluster{"Keystroke": string, "Message Queue": string, "Event": string, "Target": string, "Data": variant}
  "Message Cluster.gtype" = cluster{"Event": string, "Source": string, "Target": string, "Data": variant}
uses:
  Messaging::Create Message Queue.gvi
  Shared::Shortcuts.gvi
  Messaging::Send UI Value Change.gvi
  User Interface::Calculate Jogwheel Delta.gvi
  User Interface::Calculate Jogwheel Value.gvi
  Messaging::Parse Control Label.gvi
  User Interface::Parse Key Press.gvi
  Messaging::Send.gvi
diagram:
  call "Create Message Queue.gvi"(Queue Name="UI") -> (queue out=w1)
  disable {
    frame Disabled { }
    frame Enabled {
      w2 = variant()  # Keyboard Shortcut Map
      call "Shortcuts.gvi"() -> (Keyboard Shortcuts=w3)
      s1 = w2  # shift register
      for {
        w4 = each element of w3
        Property Node(instance in=w4) -> ("Keystroke"=w5)
        Set Variant Attribute(name=w5, value=w4, variant=s1) -> (variant out=w6)
        next s1 = w6
      }
      # #TODO
      # Make sure this runs after all message queues in the Audio Processing loop have been setup.
      Register For Events("Shutdown"=$"Shutdown Event") -> (event registration refnum out=w7)
      # These type casts do nothing. What's important is the label is being applied to the Event Registration, so the events have a sensible name in the event structure.
      while {
        event (dynamic events = w7) {
          on "Timeout" {
            w8 = default
          }
          on dynamic event 0 {
            w8 = TRUE
          }
          on "Deck1.Backspin" Value changed; "Deck1.Brake" Value changed; "Deck1.Cue1" Value changed; "Deck1.Cue2" Value changed; "Deck1.Cue3" Value changed; "Deck1.Pitch" Value changed; "Deck1.PitchBendDown" Value changed; "Deck1.PitchBendUp" Value changed; "Deck1.Play" Value changed; "Deck1.PlaybackPosition" Value changed; "Deck1.Reverse" Value changed; "Deck2.Backspin" Value changed; "Deck2.Brake" Value changed; "Deck2.Cue1" Value changed; "Deck2.Cue2" Value changed; "Deck2.Cue3" Value changed; "Deck2.Pitch" Value changed; "Deck2.PitchBendDown" Value changed; "Deck2.PitchBendUp" Value changed; "Deck2.Play" Value changed; "Deck2.PlaybackPosition" Value changed; "Deck2.Reverse" Value changed; "Mixer.Channel1.Effect1.Enable" Value changed; "Mixer.Channel1.Effect1.Value1" Value changed; "Mixer.Channel1.Effect1.Value2" Value changed; "Mixer.Channel1.Effect2.Enable" Value changed; "Mixer.Channel1.Effect2.Value1" Value changed; "Mixer.Channel1.Effect2.Value2" Value changed; "Mixer.Channel1.Effect3.Enable" Value changed; "Mixer.Channel1.Effect3.Value1" Value changed; "Mixer.Channel1.Effect3.Value2" Value changed; "Mixer.Channel1.EQHigh" Value changed; "Mixer.Channel1.EQHighKill" Value changed; "Mixer.Channel1.EQLow" Value changed; "Mixer.Channel1.EQLowKill" Value changed; "Mixer.Channel1.EQMid" Value changed; "Mixer.Channel1.EQMidKill" Value changed; "Mixer.Channel1.Gain" Value changed; "Mixer.Channel1.HeadphoneOutput" Value changed; "Mixer.Channel1.Level" Value changed; "Mixer.Channel2.Effect1.Enable" Value changed; "Mixer.Channel2.Effect1.Value1" Value changed; "Mixer.Channel2.Effect1.Value2" Value changed; "Mixer.Channel2.Effect2.Enable" Value changed; "Mixer.Channel2.Effect2.Value1" Value changed; "Mixer.Channel2.Effect2.Value2" Value changed; "Mixer.Channel2.Effect3.Enable" Value changed; "Mixer.Channel2.Effect3.Value1" Value changed; "Mixer.Channel2.Effect3.Value2" Value changed; "Mixer.Channel2.EQHigh" Value changed; "Mixer.Channel2.EQHighKill" Value changed; "Mixer.Channel2.EQLow" Value changed; "Mixer.Channel2.EQLowKill" Value changed; "Mixer.Channel2.EQMid" Value changed; "Mixer.Channel2.EQMidKill" Value changed; "Mixer.Channel2.Gain" Value changed; "Mixer.Channel2.HeadphoneOutput" Value changed; "Mixer.Channel2.Level" Value changed; "Mixer.Channel2.LevelIndicator" Value changed; "Mixer.Crossfader" Value changed; "Mixer.Headphones" Value changed; "Mixer.Master" Value changed {
            Event Data() -> ("Control Reference"=w9, "New Value"=w10)
            call "Send UI Value Change.gvi"(CtlRef=w9, Data=w10)
            w8 = default
          }
          on "Deck1.Jogwheel" Mouse down; "Deck2.Jogwheel" Mouse down {
            Event Data() -> ("Control Reference"=w11, "Button"=w12)
            case (w12) {
              frame Default { }
              frame 1 {
                To Variant(anything=0) -> w13
                # When the jogwheel is clicked, send a zero move to begin scratching on a deck.
                call "Send UI Value Change.gvi"(CtlRef=w11, Data=w13)
              }
            }
            w8 = default
          }
          on "Deck1.Jogwheel" Value changed; "Deck2.Jogwheel" Value changed {
            Event Data() -> ("Control Reference"=w14, "Old Value"=w15, "New Value"=w16)
            call "Calculate Jogwheel Delta.gvi"(Old Value=w15, New Value=w16) -> (Delta Value=w17)
            To Variant(anything=w17) -> w18
            call "Send UI Value Change.gvi"(CtlRef=w14, Data=w18)
            call "Calculate Jogwheel Value.gvi"(Playback Position=w16) -> (Jogwheel Label Image=w19)
            call "Parse Control Label.gvi"(CtlRef=w14) -> (Queue Name=w20)
            case (w20) {
              frame Default { }
              frame "Deck1" { }
              frame "Deck2" { }
            }
            w8 = default
          }
          on "Panel" Key down? {
            # Always discard the key press, and don't pass them on to controls or LabVIEW itself.
            Event Filter("Discard?"=TRUE)
            # Keyboard shortcuts can be setup directly on a control, but LabVIEW only supports function keys and other non-ASCII inputs. In this case we want any key to be a possible shortcut, so all key presses are captured here.
            Event Data() -> ("Virtual Key"=w21, "Scan Code"=w22, "Modifiers"=w23, "Platform Modifiers"=w24)
            call "Parse Key Press.gvi"(VKey=w21, ScanCode=w22, Mods=w23, PlatMods=w24) -> (Key Pressed=w25)
            Get Variant Attribute(default value="Keyboard Shortcut.gtype" {all zero or empty}, name=w25, variant=s1) -> (found?=w26, value=w27)
            # #BUG
            # While holding the mouse button down on a control (moving a slider for example), F10 will not register as a key press. All other function keys seem to work.
            #
            # WTF.
            #
            # Help mentions F3 being an issue, but that's always worked. F1 will trigger the LabVIEW help if the key press isn't discarded.
            # Register Key Down events on both THIS VI (running in a sub panel), and the owning VI. Why both? Why not just the owning VI?
            #
            # Using just the Key Down event from the owning VI works, EXCEPT for when the mouse is being held down at the same time. LabVIEW seems to redirect all input focus to the sub panel VI (this VI) while the mouse button is being held. As such the owning VI can no longer generate Key Down events.
            # #TODO
            # If file browser controls are in focus, don't execute shortcuts? Or at least allow certain key presses (arrow keys, pgup, pgdwn, home, end, etc)
            case (w26) {
              frame False, Default { }
              frame True {
                Property Node(instance in=w27) -> ("Message Queue"=w28, "Event"=w29, "Target"=w30, "Data"=w31)
                Property Node(instance in="Message Cluster.gtype" {all zero or empty}, "Event"=w29, "Target"=w30, "Data"=w31, "Source"="Shortcut") -> (instance out=w32)
                call "Send.gvi"(Queue Name=w28, Message=w32)
              }
            }
            w8 = default
          }
          on "Panel" Mouse up {
            Event Data() -> ("Position"=w33)
            w34 = cluster{"Horizontal": i32, "Vertical": i32} {all zero or empty}
            Coerce To Type(type=w34, x=w33)
            # The Mouse Up event is sent to each deck to cancel a scratch.
            #
            # Note that the Mouse Up is for the entire pane (not just a jogwheel) as the mouse will more than likely NOT be over the jogwheel. This doesn't help the case where the mouse is released outside the window entirely.
            # #TODO
            # Poll mouse buttons using Input Device Control for mouse up instead?
            Property Node(instance in="Message Cluster.gtype" {all zero or empty}, "Event"="Mouse Up") -> (instance out=w35)
            call "Send.gvi"(Queue Name="Deck1", Message=w35)
            call "Send.gvi"(Queue Name="Deck2", Message=w35)
            w8 = default
          }
        }
        stop if w8
      }
      Unregister For Events(event registration refnum=w7)
      Release Queue(error in=no error, force destroy=TRUE, queue=w1)
    }
  }
  # What if two controls have same name? Should store them both?
  This VI Reference() -> (reference out=w36)
  # This loop polls the UI message queue, and updates and controls and indicators with the specified value. All control references are stored as named attributes in a variant.
  # Tried using DeferPanelUpdates here, so the UI isn't getting spammed, but it is very jerky, even at 100Hz. Maybe needs to be even multiple of screen refresh? Or is it simply inefficient to disable and enable every 10ms?
  disable {
    frame Disabled { }
    frame Enabled {
      while {
        Wait Until Next Multiple(multiple to wait=10)
        Flush Queue(queue=w1) -> (error out=w37, remaining elements=w38)
        for {
          w39 = each element of w38
          Property Node(instance in=w39) -> ("Event"=w40, "Target"=w41, "Data"=w42)
          case (w40) {
            frame Default { }
            frame "Value Change" {
              case (w41) {
                frame Default {
                  Set Control Value(control name=w41, control value=w42, reference in=w36)
                }
                frame "Deck1.Jogwheel" {
                  Variant To Data(type=i32 0, variant=w42) -> (data=w43)
                  call "Calculate Jogwheel Value.gvi"(Playback Position=w43) -> (Jogwheel Position=w44)
                  Set Control Value(control name=w41, control value=w44, reference in=w36)
                }
                frame "Deck2.Jogwheel" {
                  Variant To Data(type=i32 0, variant=w42) -> (data=w45)
                  call "Calculate Jogwheel Value.gvi"(Playback Position=w45) -> (Jogwheel Position=w46)
                  Set Control Value(control name=w41, control value=w46, reference in=w36)
                }
              }
            }
          }
        }
        stop if w37
      }
    }
  }
  # All of the controls, laid out in roughly their placement on the front panel.
