vi "File Browser.gvi"   [LabVIEW NXG 4.0.0]
# File browser sub panel. Tracks are dragged and dropped from here to the DJ interface to load them.
# Execution System: User Interface
inputs:
  "Shutdown Event": "event Shutdown", required
panel controls:
  "Directory List": i32 = -1
  "File List": i32 = -1
  "Deck1": bool
  "Deck2": bool
panel indicators:
  "Path": path
types:
  "Message Cluster.gtype" = cluster{"Event": string, "Source": string, "Target": string, "Data": variant}
uses:
  NI::G Core::File IO (General)::Get System Directory.gvi
  Messaging::Send.gvi
diagram:
  # #TODO
  # Replace this with a tree browser
  Register For Events("Shutdown"=$"Shutdown Event") -> (event registration refnum out=w1)
  call "Get System Directory.gvi"(type="User Home") -> (system directory=w2)
  List Folder(path=w2) -> (folder names=w3)
  Is Empty String Or Path(string/path=w2) -> w4
  case (w4) {
    frame False, Default {
      Build Array("..", w3) -> w5
    }
    frame True {
      for {
        w6 = each element of w3
        Concatenate Strings(w6, ":\\") -> w7
        append w7 to w5
      }
    }
  }
  Property Node(instance in=reference to "Directory List", "Items"=w5) -> (error out=w8)  # Listbox properties
  Property Node(instance in=reference to "File List", "Items"=string[] []) -> (error out=w9)  # Listbox properties
  Merge Errors(w8, w9) -> (error out=w10)
  while (after w10) {
    event (dynamic events = w1) {
      on "Timeout" {
        w11 = default
      }
      on dynamic event 0 {
        w11 = TRUE
      }
      on "Directory List" Mouse down {
        Event Data() -> ("Control Reference"=w12, "Modifiers:Double Click"=w13, "Button"=w14)
        Is Equal(x=w14, y=1) -> w15
        Logical And(w13, w15) -> w16
        case (w16) {
          frame False, Default { }
          frame True {
            Property Node(instance in=w12) -> ("Items"=w17, instance out=w18)
            Array Size(array=w17) -> (size(s)=w19)
            Is Less(x=$"Directory List", y=w19) -> w20
            case (w20) {
              frame False, Default { }
              frame True {
                Array Index(array=w17) -> (out0[$"Directory List"]=w21)
                Build Path(base path=$Path, name or relative path=w21) -> (appended path=w22)
                $Path <- w22
                List Folder(path=w22) -> (folder names=w23)
                Is Empty String Or Path(string/path=w22) -> w24
                case (w24) {
                  frame False, Default {
                    Build Array("..", w23) -> w25
                  }
                  frame True {
                    for {
                      w26 = each element of w23
                      Concatenate Strings(w26, ":\\") -> w27
                      append w27 to w25
                    }
                  }
                }
                Property Node(instance in=w18, "Items"=w25, "TopVisibleRow"=0)
                for {
                  w28 = each element of ["*.wav", "*.mp3"]
                  List Folder(path=w22, pattern=w28) -> (file names=w30)
                  concatenate w30 onto w29
                }
                Sort 1D Array(array=w29) -> (sorted array=w31)
                Property Node(instance in=reference to "File List", "Items"=w31, "TopVisibleRow"=0)  # Listbox properties
              }
            }
          }
        }
        w11 = default
      }
      on "Deck1" Value changed; "Deck2" Value changed {
        Event Data() -> ("Control Reference"=w32)
        Property Node(instance in=w32) -> ("Label"=w33)
        Property Node(instance in=w33) -> ("Text"=w34)
        Property Node(instance in=reference to "File List") -> ("Items"=w35, "Value"=w36)
        Array Index(array=w35) -> (out0[w36]=w37)
        Build Path(base path=$Path, name or relative path=w37) -> (appended path=w38)
        Property Node(instance in="Message Cluster.gtype" {all zero or empty}, "Event"="Load Track", "Data"=w38) -> (instance out=w39)
        call "Send.gvi"(Queue Name=w34, Message=w39)
        w11 = default
      }
    }
    stop if w11
  }
  Unregister For Events(event registration refnum=w1)
  $Path <- w2
