vi "Format Sample To Time.gvi"   [LabVIEW Conversion 4.0.0]
# Convert the sample number into a time value in the form HH:MM:SS.s
inputs:
  "Samples": i32, required
outputs:
  "Formatted Time": string
diagram:
  Tag Read(ref in="Globals::Constants.grsc::Sample Rate") -> (Data=w1)
  Divide(x=$Samples, y=w1) -> w2
  To Time Stamp(number=w2) -> w3
  Timestamp To Date And Time(time stamp=w3, to UTC (F)=TRUE) -> (date time rec=w4)
  Property Node(instance in=w4) -> ("hour"=w5, "minute"=w6, "second"=w7, "fractional second"=w8)
  Multiply(60, w5) -> w9
  Add(w9, w6) -> w10
  Multiply(w8, 10) -> w11
  Round Toward Negative Infinity(x=w11) -> w12
  Format Into String(formatString="%02d:%02d.%d", w10, w7, w12) -> w13
  $"Formatted Time" <- w13
