vi "Insert Sub Panels.gvi"   [LabVIEW NXG 4.0.0]
# Starts and inserts each sub panel VI into its corresponding sub panel.
inputs:
  "Owning VI": VIRefnum, required
  "Sub Panels": "Sub Panels Cluster.gtype", required
  "Shutdown Event": "event Shutdown", required
  "error in (no error)": error
outputs:
  "error out": error
types:
  "Sub Panels Cluster.gtype" = cluster{"DJ Interface": "SubPanel reference", "File Browser": "SubPanel reference", "Audio Config": "SubPanel reference"}
uses:
  User Interface::Audio Config.gvi
  User Interface::DJ Interface.gvi
  User Interface::File Browser.gvi
diagram:
  # Pass the top level VI ref to DJ Interface.vi so it can register for Key Down events for handling keyboard shortcuts.
  Property Node(instance in=$"Sub Panels") -> ("DJ Interface"=w1, "File Browser"=w2, "Audio Config"=w3)
  call "Audio Config.gvi"() -> (VIReference=w4)
  Set Control Value(control name="Shutdown Event", control value=$"Shutdown Event", reference in=w4) -> (error out=w5, reference out=w6)
  # Start each sub panel running with the call and forget flag, then insert into the respective sub panels of the owning VI (Main.vi).
  #
  # Each sub panel VI will run until it receives a shutdown user event.
  Run VI(auto dispose=TRUE, error in=w5, reference in=w6) -> (error out=w7, reference out=w8)
  Insert VI Panel(reference in=w3, error in=w7, vi reference=w8) -> (error out=w9)
  call "DJ Interface.gvi"() -> (VIReference=w10)
  Set Control Value(control name="Shutdown Event", control value=$"Shutdown Event", reference in=w10) -> (error out=w11, reference out=w12)
  Set Control Value(control name="Owning VI", control value=$"Owning VI", error in=w11, reference in=w12) -> (error out=w13, reference out=w14)
  Run VI(auto dispose=TRUE, error in=w13, reference in=w14) -> (error out=w15, reference out=w16)
  Insert VI Panel(reference in=w1, error in=w15, vi reference=w16) -> (error out=w17)
  call "File Browser.gvi"() -> (VIReference=w18)
  Set Control Value(control name="Shutdown Event", control value=$"Shutdown Event", reference in=w18) -> (error out=w19, reference out=w20)
  Run VI(auto dispose=TRUE, error in=w19, reference in=w20) -> (error out=w21, reference out=w22)
  Insert VI Panel(reference in=w2, error in=w21, vi reference=w22) -> (error out=w23)
  Merge Errors(w17, w23, w9) -> (error out=w24)
  $"error out" <- w24
