vi "Parse Key Press.gvi"   [LabVIEW NXG 4.0.0]
# Converts key press info into a string representing the keys pressed. Output is in the form [MODIFIER + ][NUM_]SCANCODE.
# For example:
# A
# SHIFT + A
# SHIFT + CTRL + A
# NUM_ENTER
inputs:
  "VKey": "Virtual Key.gtype" = "ASCII", required
  "ScanCode": i16, required
  "Mods": cluster{"Num Pad": bool, "Menu Key": bool}, required
  "PlatMods": T1, required
outputs:
  "Key Pressed": string
types:
  "Virtual Key.gtype" = enum{"ASCII", "Enter", "Return", "Shift", "Ctrl", "Alt", "Cmd", "Opt", "Caps", "Num Lock", "Clear", "Break", "Up", "Down", "Left", "Right", "Insert", "Delete", "Home", "End", "Page Up", "Page Down", "Escape", "Help", "Pause", "Scroll Lock", "F1", "F2", "F3", "F4", "F5", "F6", "F7", "F8", "F9", "F10", "F11", "F12", "F13", "F14", "F15", "F16", "F17", "F18", "F19", "F20", "F21", "F22", "F23", "F24", "Play", "Volume Up", "Volume Down", "Mute", "Two-Byte Character"}
  T1 = cluster{"Shift": bool, "Ctrl": bool, "Alt": bool, "Cmd": bool, "Opt": bool}
diagram:
  Cluster To Array(cluster=$PlatMods) -> (array=w1)
  # Issue with ALT key as modifier in Key Down event, raised with R&D in 2008 (#44SCCJBW)
  #
  # Basically can't use it without keyboard hooks into Windows API, or polling keyboard state with LabVIEW's Input Device API
  #
  # https://forums.ni.com/t5/LabVIEW/Catching-Alt-Key-Press-with-the-Key-Down-Filter-Event/td-p/288015
  # Built up modifier string, separated by '+' character
  s1 = ""  # shift register
  for {
    w2 = each element of w1
    w3 = each element of ["SHIFT", "CTRL", "ALT"]
    case (w2) {
      frame False, Default {
        w4 = s1
      }
      frame True {
        Format Into String(formatString="%s + ", initString=s1, w3) -> w4
      }
    }
    next s1 = w4
  }
  # This array contains all keyboard keys (88), where array index is the scan code from tables below.
  # https://docs.microsoft.com/en-us/previous-versions/visualstudio/visual-studio-6.0/aa299374(v=vs.60)
  case ($VKey) {
    frame "ASCII", "Two-Byte Character" {
      w6 = ["", "ESC", "1", "2", "3", "4", "5", "6", "7", "8", "9", "0", "-", "=", "BKSP", "TAB", "Q", "W", "E", "R", "T", "Y", "U", "I", "O", "P", "[", "]", "ENTER", "CTRL", "A", "S", "D", "F", "G", "H", "J", "K", "L", ";", "'", "`", "LSHIFT", "\\", "Z", "X", "C", "V", "B", "N", "M", ",", ".", "/", "RSHIFT", "*", "ALT", "SPACE", "CAPS", "F1"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]
      Array Index(array=w6) -> (out0[$ScanCode]=w5)
    }
    frame Default {
      Format Into String($VKey) -> w7
      To Upper Case(string=w7) -> w5
    }
    frame "Return" {
      Format Into String("Enter") -> w8
      To Upper Case(string=w8) -> w5
    }
  }
  Property Node(instance in=$Mods) -> ("Num Pad"=w9)
  # Some keys share  same scan code, so prepend with NUM_ if key pressed was on numpad
  Select(s=w9, t="NUM_", f="") -> w10
  Concatenate Strings(s1, w10, w5) -> w11
  $"Key Pressed" <- w11
